# Dynamo graph LTA PIPE_Step1 Parameters (23-MAY).dyn "LTA PIPE_Step1 (without calibration )_parameter(23-MAY)" (Dynamo 2.13.1.3887)
# packages: MEPover 2022.10.30, Sparrow 2021.2.1, DynaMEP 1.2.8, Clockwork for Dynamo 2.x 2.4.0, WombatDynamo 1.3.2, Orchid 216.3.0.5842

file_path = Filename(".\PIPE_0_000000.csv")
importCSV = Data.ImportCSV(filePath=file_path)
file_path_2 = Filename(".\PIPE_0_000001.csv")
importCSV_2 = Data.ImportCSV(filePath=file_path_2)
file_path_3 = Filename(".\PIPE_0_000002.csv")
importCSV_3 = Data.ImportCSV(filePath=file_path_3)
file_path_4 = Filename(".\PIPE_0_000003.csv")
importCSV_4 = Data.ImportCSV(filePath=file_path_4)
file_path_5 = Filename(".\PIPE_0_000004.csv")
importCSV_5 = Data.ImportCSV(filePath=file_path_5)
list_create = List.Create(item0=importCSV, item1=importCSV_2, item2=importCSV_3, item3=importCSV_4, item4=importCSV_5)
code_block = CodeBlock { 0; 1; 2; }
getItemAtIndex = List.GetItemAtIndex(list=list_create@@L3, index=code_block.out0)
getItemAtIndex_2 = List.GetItemAtIndex(list=list_create@@L3, index=code_block.out1)
getItemAtIndex_3 = List.GetItemAtIndex(list=list_create@@L3, index=code_block.out2)
byCoordinates = Point.ByCoordinates(x=getItemAtIndex, y=getItemAtIndex_2, z=getItemAtIndex_3)
code_block_2 = CodeBlock { 1000; }
scale = Geometry.Scale(geometry=byCoordinates, xamount=code_block_2, yamount=code_block_2, zamount=code_block_2)
code_block_3 = CodeBlock(x=scale) { x[0][0]; }
byOrigin = CoordinateSystem.ByOrigin(origin=code_block_3)
origin = Point.Origin()
byOrigin_2 = CoordinateSystem.ByOrigin(origin=origin)
transform = Geometry.Transform(geometry=scale@L3, fromCoordinateSystem=byOrigin, contextCoordinateSystem=byOrigin_2)
code_block_4 = CodeBlock(x=transform) { x[0]; }
color_palette = ColorPalette({R: 255, G: 228, B: 181, A: 255})
byGeometryColor = Modifiers.GeometryColor.ByGeometryColor(geometry=code_block_4, color=color_palette)
file_path_6 = Filename("..\..\MEP csv 01\data DIY\pipes\1\pipe _000012.csv")  # frozen
importCSV_6 = Data.ImportCSV(filePath=file_path_6)
file_path_7 = Filename("..\..\..\MEP csv 01\data DIY\pipe PCD\pipe _000015.csv")
importCSV_7 = Data.ImportCSV(filePath=file_path_7)
file_path_8 = Filename("..\..\..\MEP csv 01\data DIY\pipe PCD\pipe _000016.csv")
importCSV_8 = Data.ImportCSV(filePath=file_path_8)
list_create_2 = List.Create()  # unwired: item0, item1
code_block_5 = CodeBlock { 0; 1; 2; }
getItemAtIndex_4 = List.GetItemAtIndex(list=list_create_2@@L3, index=code_block_5.out0)
getItemAtIndex_5 = List.GetItemAtIndex(list=list_create_2@@L3, index=code_block_5.out1)
getItemAtIndex_6 = List.GetItemAtIndex(list=list_create_2@@L3, index=code_block_5.out2)
byCoordinates_2 = Point.ByCoordinates(x=getItemAtIndex_4, y=getItemAtIndex_5, z=getItemAtIndex_6)
color_palette_2 = ColorPalette({R: 127, G: 255, B: 212, A: 255})
byGeometryColor_2 = Modifiers.GeometryColor.ByGeometryColor(color=color_palette_2)  # unwired: geometry

# group: Method 3: assume ALL to be horizontal / vertical PROJECTION + BEST FIT CIRCLE BASE ON IDENTIFIED PLANE NORMAL
code_block_6 = CodeBlock()  # frozen; unwired: PIPES_PROJECTION_PLANE, ORIENTATION_BOOLEAN
# ---------- code_block_6.designscript (8 lines) ----------
PIPES_PROJECTION_PLANE;





//-------------------
ORIENTATION_BOOLEAN;
# ----------------------------------------
origin_2 = Plane.Origin(plane=code_block_6.PIPES_PROJECTION_PLANE)
normal = Plane.Normal(plane=code_block_6.PIPES_PROJECTION_PLANE)
ZAxis = Vector.ZAxis()
angleWithVector = Vector.AngleWithVector(vector=normal, otherVector=ZAxis)
code_block_7 = CodeBlock { 45; }
lt = angleWithVector < code_block_7
ZAxis_2 = Vector.ZAxis()
X = Vector.X(vector=normal)
Y = Vector.Y(vector=normal)
byCoordinates_3 = Vector.ByCoordinates(x=X, y=Y)
if_ = RefactoredIf(test=lt@@L1, true=ZAxis_2@L1, false=byCoordinates_3@L1, lacing=Longest)
byOriginNormal = Plane.ByOriginNormal(origin=origin_2, normal=if_)
code_block_8 = CodeBlock { X; }  # unwired: X
closestPointTo = Geometry.ClosestPointTo(geometry=byOriginNormal@L1, other=code_block_8@L2, lacing=Longest)
byBestFitThroughPoints = Circle.ByBestFitThroughPoints(points=closestPointTo@L2)
code_block_9 = CodeBlock()  # unwired: tentstive_length
# ---------- code_block_9.designscript (2 lines) ----------
tentstive_length;
//extended 2times
# ----------------------------------------
radius = Circle.Radius(circle=byBestFitThroughPoints)
code_block_10 = CodeBlock { 0; }
code_block_11 = CodeBlock { 1; }

# group: Method 3: assume ALL to be horizontal / vertical PROJECTION + BEST FIT CIRCLE BASE ON IDENTIFIED PLANE NORMAL > central line
centerPoint = Circle.CenterPoint(circle=byBestFitThroughPoints)
byStartPointDirectionLength = Line.ByStartPointDirectionLength(startPoint=centerPoint, direction=if_, length=code_block_9)
closestPointTo_2 = Geometry.ClosestPointTo(geometry=byStartPointDirectionLength@L1, other=code_block_8@L2, lacing=Longest)
parameterAtPoint = Curve.ParameterAtPoint(curve=byStartPointDirectionLength@L1, point=closestPointTo_2@L2, lacing=Longest)
minimumItem = List.MinimumItem(list=parameterAtPoint@L2)
maximumItem = List.MaximumItem(list=parameterAtPoint@L2)
trimByParameter = Curve.TrimByParameter(curve=byStartPointDirectionLength, startParameter=minimumItem, endParameter=maximumItem)
code_block_12 = CodeBlock { 10000; }  # frozen

# group (continued): Method 3: assume ALL to be horizontal / vertical PROJECTION + BEST FIT CIRCLE BASE ON IDENTIFIED PLANE NORMAL
list_create_3 = List.Create(item0=trimByParameter, item1=radius)
transpose = List.Transpose(lists=list_create_3)
getItemAtIndex_7 = List.GetItemAtIndex(list=transpose@L2, index=code_block_10)
getItemAtIndex_8 = List.GetItemAtIndex(list=transpose@L2, index=code_block_11)

color_palette_3 = ColorPalette({R: 32, G: 178, B: 170, A: 255})
byGeometryColor_3 = Modifiers.GeometryColor.ByGeometryColor(geometry=getItemAtIndex_7, color=color_palette_3)

# group: Method 3: assume ALL to be horizontal / vertical PROJECTION + BEST FIT CIRCLE BASE ON IDENTIFIED PLANE NORMAL > not use
byBestFitThroughPoints_2 = Line.ByBestFitThroughPoints(bestFitPoints=code_block_8@@L2)  # frozen
length = Curve.Length(curve=byBestFitThroughPoints_2)
direction = Line.Direction(line=byBestFitThroughPoints_2)
startPoint = Curve.StartPoint(curve=byBestFitThroughPoints_2)
direction_2 = Line.Direction(line=byBestFitThroughPoints_2)
reverse = Vector.Reverse(vector=direction_2)
code_block_13 = CodeBlock { 500; }
translate = Geometry.Translate(geometry=startPoint, direction=reverse, distance=code_block_13)

# group: export csv : group A
code_block_14 = CodeBlock { [passthrough,waitfor][0]; }  # unwired: passthrough, waitfor
code_block_15 = CodeBlock { 0; 1; 2; 3; }
list_getitematindex_angle_with_z = List.GetItemAtIndex(index=code_block_15.out3)  # unwired: list
watch = Watch()  # unwired: arg0
list_getitematindex_line = List.GetItemAtIndex(list=watch@L2, index=code_block_15.out0)
startPoint_2 = Curve.StartPoint(curve=list_getitematindex_line)
deconstruct = WombatDynamo.Point.Deconstruct(point=startPoint_2)
endPoint = Curve.EndPoint(curve=list_getitematindex_line)
deconstruct_2 = WombatDynamo.Point.Deconstruct(point=endPoint)
list_getitematindex_r = List.GetItemAtIndex(list=watch@L2, index=code_block_15.out1)
list_getitematindex = List.GetItemAtIndex(list=watch@L2, index=code_block_15.out2)

# group: export csv : group A
exportCSV = Data.ExportCSV()  # frozen; unwired: filePath, data
file_path_9 = Filename(".\step0.xlsx")
code_block_16 = CodeBlock { "STEP1_output (no calibration)"; }
code_block_17 = CodeBlock { 0; 0; }
list_create_4 = List.Create(item0=deconstruct.X, item1=deconstruct.Y, item2=deconstruct.Z, item3=deconstruct_2.X, item4=deconstruct_2.Y, item5=deconstruct_2.Z, item6=list_getitematindex_r, item7=list_getitematindex)
transpose_2 = List.Transpose(lists=list_create_4)
code_block_18 = CodeBlock { true; false; }
exportToExcel = Data.ExportToExcel(filePath=file_path_9, sheetName=code_block_16, startRow=code_block_17.out0, startColumn=code_block_17.out1, data=transpose_2, overWrite=code_block_18.out0, writeAsString=code_block_18.out1)

origin_3 = Point.Origin()
code_block_19 = CodeBlock { 2000; }
byCoordinates_4 = Point.ByCoordinates(x=code_block_19)
byStartPointEndPoint = Line.ByStartPointEndPoint(startPoint=origin_3, endPoint=byCoordinates_4)
code_block_20 = CodeBlock { 3500; 300; }
byCoordinates_5 = Vector.ByCoordinates(x=code_block_20.out0, y=code_block_20.out1, z=code_block_20.out1)
join = List.Join()  # unwired: list0, list1
element_classes = ElementTypes("PipeType")
all_elements_of_class = ElementsOfType(element_class=element_classes)
element_classes_2 = ElementTypes("PipingSystemType")
all_elements_of_class_2 = ElementsOfType(element_class=element_classes_2)
code_block_21 = CodeBlock(a=all_elements_of_class, b=all_elements_of_class_2) { a[0]; b[0]; }
levels = Levels("Level 0")
code_block_22 = CodeBlock { [164, 173]; }
byLines = Custom[Pipe.ByLines](Lines=join, PipeType=code_block_21.out0, SystemType=code_block_21.out1, level=levels, Diameter=code_block_22)  # frozen; package MEPover; Creates a pipe by Line, PipeType, SystemType, Level and Diameter
select_model_element = DSModelElementSelection()  # 1 picked in the model
select_model_element_2 = DSModelElementSelection()  # 1 picked in the model
byMEPCurves = Custom[MEPFitting.ByMEPCurves](MEPCurve1=select_model_element, MEPCurve2=select_model_element_2)  # package MEPover; Creates a UnionFitting or ElbowFitting by 2 MEPCurves (Ducts, Cable Trays, Pipes or Conduits). The output may not always be all the fittings created as Revit sometimes creates extra transition fittings outside of the node transactions.
file_path_10 = Filename("..\..\..\MEP csv 01\data DIY\pipe PCD\pipe _000039.csv")  # frozen
importCSV_9 = Data.ImportCSV(filePath=file_path_10)
code_block_23 = CodeBlock(x=code_block_4) { x; }

# group: CONVEXHULL FOR line
XY = Plane.XY()
code_block_24 = CodeBlock(X=code_block_23) { X; }
closestPointTo_3 = Geometry.ClosestPointTo(geometry=XY, other=code_block_24@@L2, lacing=Longest)
code_block_25 = CodeBlock(PCD=code_block_23) { PCD; }

# group: CONVEXHULL FOR line > HORIZONTAL CONVEXHULL normal == longest boundary curve direction on xy plane
points_convexHullGrahamsScan = Custom[points_convexHullGrahamsScan](points=closestPointTo_3@@L2)  # package Sparrow; Graham's Scan Algorithm is an efficient algorithm for finding the convex hull of a finite set of points in the plane with time complexity O(N log N). The algorithm finds all vertices of the convex hull ordered along its boundary. It uses a stack to detect and remove concavities in the boundary efficiently.
deconstructPolyCurve = Geometry.Curves.DeconstructPolyCurve(polycurve=points_convexHullGrahamsScan)
direction_3 = Line.Direction(line=deconstructPolyCurve.Segments)
YAxis = Vector.YAxis()
angleWithVector_2 = Vector.AngleWithVector(vector=direction_3, otherVector=YAxis)
code_block_26 = CodeBlock { 90; }
ge = angleWithVector_2 >= code_block_26
reverse_2 = Curve.Reverse(curve=deconstructPolyCurve.Segments)
if_2 = RefactoredIf(test=ge@@L1, true=reverse_2@L1, false=deconstructPolyCurve.Segments@L1, lacing=Longest)
direction_4 = Line.Direction(line=if_2)
XAxis = Vector.XAxis()
angleWithVector_3 = Vector.AngleWithVector(vector=direction_4, otherVector=XAxis)
code_block_27 = CodeBlock { 5; }
code_block_28 = CodeBlock(angle=angleWithVector_3, x=code_block_27) { DSCore.Math.Floor(angle / x); }
groupByKey = List.GroupByKey(list=if_2@@L2, keys=code_block_28@L2)
length_2 = Curve.Length(curve=groupByKey.groups)
sum = Math.Sum(values=length_2@@L2)
maximumItem_2 = List.MaximumItem(list=sum@@L2)
indexOf = List.IndexOf(list=sum@@L2, element=maximumItem_2@L1)
getItemAtIndex_9 = List.GetItemAtIndex(list=groupByKey.groups@@L3, index=indexOf@L1)
length_3 = Curve.Length(curve=getItemAtIndex_9)
maximumItem_3 = List.MaximumItem(list=length_3@@L2)
indexOf_2 = List.IndexOf(list=length_3@L2, element=maximumItem_3@L1)
getItemAtIndex_10 = List.GetItemAtIndex(list=getItemAtIndex_9@L2, index=indexOf_2@L1)
endPoint_2 = Curve.EndPoint(curve=getItemAtIndex_10)
direction_5 = Line.Direction(line=getItemAtIndex_10)
code_block_29 = CodeBlock { 500; }
translate_2 = Geometry.Translate(geometry=endPoint_2, direction=direction_5, distance=code_block_29)
direction_6 = Line.Direction(line=getItemAtIndex_9)
average = Custom[Vector.Average](vectors=direction_6@@L2)  # package Clockwork for Dynamo 2.x; Determines the average vector of a list of vectors
reverse_3 = Vector.Reverse(vector=average)
byOriginNormal_2 = Plane.ByOriginNormal(origin=translate_2, normal=reverse_3)
code_block_30 = CodeBlock(X=code_block_24) { X; }
length_4 = Vector.Length(vector=direction_5)  # frozen

# group (continued): CONVEXHULL FOR line
closestPointTo_4 = Geometry.ClosestPointTo(geometry=byOriginNormal_2@L1, other=code_block_30@L2, lacing=Longest)
code_block_31 = CodeBlock(HORIZONTAL_PIPE_PROJECTION_PLANE=byOriginNormal_2) { HORIZONTAL_PIPE_PROJECTION_PLANE; }
code_block_32 = CodeBlock(length_HORIZONTAL=maximumItem_2) { length_HORIZONTAL * 1.5; }
code_block_33 = CodeBlock(length_HORIZONTAL=code_block_32) { length_HORIZONTAL; }

# group: CONVEXHULL FOR line > HORIZONTAL: ?
byBestFitThroughPoints_3 = Circle.ByBestFitThroughPoints(points=closestPointTo_4@L2)
centerPoint_2 = Circle.CenterPoint(circle=byBestFitThroughPoints_3)
distanceTo = Geometry.DistanceTo(geometry=closestPointTo_4@L2, other=byBestFitThroughPoints_3@L1, lacing=Longest)
average_2 = Math.Average(numbers=distanceTo@L2)
radius_2 = Circle.Radius(circle=byBestFitThroughPoints_3)
code_block_34 = CodeBlock(RADIUS=radius_2) { RADIUS * 0.25; }
lt_2 = average_2 < code_block_34
byBestFitThroughPoints_4 = Line.ByBestFitThroughPoints(bestFitPoints=code_block_30@L2)
direction_7 = Line.Direction(line=byBestFitThroughPoints_4)
deconstruct_3 = WombatDynamo.Vector.Deconstruct(vector=direction_7)
byCoordinates_6 = Vector.ByCoordinates(x=deconstruct_3.X, y=deconstruct_3.Y)
angleWithVector_4 = Vector.AngleWithVector(vector=direction_7, otherVector=byCoordinates_6)
code_block_35 = CodeBlock { 5; }
lt_3 = angleWithVector_4 < code_block_35
and_ = lt_2 && lt_3
countTrue = List.CountTrue(list=lt_3)
countTrue_2 = List.CountTrue(list=lt_2)

# group (continued): CONVEXHULL FOR line
countTrue_3 = List.CountTrue(list=and_)  # frozen

# group: CONVEXHULL FOR line > VERTICAL:? ORIGIN PCD point Z==MIN normal global Z axis
ZAxis_3 = Vector.ZAxis()
code_block_36 = CodeBlock(X=code_block_24) { X; }
byBestFitThroughPoints_5 = Line.ByBestFitThroughPoints(bestFitPoints=code_block_36@L2)
direction_8 = Line.Direction(line=byBestFitThroughPoints_5)
angleWithVector_5 = Vector.AngleWithVector(vector=ZAxis_3, otherVector=direction_8)
code_block_37 = CodeBlock { 5; }
lt_4 = angleWithVector_5 < code_block_37
countTrue_4 = List.CountTrue(list=lt_4)  # frozen
byBestFitThroughPoints_6 = Circle.ByBestFitThroughPoints(points=closestPointTo_3@L2)
distanceTo_2 = Geometry.DistanceTo(geometry=closestPointTo_3@L2, other=byBestFitThroughPoints_6@L1, lacing=Longest)
average_3 = Math.Average(numbers=distanceTo_2@L2)
radius_3 = Circle.Radius(circle=byBestFitThroughPoints_6)
code_block_38 = CodeBlock(RADIUS=radius_3) { RADIUS * 0.25; }
lt_5 = average_3 < code_block_38
and_2 = lt_5 && lt_4
countTrue_5 = List.CountTrue(list=lt_5)
Z = Point.Z(point=code_block_36@L2)
minimumItem_2 = List.MinimumItem(list=Z@L2)
indexOf_3 = List.IndexOf(list=Z@L2, element=minimumItem_2@L1)
getItemAtIndex_11 = List.GetItemAtIndex(list=code_block_36@L2, index=indexOf_3@L1)
ZAxis_4 = Vector.ZAxis()
byOriginNormal_3 = Plane.ByOriginNormal(origin=getItemAtIndex_11, normal=ZAxis_4)
length_5 = Curve.Length(curve=byBestFitThroughPoints_5)

# group: CONVEXHULL FOR line > SLANT origin at end point moving outward
byBestFitThroughPoints_7 = Line.ByBestFitThroughPoints(bestFitPoints=code_block_30@L2)
endPoint_3 = Curve.EndPoint(curve=byBestFitThroughPoints_7)
direction_9 = Line.Direction(line=byBestFitThroughPoints_7)
code_block_39 = CodeBlock { 500; }
translate_3 = Geometry.Translate(geometry=endPoint_3, direction=direction_9, distance=code_block_39)
reverse_4 = Vector.Reverse(vector=direction_9)
byOriginNormal_4 = Plane.ByOriginNormal(origin=translate_3, normal=reverse_4)
distanceTo_3 = Geometry.DistanceTo(geometry=code_block_25@@L2, other=byOriginNormal_4@L1, lacing=Longest)
code_block_5mm_step = CodeBlock(Za=distanceTo_3) { DSCore.Math.Floor(Za/5); }
groupByKey_2 = List.GroupByKey(list=code_block_25@@L2, keys=code_block_5mm_step@L2)
byBestFitThroughPoints_8 = Circle.ByBestFitThroughPoints(points=groupByKey_2.groups@@L2)
clean = Orchid.Common.List.Clean(list=byBestFitThroughPoints_8)
centerPoint_3 = Circle.CenterPoint(circle=clean)
byBestFitThroughPoints_9 = Line.ByBestFitThroughPoints(bestFitPoints=centerPoint_3@@L2)
direction_10 = Line.Direction(line=byBestFitThroughPoints_9)
length_6 = Curve.Length(curve=byBestFitThroughPoints_9)

# group: CONVEXHULL FOR line > VERTICAL
ZAxis_5 = Vector.ZAxis()
angleWithVector_6 = Vector.AngleWithVector(vector=direction_10, otherVector=ZAxis_5)
code_block_40 = CodeBlock { 5; }
lt_6 = angleWithVector_6 < code_block_40
and_3 = and_2 && lt_6

# group: CONVEXHULL FOR line > HORIZONTAL
code_block_41 = CodeBlock { 90; }
sub = angleWithVector_6 - code_block_41
abs = Math.Abs(number=sub)
code_block_42 = CodeBlock { 5; }
lt_7 = abs < code_block_42
and_4 = lt_7 && and_

# group (continued): CONVEXHULL FOR line
horizontal_verti = and_3 || and_4
countFalse = List.CountFalse(list=horizontal_verti)  # frozen
countTrue_6 = List.CountTrue(list=and_4)  # frozen
countTrue_7 = List.CountTrue(list=and_3)  # frozen
code_block_43 = CodeBlock(VERTICAL_PIPE_PROJECTION_PLANE=byOriginNormal_3) { VERTICAL_PIPE_PROJECTION_PLANE; }
if_horizontal_verti = RefactoredIf(test=and_3@@L1, true=code_block_43@L1, false=code_block_31@L1, lacing=Longest)
if_false_slant = RefactoredIf(test=horizontal_verti@@L1, true=if_horizontal_verti@L1, false=byOriginNormal_4@L1, lacing=Longest)
code_block_44 = CodeBlock(length_VERTICAL=length_5) { length_VERTICAL * 1.5; }
if_horizontal_verti_length = RefactoredIf(test=and_3@@L1, true=code_block_44@L1, false=code_block_33@L1, lacing=Longest)
code_block_45 = CodeBlock(length=length_6) { length*1.5; }
if_false_slant_length = RefactoredIf(test=horizontal_verti@@L1, true=if_horizontal_verti_length@L1, false=code_block_45@L1, lacing=Longest)

code_block_46 = CodeBlock(PIPES_PROJECTION_PLANE=if_false_slant) { PIPES_PROJECTION_PLANE; }
code_block_47 = CodeBlock(vertical_horizontal_slanted_BOOLEAN=horizontal_verti) { vertical_horizontal_slanted_BOOLEAN; }
code_block_48 = CodeBlock(PCD=code_block_25) { PCD; }
code_block_49 = CodeBlock(tentstive_length=if_false_slant_length)
# ---------- code_block_49.designscript (2 lines) ----------
tentstive_length * 3;
//extended 2times
# ----------------------------------------

# group: Method 2: slicing + NORMAL distribution : central line - radius
if_3 = RefactoredIf()  # frozen; unwired: test, true, false
code_block_50 = CodeBlock(X=code_block_48) { X; }
code_block_51 = CodeBlock(PIPES_PROJECTION_PLANE=code_block_46, ORIENTATION_BOOLEAN=code_block_47)  # same code as code_block_6
distanceTo_4 = Geometry.DistanceTo(geometry=code_block_50@@L2, other=code_block_51.PIPES_PROJECTION_PLANE@L1, lacing=Longest)
code_block_52 = CodeBlock { 5; }
code_block_5mm_step_2 = CodeBlock(Za=distanceTo_4, b=code_block_52) { DSCore.Math.Floor(Za/b); }
groupByKey_3 = List.GroupByKey(list=code_block_50@@L2, keys=code_block_5mm_step_2@L2)
distanceTo_5 = Geometry.DistanceTo(geometry=code_block_51.PIPES_PROJECTION_PLANE@L1, other=groupByKey_3.groups@@L3, lacing=Longest)
sortByKey = List.SortByKey(list=groupByKey_3.groups@@L2, keys=distanceTo_5@L2)
firstItem = List.FirstItem(list=sortByKey.sortedList@@L2)
normal_2 = Plane.Normal(plane=code_block_51.PIPES_PROJECTION_PLANE)
byOriginNormal_5 = Plane.ByOriginNormal(origin=firstItem@@L2, normal=normal_2@L1, lacing=Longest)
closestPointTo_5 = Geometry.ClosestPointTo(geometry=byOriginNormal_5@L1, other=sortByKey.sortedList@@L2)
byBestFitThroughPoints_10 = Circle.ByBestFitThroughPoints(points=closestPointTo_5@@L2)
clean_2 = Orchid.Common.List.Clean(list=byBestFitThroughPoints_10@@L2)
code_block_53 = CodeBlock { 2; }
pruneDuplicates = Point.PruneDuplicates(points=code_block_50@L2, tolerance=code_block_53)
code_block_54 = CodeBlock(PCD=pruneDuplicates) { PCD; }
code_block_55 = CodeBlock { 0; }
code_block_56 = CodeBlock { 1; }
code_block_57 = CodeBlock(tentstive_length=code_block_49)  # frozen; same code as code_block_9

# group: Method 1: projection + best fit circle
code_block_58 = CodeBlock(PIPES_PROJECTION_PLANE=code_block_46, ORIENTATION_BOOLEAN=code_block_47)  # same code as code_block_6
code_block_59 = CodeBlock(X=code_block_48) { X; }
closestPointTo_6 = Geometry.ClosestPointTo(geometry=code_block_58.PIPES_PROJECTION_PLANE@L1, other=code_block_59@L2, lacing=Longest)
byBestFitThroughPoints_11 = Circle.ByBestFitThroughPoints(points=closestPointTo_6@L2)
centerPoint_4 = Circle.CenterPoint(circle=byBestFitThroughPoints_11)
normal_3 = Plane.Normal(plane=code_block_58.PIPES_PROJECTION_PLANE)
code_block_60 = CodeBlock(tentstive_length=code_block_49)  # same code as code_block_9
radius_4 = Circle.Radius(circle=byBestFitThroughPoints_11)
code_block_61 = CodeBlock { 0; }
code_block_62 = CodeBlock { 1; }

# group: Method 1: projection + best fit circle > LINE
byStartPointDirectionLength_2 = Line.ByStartPointDirectionLength(startPoint=centerPoint_4, direction=normal_3, length=code_block_60)
closestPointTo_7 = Geometry.ClosestPointTo(geometry=byStartPointDirectionLength_2@L1, other=code_block_59@L2, lacing=Longest)
parameterAtPoint_2 = Curve.ParameterAtPoint(curve=byStartPointDirectionLength_2, point=closestPointTo_7@L2, lacing=Longest)
minimumItem_3 = List.MinimumItem(list=parameterAtPoint_2@L2)
maximumItem_4 = List.MaximumItem(list=parameterAtPoint_2@L2)
trimByParameter_2 = Curve.TrimByParameter(curve=byStartPointDirectionLength_2, startParameter=minimumItem_3, endParameter=maximumItem_4)
flatten = List.Flatten(list=trimByParameter_2)

# group (continued): Method 1: projection + best fit circle
list_create_5 = List.Create(item0=flatten, item1=radius_4)
transpose_3 = List.Transpose(lists=list_create_5)
getItemAtIndex_12 = List.GetItemAtIndex(list=transpose_3@L2, index=code_block_61)
getItemAtIndex_13 = List.GetItemAtIndex(list=transpose_3@L2, index=code_block_62)
distanceTo_6 = Geometry.DistanceTo(geometry=flatten@L1, other=code_block_59@L2, lacing=Longest)  # frozen
average_4 = Math.Average(numbers=distanceTo_6@L2)

# group: check
toLine = Geometry.Curves.ToLine(curve=getItemAtIndex_12)  # frozen
direction_11 = Line.Direction(line=toLine)
ZAxis_6 = Vector.ZAxis()
angleWithVector_7 = Vector.AngleWithVector(vector=direction_11, otherVector=ZAxis_6)

code_block_63 = CodeBlock(LINE3=getItemAtIndex_7, RADIUS3=getItemAtIndex_8)
# ---------- code_block_63.designscript (3 lines) ----------
//FROM_METHOD3;
LINE3;
RADIUS3;
# ----------------------------------------

# group: check
toLine_2 = Geometry.Curves.ToLine(curve=getItemAtIndex_7)
direction_12 = Line.Direction(line=toLine_2)
ZAxis_7 = Vector.ZAxis()
angleWithVector_8 = Vector.AngleWithVector(vector=direction_12, otherVector=ZAxis_7)

code_block_64 = CodeBlock(PCD=code_block_48) { PCD; }
code_block_65 = CodeBlock(LINE1=getItemAtIndex_12, RADIUS1=getItemAtIndex_13)
# ---------- code_block_65.designscript (3 lines) ----------
//FROM_METHOD1;
LINE1;
RADIUS1;
# ----------------------------------------
code_block_66 = CodeBlock(LINE1=code_block_65.LINE1, RADIUS1=code_block_65.RADIUS1)  # same code as code_block_65

# group: Method 2: slicing + NORMAL distribution : central line - radius > average center points & radius
centerPoint_5 = Circle.CenterPoint(circle=clean_2)
radius_5 = Circle.Radius(circle=clean_2)
sortByKey_2 = List.SortByKey(list=centerPoint_5@L2, keys=radius_5@L2)
byBestFitThroughPoints_12 = Line.ByBestFitThroughPoints(bestFitPoints=sortByKey_2.sortedList@@L2)
code_block_67 = CodeBlock { 1; }
dropItems = List.DropItems(list=sortByKey_2.sortedKeys@L2, amount=code_block_67)
code_block_68 = CodeBlock { -1; }
dropItems_2 = List.DropItems(list=dropItems@L2, amount=code_block_68)
average_5 = Math.Average(numbers=dropItems_2@L2)

# group: Method 2: slicing + NORMAL distribution : central line - radius > central line
extendEnd = Curve.ExtendEnd(curve=byBestFitThroughPoints_12)
extendStart = Curve.ExtendStart(curve=extendEnd)
closestPointTo_8 = Geometry.ClosestPointTo(geometry=extendStart@L1, other=code_block_54@L2, lacing=Longest)
parameterAtPoint_3 = Curve.ParameterAtPoint(curve=extendStart@L1, point=closestPointTo_8@L2, lacing=Longest)
minimumItem_4 = List.MinimumItem(list=parameterAtPoint_3@L2)
maximumItem_5 = List.MaximumItem(list=parameterAtPoint_3@L2)
trimByParameter_3 = Curve.TrimByParameter(curve=extendStart, startParameter=minimumItem_4, endParameter=maximumItem_5)
code_block_69 = CodeBlock { 1000; }

# group (continued): Method 2: slicing + NORMAL distribution : central line - radius
list_create_6 = List.Create(item0=trimByParameter_3, item1=average_5)
transpose_4 = List.Transpose(lists=list_create_6)
getItemAtIndex_14 = List.GetItemAtIndex(list=transpose_4@L2, index=code_block_55)
getItemAtIndex_15 = List.GetItemAtIndex(list=transpose_4@L2, index=code_block_56)

code_block_70 = CodeBlock(LINE2=getItemAtIndex_14, RADIUS2=getItemAtIndex_15)
# ---------- code_block_70.designscript (3 lines) ----------
//FROM_METHOD2;
LINE2;
RADIUS2;
# ----------------------------------------
code_block_71 = CodeBlock(LINE2=code_block_70.LINE2, RADIUS2=code_block_70.RADIUS2)  # same code as code_block_70

# group: method 3 redefine global MAIN XY
code_block_72 = CodeBlock(X=code_block_48) { X; }
code_block_73 = CodeBlock(X=code_block_72) { X; }
code_block_74 = CodeBlock(PIPES_PROJECTION_PLANE=code_block_46, ORIENTATION_BOOLEAN=code_block_47)  # same code as code_block_6
code_block_75 = CodeBlock { 5; }
code_block_76 = CodeBlock { 2; }
pruneDuplicates_2 = Point.PruneDuplicates(points=code_block_73@L2, tolerance=code_block_76)
code_block_77 = CodeBlock(PCD=pruneDuplicates_2) { PCD; }
code_block_78 = CodeBlock { 0; }
code_block_79 = CodeBlock { 1; }
if_4 = RefactoredIf()  # frozen; unwired: test, true, false

code_block_80 = CodeBlock(tentstive_length=code_block_49)  # same code as code_block_9
color_palette_4 = ColorPalette({R: 0, G: 128, B: 128, A: 126})

# group: export csv : group A
code_block_81 = CodeBlock { "START_X"; "START_Y"; "START_Z"; "END_X"; "END_Y"; "END_Z"; "RADIUS"; "PERCENTAGE"; "ANGLE_with_Z"; }
join_2 = List.Join(list0=code_block_81.out0, list1=code_block_81.out1, list2=code_block_81.out2, list3=code_block_81.out3, list4=code_block_81.out4, list5=code_block_81.out5, list6=code_block_81.out6, list7=code_block_81.out7, list8=code_block_81.out8)

# group: ANGLE WITH Z CHECK LESS THAN 5 DEGREE (ACCURACY MAY BE COMPROMISED)
code_block_82 = CodeBlock()  # frozen; unwired: ANGLE_FROM_ALL_METHODS
# ---------- code_block_82.designscript (2 lines) ----------
ANGLE_FROM_ALL_METHODS;
//WITH Z AXIS;
# ----------------------------------------
code_block_83 = CodeBlock()  # frozen; unwired: ANGLE1, ANGLE2
# ---------- code_block_83.designscript (4 lines) ----------
ANGLE1;
ANGLE2;
// NOT INCLUDE ANGLE3
	//found by absolute H/V;
# ----------------------------------------
list_create_7 = List.Create(item0=code_block_83.ANGLE1, item1=code_block_83.ANGLE2)
transpose_5 = List.Transpose(lists=list_create_7)
code_block_84 = CodeBlock { PCD; }  # unwired: PCD
code_block_85 = CodeBlock()  # frozen; unwired: LINE1, RADIUS1, LINE2, RADIUS2
# ---------- code_block_85.designscript (16 lines) ----------
//FROM_METHOD1;
LINE1;
RADIUS1;




//FROM_METHOD2;
LINE2;
RADIUS2;




// NOT INCLUDE method3
	//found by absolute H/V;
# ----------------------------------------

# group: ANGLE WITH Z CHECK LESS THAN 5 DEGREE (ACCURACY MAY BE COMPROMISED) > HORIZONTAL
code_block_86 = CodeBlock { 90; 5; }
eq = Equals(x=transpose_5, y=code_block_86.out0, tolerance=code_block_86.out1)
allTrue = List.AllTrue(list=eq@L2)

# group: ANGLE WITH Z CHECK LESS THAN 5 DEGREE (ACCURACY MAY BE COMPROMISED) > VERTICAL
code_block_87 = CodeBlock { 0; 5; }
eq_2 = Equals(x=transpose_5, y=code_block_87.out0, tolerance=code_block_87.out1)
code_block_88 = CodeBlock { 180; 5; }
eq_3 = Equals(x=transpose_5, y=code_block_88.out0, tolerance=code_block_88.out1)
or_ = eq_2 || eq_3
allTrue_2 = List.AllTrue(list=or_@L2)

# group (continued): ANGLE WITH Z CHECK LESS THAN 5 DEGREE (ACCURACY MAY BE COMPROMISED)
or_2 = allTrue || allTrue_2

code_block_89 = CodeBlock(TRANSPOSED_INFO=transpose_3)
# ---------- code_block_89.designscript (2 lines) ----------
TRANSPOSED_INFO;
//LINE + RADIUS
# ----------------------------------------
dropEveryNthItem = List.DropEveryNthItem()  # unwired: list, n
firstItem_2 = List.FirstItem()  # frozen; unwired: list
normal_4 = Plane.Normal()  # unwired: plane
code_block_90 = CodeBlock { 5000; }
byStartPointDirectionLength_3 = Line.ByStartPointDirectionLength(startPoint=firstItem_2, direction=normal_4, length=code_block_90)

# group: Method 2: slicing + NORMAL distribution : central line - radius
code_block_91 = CodeBlock { X; }  # frozen; unwired: X
code_block_92 = CodeBlock()  # unwired: PIPES_PROJECTION_PLANE, ORIENTATION_BOOLEAN; same code as code_block_6
distanceTo_7 = Geometry.DistanceTo(geometry=code_block_91@@L2, other=code_block_92.PIPES_PROJECTION_PLANE@L1, lacing=Longest)
code_block_5mm_step_3 = CodeBlock(Za=distanceTo_7) { DSCore.Math.Floor(Za/5); }
groupByKey_4 = List.GroupByKey(list=code_block_91@@L2, keys=code_block_5mm_step_3@L2)
byBestFitThroughPoints_13 = Circle.ByBestFitThroughPoints(points=groupByKey_4.groups@@L2)
clean_3 = Orchid.Common.List.Clean(list=byBestFitThroughPoints_13@@L2)
code_block_93 = CodeBlock { 1; }
code_block_94 = CodeBlock { 0; }
code_block_95 = CodeBlock { PCD; }  # unwired: PCD
code_block_96 = CodeBlock()  # unwired: tentstive_length; same code as code_block_9

# group: Method 2: slicing + NORMAL distribution : central line - radius
centerPoint_6 = Circle.CenterPoint(circle=clean_3)
radius_6 = Circle.Radius(circle=clean_3)
sortByKey_3 = List.SortByKey(list=centerPoint_6@L2, keys=radius_6@L2)
byBestFitThroughPoints_14 = Line.ByBestFitThroughPoints(bestFitPoints=sortByKey_3.sortedList@@L2)
code_block_97 = CodeBlock { 1; }
dropItems_3 = List.DropItems(list=sortByKey_3.sortedKeys@L2, amount=code_block_97)
code_block_98 = CodeBlock { -1; }
dropItems_4 = List.DropItems(list=dropItems_3@L2, amount=code_block_98)
average_6 = Math.Average(numbers=dropItems_4@L2)

# group: Method 2: slicing + NORMAL distribution : central line - radius > central line
code_block_99 = CodeBlock { 1000; }
extendEnd_2 = Curve.ExtendEnd(curve=byBestFitThroughPoints_14, distance=code_block_99)
extendStart_2 = Curve.ExtendStart(curve=extendEnd_2, distance=code_block_99)
closestPointTo_9 = Geometry.ClosestPointTo(geometry=extendStart_2@L1, other=code_block_91@L2, lacing=Longest)
parameterAtPoint_4 = Curve.ParameterAtPoint(curve=extendStart_2@L1, point=closestPointTo_9@L2, lacing=Longest)
minimumItem_5 = List.MinimumItem(list=parameterAtPoint_4@L2)
maximumItem_6 = List.MaximumItem(list=parameterAtPoint_4@L2)
trimByParameter_4 = Curve.TrimByParameter(curve=extendStart_2, startParameter=minimumItem_5, endParameter=maximumItem_6)

# group (continued): Method 2: slicing + NORMAL distribution : central line - radius
list_create_8 = List.Create(item0=trimByParameter_4, item1=average_6)  # frozen
transpose_6 = List.Transpose(lists=list_create_8)
getItemAtIndex_16 = List.GetItemAtIndex(list=transpose_6@L2, index=code_block_93)
getItemAtIndex_17 = List.GetItemAtIndex(list=transpose_6@L2, index=code_block_94)

# group: Method 2: slicing + NORMAL distribution : central line - radius > how many points are contained in the radius buffer: comparison Method 1: purly
code_block_100 = CodeBlock(PCD=code_block_91) { PCD; }
code_block_101 = CodeBlock { 0.5; }
pruneDuplicates_3 = Point.PruneDuplicates(points=code_block_100@L2, tolerance=code_block_101)
distanceTo_8 = Geometry.DistanceTo(geometry=pruneDuplicates_3@@L2, other=trimByParameter_4@L1)
code_block_102 = CodeBlock { 10; }
eq_4 = Equals(x=distanceTo_8@L2, y=average_6@L1, tolerance=code_block_102@L1, lacing=Longest)
countTrue_8 = List.CountTrue(list=eq_4@L2)
count = List.Count(list=eq_4@L2)
mod = CodeBlock(TRUE=countTrue_8, COUNT=count) { TRUE/COUNT * 100; }

# group: check
toLine_3 = Geometry.Curves.ToLine(curve=getItemAtIndex_14)
direction_13 = Line.Direction(line=toLine_3)
ZAxis_8 = Vector.ZAxis()
angleWithVector_9 = Vector.AngleWithVector(vector=direction_13, otherVector=ZAxis_8)

# group: check
color_palette_5 = ColorPalette({R: 255, G: 140, B: 0, A: 120})
byGeometryColor_4 = Modifiers.GeometryColor.ByGeometryColor(geometry=getItemAtIndex_14, color=color_palette_5)

# group: Method 2: slicing + NORMAL distribution : central line - radius
code_block_103 = CodeBlock(X=code_block_84) { X; }
code_block_104 = CodeBlock { 2; }
pruneDuplicates_4 = Point.PruneDuplicates(points=code_block_103@L2, tolerance=code_block_104)
code_block_105 = CodeBlock(horizontal_boolean=allTrue, vertical_boolean=allTrue_2) { horizontal_boolean; vertical_boolean; }
code_block_106 = CodeBlock(line=code_block_85.LINE2) { line; }
toLine_4 = Geometry.Curves.ToLine(curve=code_block_106)
or_3 = code_block_105.horizontal_boolean || code_block_105.vertical_boolean
code_block_107 = CodeBlock(PCD=pruneDuplicates_4) { PCD; }
list_create_9 = List.Create()  # frozen; unwired: item0, item1
transpose_7 = List.Transpose(lists=list_create_9)
code_block_108 = CodeBlock { 0; }
code_block_109 = CodeBlock { 1; }

# group: Method 2: slicing + NORMAL distribution : central line - radius > replacing projection plane
startPoint_3 = Curve.StartPoint(curve=toLine_4)
Z_2 = Point.Z(point=startPoint_3)
endPoint_4 = Curve.EndPoint(curve=toLine_4)
Z_3 = Point.Z(point=endPoint_4)
lt_8 = Z_2 < Z_3
if_5 = RefactoredIf(test=lt_8@@L1, true=startPoint_3@L1, false=endPoint_4@L1, lacing=Longest)
ZAxis_9 = Vector.ZAxis()
byOriginNormal_6 = Plane.ByOriginNormal(origin=if_5, normal=ZAxis_9)
direction_14 = Line.Direction(line=toLine_4)
deconstruct_4 = WombatDynamo.Vector.Deconstruct(vector=direction_14)
byCoordinates_7 = Vector.ByCoordinates(x=deconstruct_4.X, y=deconstruct_4.Y)
byOriginNormal_7 = Plane.ByOriginNormal(origin=startPoint_3, normal=byCoordinates_7)
byOriginNormal_8 = Plane.ByOriginNormal(origin=startPoint_3, normal=direction_14)
if_6 = RefactoredIf(test=code_block_105.horizontal_boolean@@L1, true=byOriginNormal_7@L1, false=byOriginNormal_8@L1, lacing=Longest)
if_7 = RefactoredIf(test=code_block_105.vertical_boolean@@L1, true=byOriginNormal_6@L1, false=if_6@L1, lacing=Longest)

# group (continued): Method 2: slicing + NORMAL distribution : central line - radius
code_block_110 = CodeBlock(PIPES_PROJECTION_PLANE=if_7, ORIENTATION_BOOLEAN=or_3)  # same code as code_block_6
distanceTo_9 = Geometry.DistanceTo(geometry=code_block_103@@L2, other=code_block_110.PIPES_PROJECTION_PLANE@L1, lacing=Longest)
code_block_5mm_step_4 = CodeBlock(Za=distanceTo_9) { DSCore.Math.Floor(Za/5); }
groupByKey_5 = List.GroupByKey(list=code_block_103@@L2, keys=code_block_5mm_step_4@L2)
byBestFitThroughPoints_15 = Circle.ByBestFitThroughPoints(points=groupByKey_5.groups@@L2)
clean_4 = Orchid.Common.List.Clean(list=byBestFitThroughPoints_15@@L2)
code_block_111 = CodeBlock(PIPES_PROJECTION_PLANE=code_block_110.PIPES_PROJECTION_PLANE) { PIPES_PROJECTION_PLANE; }
circle_centerpoint_from_each = Circle.CenterPoint(circle=clean_4@@L2)  # "Circle.CenterPoint: from each slice"
closestPointTo_10 = Geometry.ClosestPointTo(geometry=code_block_111@@L1, other=circle_centerpoint_from_each@L2, lacing=Longest)
closestPointTo_11 = Geometry.ClosestPointTo(geometry=code_block_111@@L1, other=code_block_103@L2, lacing=Longest)
normal_5 = Plane.Normal(plane=code_block_110.PIPES_PROJECTION_PLANE)
code_block_112 = CodeBlock(direction=normal_5) { direction; }
radius_7 = Circle.Radius(circle=clean_4)

# group: Method 2: slicing + NORMAL distribution : central line - radius > for slanted pipes average center points & radius
centerPoint_7 = Circle.CenterPoint(circle=clean_4)
radius_8 = Circle.Radius(circle=clean_4)
sortByKey_4 = List.SortByKey(list=centerPoint_7@L2, keys=radius_8@L2)
byBestFitThroughPoints_16 = Line.ByBestFitThroughPoints(bestFitPoints=sortByKey_4.sortedList@@L2)
code_block_113 = CodeBlock { 1; }
dropItems_5 = List.DropItems(list=sortByKey_4.sortedKeys@L2, amount=code_block_113)
code_block_114 = CodeBlock { -1; }
dropItems_6 = List.DropItems(list=dropItems_5@L2, amount=code_block_114)
average_7 = Math.Average(numbers=dropItems_6@L2)

# group: Method 2: slicing + NORMAL distribution : central line - radius > central line
code_block_115 = CodeBlock { 1000; }
extendEnd_3 = Curve.ExtendEnd(curve=byBestFitThroughPoints_16, distance=code_block_115)
extendStart_3 = Curve.ExtendStart(curve=extendEnd_3, distance=code_block_115)
closestPointTo_12 = Geometry.ClosestPointTo(geometry=extendStart_3@L1, other=code_block_107@L2, lacing=Longest)
parameterAtPoint_5 = Curve.ParameterAtPoint(curve=extendStart_3@L1, point=closestPointTo_12@L2, lacing=Longest)
minimumItem_6 = List.MinimumItem(list=parameterAtPoint_5@L2)
maximumItem_7 = List.MaximumItem(list=parameterAtPoint_5@L2)
trimByParameter_5 = Curve.TrimByParameter(curve=extendStart_3, startParameter=minimumItem_6, endParameter=maximumItem_7)

# group: how many points are contained in the radius buffer: comparison Method 1: purly
code_block_116 = CodeBlock(PCD=pruneDuplicates_4) { PCD; }
code_block_117 = CodeBlock { 0.5; }
pruneDuplicates_5 = Point.PruneDuplicates(points=code_block_116@L2, tolerance=code_block_117)
distanceTo_10 = Geometry.DistanceTo(geometry=pruneDuplicates_5@@L2, other=trimByParameter_5@L1)
code_block_118 = CodeBlock { 10; }
eq_5 = Equals(x=distanceTo_10@L2, y=average_7@L1, tolerance=code_block_118@L1, lacing=Longest)
countTrue_9 = List.CountTrue(list=eq_5@L2)
count_2 = List.Count(list=eq_5@L2)
mod_2 = CodeBlock(TRUE=countTrue_9, COUNT=count_2) { TRUE/COUNT * 100; }

# group: Method 2: slicing + NORMAL distribution : central line - radius > REDUCE computing demand
code_block_119 = CodeBlock { 1; }
pruneDuplicates_6 = Point.PruneDuplicates(points=closestPointTo_10@L2, tolerance=code_block_119)
shuffle = List.Shuffle(list=closestPointTo_11@L2)
code_block_120 = CodeBlock { 2; }
takeEveryNthItem = List.TakeEveryNthItem(list=shuffle@L2, n=code_block_120)
code_block_121 = CodeBlock { 1; }
pruneDuplicates_7 = Point.PruneDuplicates(points=takeEveryNthItem@L2, tolerance=code_block_121)
count_3 = List.Count(list=pruneDuplicates_6@L2)
ofRepeatedItem = List.OfRepeatedItem(item=pruneDuplicates_7@L2, amount=count_3@L1)

# group (continued): Method 2: slicing + NORMAL distribution : central line - radius
distanceTo_11 = Geometry.DistanceTo(geometry=pruneDuplicates_6@L1, other=ofRepeatedItem@@L2, lacing=Longest)
list_create_10 = List.Create(item0=trimByParameter_5, item1=average_7)
transpose_8 = List.Transpose(lists=list_create_10)

# group: Method 2: slicing + NORMAL distribution : central line - radius > best centerpoint ==MIN STDV
average_8 = Math.Average(numbers=distanceTo_11@@L2)
sub_2 = distanceTo_11@@L2 - average_8@L1  # lacing=Longest
code_block_122 = CodeBlock { 2; }
pow = Math.Pow(number=sub_2, power=code_block_122)
sum_2 = Math.Sum(values=pow@@L2)
count_4 = List.Count(list=distanceTo_11@@L2)
stdv2 = sum_2 / count_4
sqrt = Math.Sqrt(number=stdv2)
minimumItem_7 = List.MinimumItem(list=sqrt@@L2)
indexOf_4 = List.IndexOf(list=sqrt@@L2, element=minimumItem_7@L1)
list_getitematindex_center_point = List.GetItemAtIndex(list=pruneDuplicates_6@L2, index=indexOf_4@L1)

# group: Method 2: slicing + NORMAL distribution : central line - radius > central line
code_block_123 = CodeBlock { 8000; }
byStartPointDirectionLength_4 = Line.ByStartPointDirectionLength(startPoint=list_getitematindex_center_point, direction=code_block_112, length=code_block_123)
closestPointTo_13 = Geometry.ClosestPointTo(geometry=byStartPointDirectionLength_4@L1, other=pruneDuplicates_4@L2, lacing=Longest)
parameterAtPoint_6 = Curve.ParameterAtPoint(curve=byStartPointDirectionLength_4@L1, point=closestPointTo_13@L2, lacing=Longest)
minimumItem_8 = List.MinimumItem(list=parameterAtPoint_6@L2)
maximumItem_8 = List.MaximumItem(list=parameterAtPoint_6@L2)
trimByParameter_6 = Curve.TrimByParameter(curve=byStartPointDirectionLength_4, startParameter=minimumItem_8, endParameter=maximumItem_8)

# group (continued): Method 2: slicing + NORMAL distribution : central line - radius
code_block_124 = CodeBlock(CENTERPOINT=list_getitematindex_center_point)
# ---------- code_block_124.designscript (2 lines) ----------
CENTERPOINT;
//ON THE PROJECTION PLANE
# ----------------------------------------
code_block_125 = CodeBlock(CENTERPOINT=code_block_124)  # same code as code_block_124

# group: Method 2: slicing + NORMAL distribution : central line - radius > REDUCE computing demand
byCoordinates_8 = Point.ByCoordinates(x=radius_7)
pruneDuplicates_8 = Point.PruneDuplicates(points=byCoordinates_8@L2, tolerance=code_block_119)
point_deconstruct_radius = WombatDynamo.Point.Deconstruct(point=pruneDuplicates_8)
normal_6 = Plane.Normal(plane=code_block_110.PIPES_PROJECTION_PLANE)
byCenterPointRadiusNormal = Circle.ByCenterPointRadiusNormal(centerPoint=code_block_125@@L1, radius=point_deconstruct_radius.X@L2, normal=normal_6@L1, lacing=Longest)
count_5 = List.Count(list=point_deconstruct_radius.X@L2)
ofRepeatedItem_2 = List.OfRepeatedItem(item=pruneDuplicates_7@L2, amount=count_5@L1)

# group (continued): Method 2: slicing + NORMAL distribution : central line - radius
distanceTo_12 = Geometry.DistanceTo(geometry=byCenterPointRadiusNormal@@L1, other=ofRepeatedItem_2@L2, lacing=Longest)

# group: Method 2: slicing + NORMAL distribution : central line - radius > BEST RADIUS == MIN AVERAGE
average_9 = Math.Average(numbers=distanceTo_12@@L2)
minimumItem_9 = List.MinimumItem(list=average_9@@L2)
indexOf_5 = List.IndexOf(list=average_9@@L2, element=minimumItem_9@L1)
list_getitematindex_radius = List.GetItemAtIndex(list=point_deconstruct_radius.X@L2, index=indexOf_5@L1)

# group (continued): Method 2: slicing + NORMAL distribution : central line - radius
list_create_11 = List.Create(item0=trimByParameter_6, item1=list_getitematindex_radius)
transpose_9 = List.Transpose(lists=list_create_11)
if_8 = RefactoredIf(test=code_block_110.ORIENTATION_BOOLEAN@@L1, true=transpose_9@L2, false=transpose_8@L2)
getItemAtIndex_18 = List.GetItemAtIndex(list=if_8@L2, index=code_block_108)
getItemAtIndex_19 = List.GetItemAtIndex(list=if_8@L2, index=code_block_109)

code_block_126 = CodeBlock(LINE2=getItemAtIndex_18, RADIUS2=getItemAtIndex_19)  # same code as code_block_70
code_block_127 = CodeBlock()  # unwired: TRANSPOSED_INFO; same code as code_block_89

# group: check
toLine_5 = Geometry.Curves.ToLine(curve=getItemAtIndex_18)
direction_15 = Line.Direction(line=toLine_5)
ZAxis_10 = Vector.ZAxis()
angleWithVector_10 = Vector.AngleWithVector(vector=direction_15, otherVector=ZAxis_10)

# group: check
color_palette_6 = ColorPalette({R: 255, G: 140, B: 0, A: 120})
byGeometryColor_5 = Modifiers.GeometryColor.ByGeometryColor(geometry=getItemAtIndex_18, color=color_palette_6)

color_palette_7 = ColorPalette({R: 32, G: 178, B: 170, A: 255})
code_block_128 = CodeBlock()  # unwired: LINE_x, R_average
# ---------- code_block_128.designscript (3 lines) ----------
//FROM METHOD4;
LINE_x;
R_average;
# ----------------------------------------
code_block_129 = CodeBlock { X; }  # unwired: X
code_block_130 = CodeBlock()  # unwired: PIPES_PROJECTION_PLANE, ORIENTATION_BOOLEAN; same code as code_block_6
distanceTo_13 = Geometry.DistanceTo()  # unwired: geometry, other

# group: how many points are contained in the radius buffer: comparison Method 1: purly
code_block_131 = CodeBlock { PCD; }  # frozen; unwired: PCD
code_block_132 = CodeBlock { 0.5; }
pruneDuplicates_9 = Point.PruneDuplicates(points=code_block_131@L2, tolerance=code_block_132)
distanceTo_14 = Geometry.DistanceTo(geometry=pruneDuplicates_9@@L2)  # unwired: other
code_block_133 = CodeBlock { 10; }
eq_6 = Equals(x=distanceTo_14@L2, tolerance=code_block_133@L1, lacing=Longest)  # unwired: y
countTrue_10 = List.CountTrue(list=eq_6@L2)
count_6 = List.Count(list=eq_6@L2)
mod_3 = CodeBlock(TRUE=countTrue_10, COUNT=count_6) { TRUE/COUNT * 100; }

# group: 3n xyz
file_path_11 = Filename("..\..\..\MEP csv 01\data DIY\pipe PCD\pipe _000000.csv")
importCSV_10 = Data.ImportCSV(filePath=file_path_11)
file_path_12 = Filename("..\..\..\MEP csv 01\data DIY\pipe PCD\pipe _000001.csv")
importCSV_11 = Data.ImportCSV(filePath=file_path_12)
file_path_13 = Filename("..\..\..\MEP csv 01\data DIY\pipe PCD\pipe _000002.csv")
importCSV_12 = Data.ImportCSV(filePath=file_path_13)
file_path_14 = Filename("..\..\..\MEP csv 01\data DIY\pipe PCD\pipe _000003.csv")
importCSV_13 = Data.ImportCSV(filePath=file_path_14)
file_path_15 = Filename("..\..\..\MEP csv 01\data DIY\pipe PCD\pipe _000004.csv")
importCSV_14 = Data.ImportCSV(filePath=file_path_15)
file_path_16 = Filename("..\..\..\MEP csv 01\data DIY\pipe PCD\pipe _000006.csv")
importCSV_15 = Data.ImportCSV(filePath=file_path_16)
file_path_17 = Filename("..\..\..\MEP csv 01\data DIY\pipe PCD\pipe _000007.csv")
importCSV_16 = Data.ImportCSV(filePath=file_path_17)

file_path_18 = Filename("..\..\..\MEP csv 01\data DIY\pipe PCD\pipe _000008.csv")
importCSV_17 = Data.ImportCSV(filePath=file_path_18)
file_path_19 = Filename("..\..\..\MEP csv 01\data DIY\pipe PCD\pipe _000009.csv")
importCSV_18 = Data.ImportCSV(filePath=file_path_19)
file_path_20 = Filename("..\..\..\MEP csv 01\data DIY\pipe PCD\pipe _000010.csv")
importCSV_19 = Data.ImportCSV(filePath=file_path_20)
file_path_21 = Filename("..\..\..\MEP csv 01\data DIY\pipe PCD\pipe _000012.csv")
importCSV_20 = Data.ImportCSV(filePath=file_path_21)
file_path_22 = Filename("..\..\..\MEP csv 01\data DIY\pipe PCD\pipe _000014.csv")
importCSV_21 = Data.ImportCSV(filePath=file_path_22)
file_path_23 = Filename("..\..\..\MEP csv 01\data DIY\pipe PCD\pipe _000017.csv")
importCSV_22 = Data.ImportCSV(filePath=file_path_23)
file_path_24 = Filename("..\..\..\MEP csv 01\data DIY\pipe PCD\pipe _000019.csv")
importCSV_23 = Data.ImportCSV(filePath=file_path_24)
file_path_25 = Filename("..\..\..\MEP csv 01\data DIY\pipe PCD\pipe _000020.csv")
importCSV_24 = Data.ImportCSV(filePath=file_path_25)
file_path_26 = Filename("..\..\..\MEP csv 01\data DIY\pipe PCD\pipe _000021.csv")
importCSV_25 = Data.ImportCSV(filePath=file_path_26)

# group: 3n xyz
file_path_27 = Filename("..\..\..\MEP csv 01\data DIY\pipe PCD\pipe _000022.csv")
importCSV_26 = Data.ImportCSV(filePath=file_path_27)
file_path_28 = Filename("..\..\..\MEP csv 01\data DIY\pipe PCD\pipe _000023.csv")
importCSV_27 = Data.ImportCSV(filePath=file_path_28)
file_path_29 = Filename("..\..\..\MEP csv 01\data DIY\pipe PCD\pipe _000024.csv")
importCSV_28 = Data.ImportCSV(filePath=file_path_29)

file_path_30 = Filename("..\..\..\MEP csv 01\data DIY\pipe PCD\pipe _000025.csv")
importCSV_29 = Data.ImportCSV(filePath=file_path_30)
file_path_31 = Filename("..\..\..\MEP csv 01\data DIY\pipe PCD\pipe _000026.csv")
importCSV_30 = Data.ImportCSV(filePath=file_path_31)
file_path_32 = Filename("..\..\..\MEP csv 01\data DIY\pipe PCD\pipe _000027.csv")
importCSV_31 = Data.ImportCSV(filePath=file_path_32)
file_path_33 = Filename("..\..\..\MEP csv 01\data DIY\pipe PCD\pipe _000028.csv")
importCSV_32 = Data.ImportCSV(filePath=file_path_33)
file_path_34 = Filename("..\..\..\MEP csv 01\data DIY\pipe PCD\pipe _000029.csv")
importCSV_33 = Data.ImportCSV(filePath=file_path_34)
file_path_35 = Filename("..\..\..\MEP csv 01\data DIY\pipe PCD\pipe _000030.csv")
importCSV_34 = Data.ImportCSV(filePath=file_path_35)
file_path_36 = Filename("..\..\..\MEP csv 01\data DIY\pipe PCD\pipe _000031.csv")
importCSV_35 = Data.ImportCSV(filePath=file_path_36)

# group: short
file_path_37 = Filename("..\..\..\MEP csv 01\data DIY\pipe PCD\pipe _000032.csv")
importCSV_36 = Data.ImportCSV(filePath=file_path_37)
file_path_38 = Filename("..\..\..\MEP csv 01\data DIY\pipe PCD\pipe _000034.csv")
importCSV_37 = Data.ImportCSV(filePath=file_path_38)
file_path_39 = Filename("..\..\..\MEP csv 01\data DIY\pipe PCD\pipe _000033.csv")
importCSV_38 = Data.ImportCSV(filePath=file_path_39)
file_path_40 = Filename("..\..\..\MEP csv 01\data DIY\pipe PCD\pipe _000035.csv")
importCSV_39 = Data.ImportCSV(filePath=file_path_40)
file_path_41 = Filename("..\..\..\MEP csv 01\data DIY\pipe PCD\pipe _000036.csv")
importCSV_40 = Data.ImportCSV(filePath=file_path_41)
file_path_42 = Filename("..\..\..\MEP csv 01\data DIY\pipe PCD\pipe _000037.csv")
importCSV_41 = Data.ImportCSV(filePath=file_path_42)

file_path_43 = Filename("..\..\..\MEP csv 01\data DIY\pipe PCD\pipe _000038.csv")
importCSV_42 = Data.ImportCSV(filePath=file_path_43)
file_path_44 = Filename("..\..\..\MEP csv 01\data DIY\pipe PCD\pipe _000039.csv")
importCSV_43 = Data.ImportCSV(filePath=file_path_44)
list_create_12 = List.Create(item0=importCSV_10, item1=importCSV_11, item2=importCSV_12, item3=importCSV_13, item4=importCSV_14, item5=importCSV_15, item6=importCSV_16, item7=importCSV_17, item8=importCSV_18, item9=importCSV_19, item10=importCSV_20, item11=importCSV_21, item12=importCSV_22, item13=importCSV_23, item14=importCSV_24, item15=importCSV_25, item16=importCSV_26, item17=importCSV_27, item18=importCSV_28, item19=importCSV_29, item20=importCSV_30, item21=importCSV_31, item22=importCSV_32, item23=importCSV_33, item24=importCSV_34, item25=importCSV_35, item26=importCSV_36, item27=importCSV_37, item28=importCSV_38, item29=importCSV_39, item30=importCSV_40, item31=importCSV_41, item32=importCSV_42, item33=importCSV_43)  # frozen
shuffle_2 = List.Shuffle(list=code_block_4@@L2)
code_block_134 = CodeBlock { 2; }
takeEveryNthItem_2 = List.TakeEveryNthItem(list=shuffle_2@@L2, n=code_block_134)
origin_4 = Point.Origin()
code_block_135 = CodeBlock { 1; }
code_block_136 = CodeBlock { 1; }

# group: XY LINE
getItemAtIndex_20 = List.GetItemAtIndex()  # frozen; unwired: list, index
firstItem_3 = List.FirstItem(list=getItemAtIndex_20@L2)
startPoint_4 = Curve.StartPoint(curve=firstItem_3)
direction_16 = Line.Direction(line=getItemAtIndex_20)
average_10 = Custom[Vector.Average](vectors=direction_16@@L2)
code_block_137 = CodeBlock { 5000; }
byStartPointDirectionLength_5 = Line.ByStartPointDirectionLength(startPoint=startPoint_4, direction=average_10, length=code_block_137)
extendStart_4 = Curve.ExtendStart(curve=byStartPointDirectionLength_5, distance=code_block_137)

# group: STANTED CONVEXHULL
ZAxis_11 = Vector.ZAxis()
cross = Vector.Cross(vector=ZAxis_11, cross=average_10)
byOriginNormal_9 = Plane.ByOriginNormal(origin=startPoint_4, normal=cross)
code_block_138 = CodeBlock { X; }  # unwired: X
closestPointTo_14 = Geometry.ClosestPointTo(geometry=byOriginNormal_9@L1, other=code_block_138@L2, lacing=Longest)
byPlane = CoordinateSystem.ByPlane(plane=byOriginNormal_9)
byOrigin_3 = CoordinateSystem.ByOrigin()
transform_2 = Geometry.Transform(geometry=closestPointTo_14, fromCoordinateSystem=byPlane, contextCoordinateSystem=byOrigin_3)
points_convexHullGrahamsScan_2 = Custom[points_convexHullGrahamsScan](points=transform_2@@L2)
transform_3 = Geometry.Transform(geometry=points_convexHullGrahamsScan_2, fromCoordinateSystem=byOrigin_3, contextCoordinateSystem=byPlane)
deconstructPolyCurve_2 = Geometry.Curves.DeconstructPolyCurve(polycurve=transform_3)
direction_17 = Line.Direction(line=deconstructPolyCurve_2.Segments)
XAxis_2 = Vector.XAxis()
angleWithVector_11 = Vector.AngleWithVector(vector=direction_17, otherVector=XAxis_2)
code_block_139 = CodeBlock { 90; }
ge_2 = angleWithVector_11 >= code_block_139
reverse_5 = Curve.Reverse(curve=deconstructPolyCurve_2.Segments)
if_9 = RefactoredIf(test=ge_2@@L1, true=reverse_5@L1, false=deconstructPolyCurve_2.Segments@L1, lacing=Longest)
direction_18 = Line.Direction(line=if_9)
XAxis_3 = Vector.XAxis()
angleWithVector_12 = Vector.AngleWithVector(vector=direction_18, otherVector=XAxis_3)
code_block_140 = CodeBlock { 5; }
code_block_141 = CodeBlock(angle=angleWithVector_12, x=code_block_140) { DSCore.Math.Floor(angle / x); }
groupByKey_6 = List.GroupByKey(list=if_9@@L2, keys=code_block_141@L2)
direction_19 = Line.Direction(line=groupByKey_6.groups)
length_7 = Curve.Length(curve=groupByKey_6.groups)
sum_3 = Math.Sum(values=length_7@@L2)
maximumItem_9 = List.MaximumItem(list=sum_3@@L2)
indexOf_6 = List.IndexOf(list=sum_3@@L2, element=maximumItem_9@L1)
getItemAtIndex_21 = List.GetItemAtIndex(list=direction_19@@L3, index=indexOf_6@L1)  # frozen
average_11 = Custom[Vector.Average](vectors=getItemAtIndex_21@@L2)
code_block_142 = CodeBlock(X=code_block_138) { X; }
code_block_143 = CodeBlock(X=code_block_142) { X; }

# group: XY LINE
getItemAtIndex_22 = List.GetItemAtIndex(list=groupByKey_6.groups@@L3, index=indexOf_6@L1)
firstItem_4 = List.FirstItem(list=getItemAtIndex_22@L2)
startPoint_5 = Curve.StartPoint(curve=firstItem_4)
direction_20 = Line.Direction(line=getItemAtIndex_22)
average_12 = Custom[Vector.Average](vectors=direction_20@@L2)
code_block_144 = CodeBlock { 5000; }
byStartPointDirectionLength_6 = Line.ByStartPointDirectionLength(startPoint=startPoint_5, direction=average_12, length=code_block_144)
extendStart_5 = Curve.ExtendStart(curve=byStartPointDirectionLength_6, distance=code_block_144)
closestPointTo_15 = Geometry.ClosestPointTo(geometry=extendStart_5@L1, other=code_block_143@L2, lacing=Longest)
parameterAtPoint_7 = Curve.ParameterAtPoint(curve=extendStart_5, point=closestPointTo_15@L2, lacing=Longest)
minimumItem_10 = List.MinimumItem(list=parameterAtPoint_7@L2)
maximumItem_10 = List.MaximumItem(list=parameterAtPoint_7@L2)
trimByParameter_7 = Curve.TrimByParameter(curve=extendStart_5, startParameter=minimumItem_10, endParameter=maximumItem_10)

toLine_6 = Geometry.Curves.ToLine(curve=trimByParameter_7)
startPoint_6 = Curve.StartPoint(curve=toLine_6)

# group (continued): XY LINE
closestPointTo_16 = Geometry.ClosestPointTo(geometry=extendStart_4@L1, other=code_block_138@L2, lacing=Longest)
parameterAtPoint_8 = Curve.ParameterAtPoint(curve=extendStart_4, point=closestPointTo_16@L2, lacing=Longest)
minimumItem_11 = List.MinimumItem(list=parameterAtPoint_8@L2)
maximumItem_11 = List.MaximumItem(list=parameterAtPoint_8@L2)
trimByParameter_8 = Curve.TrimByParameter(curve=extendStart_4, startParameter=minimumItem_11, endParameter=maximumItem_11)

toLine_7 = Geometry.Curves.ToLine(curve=trimByParameter_8)
direction_21 = Line.Direction(line=toLine_7)
direction_22 = Line.Direction(line=toLine_6)
add = Vector.Add(vector=direction_21, vectorToAdd=direction_22)
byOriginNormal_10 = Plane.ByOriginNormal(origin=startPoint_6, normal=add)
closestPointTo_17 = Geometry.ClosestPointTo(geometry=byOriginNormal_10@L1, other=code_block_143@L2, lacing=Longest)
byBestFitThroughPoints_17 = Circle.ByBestFitThroughPoints(points=closestPointTo_17@L2)
startPoint_7 = Curve.StartPoint(curve=toLine_7)

# group: how many points are contained in the radius buffer: comparison Method 1: purly
code_block_145 = CodeBlock(PCD=code_block_64) { PCD; }
code_block_146 = CodeBlock { 0.5; }
pruneDuplicates_10 = Point.PruneDuplicates(points=code_block_145@L2, tolerance=code_block_146)

# group: method 3 redefine global MAIN XY > re-redefine system main xy axis
origin_5 = Plane.Origin(plane=code_block_74.PIPES_PROJECTION_PLANE)
normal_7 = Plane.Normal(plane=code_block_74.PIPES_PROJECTION_PLANE)
ZAxis_12 = Vector.ZAxis()
angleWithVector_13 = Vector.AngleWithVector(vector=normal_7, otherVector=ZAxis_12)
code_block_147 = CodeBlock { 15; }
le = angleWithVector_13 <= code_block_147
deconstruct_5 = WombatDynamo.Vector.Deconstruct(vector=normal_7)
byCoordinates_9 = Vector.ByCoordinates(x=deconstruct_5.X, y=deconstruct_5.Y)
code_block_148 = CodeBlock { 45; }
ZAxis_13 = Vector.ZAxis()

# group: redefine space XY for all
code_block_149 = CodeBlock(LINE1=code_block_65.LINE1, RADIUS1=code_block_65.RADIUS1)  # same code as code_block_65
code_block_150 = CodeBlock { 0.5; }
code_block_151 = CodeBlock(radius=code_block_149.RADIUS1) { radius*0.1; }
code_block_152 = CodeBlock { 10; }

# group: redefine space XY for all
code_block_153 = CodeBlock(LINE2=getItemAtIndex_14, RADIUS2=getItemAtIndex_15)  # same code as code_block_70
code_block_154 = CodeBlock { 0.5; }
code_block_155 = CodeBlock(radius=code_block_153.RADIUS2) { radius*0.1; }
code_block_156 = CodeBlock { 10; }

# group: redefine space XY for all
list_create_13 = List.Create(item0=code_block_149.LINE1, item1=code_block_153.LINE2)
transpose_10 = List.Transpose(lists=list_create_13)
toLine_8 = Geometry.Curves.ToLine(curve=transpose_10)
direction_23 = Line.Direction(line=toLine_8)
ZAxis_14 = Vector.ZAxis()
angleWithVector_14 = Vector.AngleWithVector(vector=direction_23, otherVector=ZAxis_14)
code_block_157 = CodeBlock { 90; 10; }
eq_7 = Equals(x=angleWithVector_14, y=code_block_157.out0, tolerance=code_block_157.out1)

# group: redefine space XY for all
filterByBoolMask = List.FilterByBoolMask(list=toLine_8@L2, mask=eq_7@L2)
flatten_2 = List.Flatten(list=filterByBoolMask.in)
code_block_158 = CodeBlock(PCD=code_block_48) { PCD; }

# group (continued): redefine space XY for all
code_block_159 = CodeBlock(PCD=code_block_158) { PCD; }
pruneDuplicates_11 = Point.PruneDuplicates(points=code_block_159@L2, tolerance=code_block_150)
distanceTo_15 = Geometry.DistanceTo(geometry=pruneDuplicates_11@@L2, other=code_block_149.LINE1@L1)
eq_8 = Equals(x=distanceTo_15@L2, y=code_block_149.RADIUS1@L1, tolerance=code_block_151@L1, lacing=Longest)
countTrue_11 = List.CountTrue(list=eq_8@L2)
count_7 = List.Count(list=eq_8@L2)
mod_4 = CodeBlock(TRUE=countTrue_11, COUNT=count_7) { TRUE/COUNT * 100; }

# group (continued): redefine space XY for all
code_block_160 = CodeBlock(PCD=code_block_158) { PCD; }
pruneDuplicates_12 = Point.PruneDuplicates(points=code_block_160@L2, tolerance=code_block_154)
distanceTo_16 = Geometry.DistanceTo(geometry=pruneDuplicates_12@@L2, other=code_block_153.LINE2@L1)
eq_9 = Equals(x=distanceTo_16@L2, y=code_block_153.RADIUS2@L1, tolerance=code_block_155@L1, lacing=Longest)
countTrue_12 = List.CountTrue(list=eq_9@L2)
count_8 = List.Count(list=eq_9@L2)
mod_5 = CodeBlock(TRUE=countTrue_12, COUNT=count_8) { TRUE/COUNT * 100; }

# group: redefine space XY for all
list_create_14 = List.Create(item0=mod_4, item1=mod_5)
transpose_11 = List.Transpose(lists=list_create_14)
filterByBoolMask_2 = List.FilterByBoolMask(list=transpose_11@L2, mask=eq_7@L2)
flatten_3 = List.Flatten(list=filterByBoolMask_2.in)
maximumItem_12 = List.MaximumItem(list=flatten_3)
indexOf_7 = List.IndexOf(list=flatten_3, element=maximumItem_12)

# group (continued): redefine space XY for all
getItemAtIndex_23 = List.GetItemAtIndex(list=flatten_2, index=indexOf_7)

code_block_161 = CodeBlock(space_direction=getItemAtIndex_23)
# ---------- code_block_161.designscript (2 lines) ----------
space_direction;
// in line
# ----------------------------------------
code_block_162 = CodeBlock(space_direction=code_block_161)  # same code as code_block_161

# group (continued): method 3 redefine global MAIN XY > re-redefine system main xy axis
direction_24 = Line.Direction(line=code_block_162)
deconstruct_6 = WombatDynamo.Vector.Deconstruct(vector=direction_24)
byCoordinates_10 = Vector.ByCoordinates(x=deconstruct_6.X, y=deconstruct_6.Y)
angleWithVector_15 = Vector.AngleWithVector(vector=byCoordinates_10, otherVector=byCoordinates_9)
le_2 = angleWithVector_15 <= code_block_148
cross_2 = Vector.Cross(vector=byCoordinates_10, cross=ZAxis_13)
if_10 = RefactoredIf(test=le_2@@L1, true=byCoordinates_10@L1, false=cross_2@L1, lacing=Longest)
if_11 = RefactoredIf(test=le@@L1, true=ZAxis_12@L1, false=if_10@L1, lacing=Longest)

# group: method 3 redefine global MAIN XY
code_block_163 = CodeBlock(SPACE_XY=if_11) { SPACE_XY; }
code_block_164 = CodeBlock(ORIGINAL_NORMAL=normal_7) { ORIGINAL_NORMAL; }
angleWithVector_16 = Vector.AngleWithVector(vector=code_block_163, otherVector=code_block_164)
code_block_165 = CodeBlock { 90; }
le_3 = angleWithVector_16 <= code_block_165
reverse_6 = Vector.Reverse(vector=code_block_163)
if_12 = RefactoredIf(test=le_3@@L1, true=code_block_163@L1, false=reverse_6@L1, lacing=Longest)

# group (continued): method 3 redefine global MAIN XY > re-redefine system main xy axis
byOriginNormal_11 = Plane.ByOriginNormal(origin=origin_5, normal=if_12)

# group (continued): method 3 redefine global MAIN XY
code_block_166 = CodeBlock(PIPES_PROJECTION_PLANE=byOriginNormal_11) { PIPES_PROJECTION_PLANE; }
distanceTo_17 = Geometry.DistanceTo(geometry=code_block_73@@L2, other=code_block_166@L1, lacing=Longest)
code_block_5mm_step_5 = CodeBlock(Za=distanceTo_17, b=code_block_75) { DSCore.Math.Floor(Za/b); }
groupByKey_7 = List.GroupByKey(list=code_block_73@@L2, keys=code_block_5mm_step_5@L2)
distanceTo_18 = Geometry.DistanceTo(geometry=code_block_166@L1, other=groupByKey_7.groups@@L3, lacing=Longest)
sortByKey_5 = List.SortByKey(list=groupByKey_7.groups@@L2, keys=distanceTo_18@L2)
firstItem_5 = List.FirstItem(list=sortByKey_5.sortedList@@L2)
normal_8 = Plane.Normal(plane=code_block_166)
byOriginNormal_12 = Plane.ByOriginNormal(origin=firstItem_5@@L2, normal=normal_8@L1, lacing=Longest)
closestPointTo_18 = Geometry.ClosestPointTo(geometry=byOriginNormal_12@L1, other=sortByKey_5.sortedList@@L2)
byBestFitThroughPoints_18 = Circle.ByBestFitThroughPoints(points=closestPointTo_18@@L2)
clean_5 = Orchid.Common.List.Clean(list=byBestFitThroughPoints_18@@L2)

# group: method 3 redefine global MAIN XY > average center points & radius
centerPoint_8 = Circle.CenterPoint(circle=clean_5)
radius_9 = Circle.Radius(circle=clean_5)
sortByKey_6 = List.SortByKey(list=centerPoint_8@L2, keys=radius_9@L2)
byBestFitThroughPoints_19 = Line.ByBestFitThroughPoints(bestFitPoints=sortByKey_6.sortedList@@L2)
code_block_167 = CodeBlock { 1; }
dropItems_7 = List.DropItems(list=sortByKey_6.sortedKeys@L2, amount=code_block_167)
code_block_168 = CodeBlock { -1; }
dropItems_8 = List.DropItems(list=dropItems_7@L2, amount=code_block_168)
average_13 = Math.Average(numbers=dropItems_8@L2)

# group: method 3 redefine global MAIN XY > central line
extendEnd_4 = Curve.ExtendEnd(curve=byBestFitThroughPoints_19)
extendStart_6 = Curve.ExtendStart(curve=extendEnd_4)
closestPointTo_19 = Geometry.ClosestPointTo(geometry=extendStart_6@L1, other=code_block_77@L2, lacing=Longest)
parameterAtPoint_9 = Curve.ParameterAtPoint(curve=extendStart_6@L1, point=closestPointTo_19@L2, lacing=Longest)
minimumItem_12 = List.MinimumItem(list=parameterAtPoint_9@L2)
maximumItem_13 = List.MaximumItem(list=parameterAtPoint_9@L2)
trimByParameter_9 = Curve.TrimByParameter(curve=extendStart_6, startParameter=minimumItem_12, endParameter=maximumItem_13)
code_block_169 = CodeBlock { 1000; }

# group (continued): method 3 redefine global MAIN XY
list_create_15 = List.Create(item0=trimByParameter_9, item1=average_13)
transpose_12 = List.Transpose(lists=list_create_15)
getItemAtIndex_24 = List.GetItemAtIndex(list=transpose_12@L2, index=code_block_78)
getItemAtIndex_25 = List.GetItemAtIndex(list=transpose_12@L2, index=code_block_79)

code_block_170 = CodeBlock(LINE3=getItemAtIndex_24, RADIUS3=getItemAtIndex_25)  # same code as code_block_63
code_block_171 = CodeBlock(LINE3=code_block_170.LINE3, RADIUS3=code_block_170.RADIUS3)  # same code as code_block_63

# group: Method 1: projection + best fit circle
code_block_172 = CodeBlock(PIPES_PROJECTION_PLANE=byOriginNormal_11) { PIPES_PROJECTION_PLANE; }
code_block_173 = CodeBlock(X=code_block_72) { X; }
closestPointTo_20 = Geometry.ClosestPointTo(geometry=code_block_172@L1, other=code_block_173@L2, lacing=Longest)
byBestFitThroughPoints_20 = Circle.ByBestFitThroughPoints(points=closestPointTo_20@L2)
centerPoint_9 = Circle.CenterPoint(circle=byBestFitThroughPoints_20)
normal_9 = Plane.Normal(plane=code_block_172)
code_block_174 = CodeBlock(tentstive_length=code_block_80)  # same code as code_block_9
radius_10 = Circle.Radius(circle=byBestFitThroughPoints_20)
code_block_175 = CodeBlock { 0; }
code_block_176 = CodeBlock { 1; }

# group: Method 1: projection + best fit circle > LINE
byStartPointDirectionLength_7 = Line.ByStartPointDirectionLength(startPoint=centerPoint_9, direction=normal_9, length=code_block_174)
closestPointTo_21 = Geometry.ClosestPointTo(geometry=byStartPointDirectionLength_7@L1, other=code_block_173@L2, lacing=Longest)
parameterAtPoint_10 = Curve.ParameterAtPoint(curve=byStartPointDirectionLength_7, point=closestPointTo_21@L2, lacing=Longest)
minimumItem_13 = List.MinimumItem(list=parameterAtPoint_10@L2)
maximumItem_14 = List.MaximumItem(list=parameterAtPoint_10@L2)
trimByParameter_10 = Curve.TrimByParameter(curve=byStartPointDirectionLength_7, startParameter=minimumItem_13, endParameter=maximumItem_14)
flatten_4 = List.Flatten(list=trimByParameter_10)

# group (continued): Method 1: projection + best fit circle
list_create_16 = List.Create(item0=flatten_4, item1=radius_10)
transpose_13 = List.Transpose(lists=list_create_16)
getItemAtIndex_26 = List.GetItemAtIndex(list=transpose_13@L2, index=code_block_175)
getItemAtIndex_27 = List.GetItemAtIndex(list=transpose_13@L2, index=code_block_176)
distanceTo_19 = Geometry.DistanceTo(geometry=flatten_4@L1, other=code_block_173@L2, lacing=Longest)  # frozen
average_14 = Math.Average(numbers=distanceTo_19@L2)

code_block_177 = CodeBlock(LINE4=getItemAtIndex_26, RADIUS4=getItemAtIndex_27)
# ---------- code_block_177.designscript (3 lines) ----------
//FROM_METHOD1;
LINE4;
RADIUS4;
# ----------------------------------------
code_block_178 = CodeBlock(LINE34=code_block_177.LINE4, RADIUS4=code_block_177.RADIUS4)
# ---------- code_block_178.designscript (3 lines) ----------
//FROM_METHOD3;
LINE34;
RADIUS4;
# ----------------------------------------
code_block_179 = CodeBlock(LINE1=code_block_66.LINE1, RADIUS1=code_block_66.RADIUS1, LINE2=code_block_71.LINE2, RADIUS2=code_block_71.RADIUS2, LINE3=code_block_171.LINE3, RADIUS3=code_block_171.RADIUS3, LINE4=code_block_178.LINE34, RADIUS4=code_block_178.RADIUS4)
# ---------- code_block_179.designscript (23 lines) ----------
//FROM_METHOD1;
LINE1;
RADIUS1;




//FROM_METHOD2;
LINE2;
RADIUS2;



//FROM_METHOD3;
LINE3;
RADIUS3;




//FROM_METHOD3;
LINE4;
RADIUS4;
# ----------------------------------------

# group (continued): how many points are contained in the radius buffer: comparison Method 1: purly
code_block_180 = CodeBlock(LINE1=code_block_179.LINE1, RADIUS1=code_block_179.RADIUS1, LINE2=code_block_179.LINE2, RADIUS2=code_block_179.RADIUS2, LINE3=code_block_179.LINE3, RADIUS3=code_block_179.RADIUS3, LINE4=code_block_179.LINE4, RADIUS4=code_block_179.RADIUS4)
# ---------- code_block_180.designscript (24 lines) ----------
//FROM_METHOD1;
LINE1;
RADIUS1;




//FROM_METHOD2;
LINE2;
RADIUS2;




//FROM_METHOD3;
LINE3;
RADIUS3;




//FROM_METHOD3;
LINE4;
RADIUS4;
# ----------------------------------------
distanceTo_20 = Geometry.DistanceTo(geometry=pruneDuplicates_10@@L2, other=code_block_180.LINE1@L1)

# group: how many points are contained in the radius buffer: comparison Method 1: purly > distance threshold
code_block_181 = CodeBlock(radius1=code_block_180.RADIUS1, radius2=code_block_180.RADIUS2, radius3=code_block_180.RADIUS3, radius4=code_block_180.RADIUS4) { radius1; radius1 * 0.05; radius2; radius2 * 0.05; radius3; radius3 * 0.05; radius4; radius4 * 0.05; }
code_block_182 = CodeBlock { 10; }

# group (continued): how many points are contained in the radius buffer: comparison Method 1: purly
eq_10 = Equals(x=distanceTo_20@L2, y=code_block_181.radius1@L1, tolerance=code_block_181.out1@L1, lacing=Longest)
countTrue_13 = List.CountTrue(list=eq_10@L2)
count_9 = List.Count(list=eq_10@L2)
mod_6 = CodeBlock(TRUE=countTrue_13, COUNT=count_9) { TRUE/COUNT * 100; }

# group: how many points are contained in the radius buffer: comparison Method 1: purly > radius from method 2
eq_11 = Equals(x=distanceTo_20@L2, y=code_block_181.radius2@L1, tolerance=code_block_181.out3@L1, lacing=Longest)
countTrue_14 = List.CountTrue(list=eq_11@L2)
count_10 = List.Count(list=eq_11@L2)
mod_7 = CodeBlock(TRUE=countTrue_14, COUNT=count_10) { TRUE/COUNT * 100; }

# group: how many points are contained in the radius buffer: comparison Method 1: purly > radius from method 3
eq_12 = Equals(x=distanceTo_20@L2, y=code_block_181.radius3@L1, tolerance=code_block_181.out5@L1, lacing=Longest)
countTrue_15 = List.CountTrue(list=eq_12@L2)
count_11 = List.Count(list=eq_12@L2)
mod_8 = CodeBlock(TRUE=countTrue_15, COUNT=count_11) { TRUE/COUNT * 100; }

# group: how many points are contained in the radius buffer: comparison Method 1: purly > radius from method 4
eq_13 = Equals(x=distanceTo_20@L2, y=code_block_181.radius4@L1, tolerance=code_block_181.out7@L1, lacing=Longest)
countTrue_16 = List.CountTrue(list=eq_13@L2)
count_12 = List.Count(list=eq_13@L2)
mod_9 = CodeBlock(TRUE=countTrue_16, COUNT=count_12) { TRUE/COUNT * 100; }

# group: method 2: purly
code_block_183 = CodeBlock(PCD=code_block_64) { PCD; }
code_block_184 = CodeBlock { 0.5; }
pruneDuplicates_13 = Point.PruneDuplicates(points=code_block_183@L2, tolerance=code_block_184)
code_block_185 = CodeBlock(LINE1=code_block_179.LINE1, RADIUS1=code_block_179.RADIUS1, LINE2=code_block_179.LINE2, RADIUS2=code_block_179.RADIUS2, LINE3=code_block_179.LINE3, RADIUS3=code_block_179.RADIUS3, LINE4=code_block_179.LINE4, RADIUS4=code_block_179.RADIUS4)
# ---------- code_block_185.designscript (25 lines) ----------
//FROM_METHOD1;
LINE1;
RADIUS1;




//FROM_METHOD2;
LINE2;
RADIUS2;





//FROM_METHOD3;
LINE3;
RADIUS3;




//FROM_METHOD3;
LINE4;
RADIUS4;
# ----------------------------------------
distanceTo_21 = Geometry.DistanceTo(geometry=pruneDuplicates_13@@L2, other=code_block_185.LINE2@L1, lacing=Longest)

# group: method 2: purly > distance threshold
code_block_186 = CodeBlock(radius1=code_block_185.RADIUS1, radius2=code_block_185.RADIUS2, radius3=code_block_185.RADIUS3, radius4=code_block_185.RADIUS4) { radius1; radius1 * 0.05; radius2; radius2 * 0.05; radius3; radius3 * 0.05; radius4; radius4 * 0.05; }
code_block_187 = CodeBlock { 10; }

# group (continued): method 2: purly
eq_14 = Equals(x=distanceTo_21@L2, y=code_block_186.radius1@L1, tolerance=code_block_186.out1@L1, lacing=Longest)
countTrue_17 = List.CountTrue(list=eq_14@L2)
count_13 = List.Count(list=eq_14@L2)
mod_10 = CodeBlock(TRUE=countTrue_17, COUNT=count_13) { TRUE/COUNT * 100; }

# group: method 2: purly > radius from method
eq_15 = Equals(x=distanceTo_21@L2, y=code_block_186.radius2@L1, tolerance=code_block_186.out3@L1, lacing=Longest)
countTrue_18 = List.CountTrue(list=eq_15@L2)
count_14 = List.Count(list=eq_15@L2)
mod_11 = CodeBlock(TRUE=countTrue_18, COUNT=count_14) { TRUE/COUNT * 100; }

# group: method 2: purly > radius from method
eq_16 = Equals(x=distanceTo_21@L2, y=code_block_186.radius3@L1, tolerance=code_block_186.out5@L1, lacing=Longest)
countTrue_19 = List.CountTrue(list=eq_16@L2)
count_15 = List.Count(list=eq_16@L2)
mod_12 = CodeBlock(TRUE=countTrue_19, COUNT=count_15) { TRUE/COUNT * 100; }

# group: method 2: purly > radius from method 4
eq_17 = Equals(x=distanceTo_21@L2, y=code_block_186.radius4@L1, tolerance=code_block_186.out7@L1, lacing=Longest)
countTrue_20 = List.CountTrue(list=eq_17@L2)
count_16 = List.Count(list=eq_17@L2)
mod_13 = CodeBlock(TRUE=countTrue_20, COUNT=count_16) { TRUE/COUNT * 100; }

code_block_188 = CodeBlock(WAITFOR=mod_13) { WAITFOR; }
code_block_189 = CodeBlock(PASSTHROUGH=code_block_64, WAITFOR=code_block_188) { [PASSTHROUGH, WAITFOR][0]; }

# group: method 3: purly
code_block_190 = CodeBlock(PCD=code_block_189) { PCD; }
code_block_191 = CodeBlock { 0.5; }
pruneDuplicates_14 = Point.PruneDuplicates(points=code_block_190@L2, tolerance=code_block_191)
code_block_192 = CodeBlock(LINE1=code_block_179.LINE1, RADIUS1=code_block_179.RADIUS1, LINE2=code_block_179.LINE2, RADIUS2=code_block_179.RADIUS2, LINE3=code_block_179.LINE3, RADIUS3=code_block_179.RADIUS3, LINE4=code_block_179.LINE4, RADIUS4=code_block_179.RADIUS4)
# ---------- code_block_192.designscript (27 lines) ----------
//FROM_METHOD1;
LINE1;
RADIUS1;




//FROM_METHOD2;
LINE2;
RADIUS2;





//FROM_METHOD3;
LINE3;
RADIUS3;






//FROM_METHOD3;
LINE4;
RADIUS4;
# ----------------------------------------
distanceTo_22 = Geometry.DistanceTo(geometry=pruneDuplicates_14@@L2, other=code_block_192.LINE3@L1, lacing=Longest)

# group: method 3: purly > distance threshold
code_block_193 = CodeBlock(radius1=code_block_192.RADIUS1, radius2=code_block_192.RADIUS2, radius3=code_block_192.RADIUS3, radius4=code_block_192.RADIUS4) { radius1; radius1 * 0.05; radius2; radius2 * 0.05; radius3; radius3 * 0.05; radius4; radius4 * 0.05; }
code_block_194 = CodeBlock { 10; }

# group (continued): method 3: purly
eq_18 = Equals(x=distanceTo_22@L2, y=code_block_193.radius1@L1, tolerance=code_block_193.out1@L1, lacing=Longest)
countTrue_21 = List.CountTrue(list=eq_18@L2)
count_17 = List.Count(list=eq_18@L2)
mod_14 = CodeBlock(TRUE=countTrue_21, COUNT=count_17) { TRUE/COUNT * 100; }

# group: method 3: purly > radius from method
eq_19 = Equals(x=distanceTo_22@L2, y=code_block_193.radius2@L1, tolerance=code_block_193.out3@L1, lacing=Longest)
countTrue_22 = List.CountTrue(list=eq_19@L2)
count_18 = List.Count(list=eq_19@L2)
mod_15 = CodeBlock(TRUE=countTrue_22, COUNT=count_18) { TRUE/COUNT * 100; }

# group: method 3: purly > radius from method
eq_20 = Equals(x=distanceTo_22@L2, y=code_block_193.radius3@L1, tolerance=code_block_193.out5@L1, lacing=Longest)
countTrue_23 = List.CountTrue(list=eq_20@L2)
count_19 = List.Count(list=eq_20@L2)
mod_16 = CodeBlock(TRUE=countTrue_23, COUNT=count_19) { TRUE/COUNT * 100; }

# group: method 3: purly > radius from method 4
eq_21 = Equals(x=distanceTo_22@L2, y=code_block_193.radius4@L1, tolerance=code_block_193.out7@L1, lacing=Longest)
countTrue_24 = List.CountTrue(list=eq_21@L2)
count_20 = List.Count(list=eq_21@L2)
mod_17 = CodeBlock(TRUE=countTrue_24, COUNT=count_20) { TRUE/COUNT * 100; }

code_block_195 = CodeBlock(WAITFOR=mod_17) { WAITFOR; }
code_block_196 = CodeBlock(PASSTHROUGH=code_block_64, WAITFOR=code_block_195) { [PASSTHROUGH, WAITFOR][0]; }

# group: method 3: purly
code_block_197 = CodeBlock(PCD=code_block_196) { PCD; }
code_block_198 = CodeBlock { 0.5; }
pruneDuplicates_15 = Point.PruneDuplicates(points=code_block_197@L2, tolerance=code_block_198)
code_block_199 = CodeBlock(LINE1=code_block_179.LINE1, RADIUS1=code_block_179.RADIUS1, LINE2=code_block_179.LINE2, RADIUS2=code_block_179.RADIUS2, LINE3=code_block_179.LINE3, RADIUS3=code_block_179.RADIUS3, LINE4=code_block_179.LINE4, RADIUS4=code_block_179.RADIUS4)  # same code as code_block_192
distanceTo_23 = Geometry.DistanceTo(geometry=pruneDuplicates_15@@L2, other=code_block_199.LINE4@L1, lacing=Longest)

# group: method 3: purly > distance threshold
code_block_200 = CodeBlock(radius1=code_block_199.RADIUS1, radius2=code_block_199.RADIUS2, radius3=code_block_199.RADIUS3, radius4=code_block_199.RADIUS4) { radius1; radius1 * 0.05; radius2; radius2 * 0.05; radius3; radius3 * 0.05; radius4; radius4 * 0.05; }
code_block_201 = CodeBlock { 10; }

# group (continued): method 3: purly
eq_22 = Equals(x=distanceTo_23@L2, y=code_block_200.radius1@L1, tolerance=code_block_200.out1@L1, lacing=Longest)
countTrue_25 = List.CountTrue(list=eq_22@L2)
count_21 = List.Count(list=eq_22@L2)
mod_18 = CodeBlock(TRUE=countTrue_25, COUNT=count_21) { TRUE/COUNT * 100; }

# group: method 3: purly > radius from method
eq_23 = Equals(x=distanceTo_23@L2, y=code_block_200.radius2@L1, tolerance=code_block_200.out3@L1, lacing=Longest)
countTrue_26 = List.CountTrue(list=eq_23@L2)
count_22 = List.Count(list=eq_23@L2)
mod_19 = CodeBlock(TRUE=countTrue_26, COUNT=count_22) { TRUE/COUNT * 100; }

# group: method 3: purly > radius from method
eq_24 = Equals(x=distanceTo_23@L2, y=code_block_200.radius3@L1, tolerance=code_block_200.out5@L1, lacing=Longest)
countTrue_27 = List.CountTrue(list=eq_24@L2)
count_23 = List.Count(list=eq_24@L2)
mod_20 = CodeBlock(TRUE=countTrue_27, COUNT=count_23) { TRUE/COUNT * 100; }

# group: method 3: purly > radius from method 4
eq_25 = Equals(x=distanceTo_23@L2, y=code_block_200.radius4@L1, tolerance=code_block_200.out7@L1, lacing=Longest)
countTrue_28 = List.CountTrue(list=eq_25@L2)
count_24 = List.Count(list=eq_25@L2)
mod_21 = CodeBlock(TRUE=countTrue_28, COUNT=count_24) { TRUE/COUNT * 100; }

# group: SELECT THE BEST > count L1(R123), L2(R123), L3(R123)
list_create_17 = List.Create(item0=mod_6, item1=mod_7, item2=mod_8, item3=mod_9, item4=mod_10, item5=mod_11, item6=mod_12, item7=mod_13, item8=mod_14, item9=mod_15, item10=mod_16, item11=mod_17, item12=mod_18, item13=mod_19, item14=mod_20, item15=mod_21)
transpose_14 = List.Transpose(lists=list_create_17)

code_block_202 = CodeBlock(LINE1=code_block_179.LINE1, RADIUS1=code_block_179.RADIUS1, LINE2=code_block_179.LINE2, RADIUS2=code_block_179.RADIUS2, LINE3=code_block_179.LINE3, RADIUS3=code_block_179.RADIUS3, LINE4=code_block_179.LINE4, RADIUS4=code_block_179.RADIUS4)
# ---------- code_block_202.designscript (24 lines) ----------
//FROM_METHOD1;
LINE1;
RADIUS1;




//FROM_METHOD2;
LINE2;
RADIUS2;



//FROM_METHOD3;
LINE3;
RADIUS3;





//FROM_METHOD3;
LINE4;
RADIUS4;
# ----------------------------------------
code_block_203 = CodeBlock(L1=code_block_202.LINE1, R1=code_block_202.RADIUS1, R2=code_block_202.RADIUS2, R3=code_block_202.RADIUS3, R4=code_block_202.RADIUS4, L2=code_block_202.LINE2, L3=code_block_202.LINE3, L4=code_block_202.LINE4)
# ---------- code_block_203.designscript (19 lines) ----------
[L1,R1];
[L1,R2];
[L1,R3];
[L1,R4];

[L2,R1];
[L2,R2];
[L2,R3];
[L2,R4];

[L3,R1];
[L3,R2];
[L3,R3];
[L3,R4];

[L4,R1];
[L4,R2];
[L4,R3];
[L4,R4];
# ----------------------------------------

# group: SELECT THE BEST > L3 == 1 PIPES ALL CHOICES
join_3 = List.Join(list0=code_block_203.out0, list1=code_block_203.out1, list2=code_block_203.out2, list3=code_block_203.out3, list4=code_block_203.out4, list5=code_block_203.out5, list6=code_block_203.out6, list7=code_block_203.out7, list8=code_block_203.out8, list9=code_block_203.out9, list10=code_block_203.out10, list11=code_block_203.out11, list12=code_block_203.out12, list13=code_block_203.out13, list14=code_block_203.out14, list15=code_block_203.out15)
transpose_15 = List.Transpose(lists=join_3@@L2)
transpose_16 = List.Transpose(lists=transpose_15)
code_block_204 = CodeBlock { 2; }
chop = List.Chop(list=transpose_16@@L2, lengths=code_block_204)

# group: SELECT THE BEST
maximumItem_15 = List.MaximumItem(list=transpose_14@L2)
indexOf_8 = List.IndexOf(list=transpose_14@L2, element=maximumItem_15@L1)
getItemAtIndex_28 = List.GetItemAtIndex(list=chop@L3, index=indexOf_8@L1)
addItemToEnd = List.AddItemToEnd(item=maximumItem_15@L1, list=getItemAtIndex_28@L2)
code_block_205 = CodeBlock { 0; 1; }
getItemAtIndex_29 = List.GetItemAtIndex(list=addItemToEnd@L2, index=code_block_205.out0)
getItemAtIndex_30 = List.GetItemAtIndex(list=addItemToEnd@L2, index=code_block_205.out1)
addItemToEnd_2 = List.AddItemToEnd()  # unwired: item, list

# group: SELECT THE BEST > cylinder check
startPoint_8 = Curve.StartPoint(curve=getItemAtIndex_29)
endPoint_5 = Curve.EndPoint(curve=getItemAtIndex_29)
byPointsRadius = Cylinder.ByPointsRadius(startPoint=startPoint_8, endPoint=endPoint_5, radius=getItemAtIndex_30)

byGeometryColor_6 = Modifiers.GeometryColor.ByGeometryColor(geometry=byPointsRadius, color=color_palette_4)

# group: SELECT THE BEST > check
toLine_9 = Geometry.Curves.ToLine(curve=getItemAtIndex_29)
direction_25 = Line.Direction(line=toLine_9)
ZAxis_15 = Vector.ZAxis()
angleWithVector_17 = Vector.AngleWithVector(vector=direction_25, otherVector=ZAxis_15)

# group: check
toLine_10 = Geometry.Curves.ToLine(curve=getItemAtIndex_24)
direction_26 = Line.Direction(line=toLine_10)
ZAxis_16 = Vector.ZAxis()
angleWithVector_18 = Vector.AngleWithVector(vector=direction_26, otherVector=ZAxis_16)

byGeometryColor_7 = Modifiers.GeometryColor.ByGeometryColor(geometry=getItemAtIndex_24, color=color_palette_7)

# group: check
toLine_11 = Geometry.Curves.ToLine(curve=getItemAtIndex_26)
direction_27 = Line.Direction(line=toLine_11)
ZAxis_17 = Vector.ZAxis()
angleWithVector_19 = Vector.AngleWithVector(vector=direction_27, otherVector=ZAxis_17)

# group: Method 2: slicing + NORMAL distribution : central line - radius > NEW DIRECTION
direction_28 = Line.Direction(line=code_block_162)

code_block_206 = CodeBlock(line_info=addItemToEnd, PCD=code_block_64) { line_info; PCD; }
code_block_207 = CodeBlock(line_info=code_block_206.line_info, PCD=code_block_206.PCD) { line_info; PCD; }

# group: accuracy<90
code_block_208 = CodeBlock { 2; }
getItemAtIndex_31 = List.GetItemAtIndex(list=code_block_207.line_info@L2, index=code_block_208)
code_block_209 = CodeBlock { 90; }
lt_9 = getItemAtIndex_31 < code_block_209
filterByBoolMask_3 = List.FilterByBoolMask(list=code_block_207.line_info@L3, mask=lt_9@L2)
code_block_210 = CodeBlock { true; }
allIndicesOf = List.AllIndicesOf(list=lt_9, item=code_block_210)
code_block_211 = CodeBlock(good=filterByBoolMask_3.out, need_calibration=filterByBoolMask_3.in, index=allIndicesOf)
# ---------- code_block_211.designscript (6 lines) ----------
good;

//---------------
need_calibration;

index;
# ----------------------------------------

code_block_212 = CodeBlock(good=code_block_211.good, need_calibration=code_block_211.need_calibration, index=code_block_211.index)  # same code as code_block_211
code_block_213 = CodeBlock(good=code_block_212.good, need_calibration=code_block_212.need_calibration, index=code_block_212.index)  # same code as code_block_211
code_block_214 = CodeBlock(good=code_block_213.good, need_calibration=code_block_213.need_calibration, index=code_block_213.index)
# ---------- code_block_214.designscript (6 lines) ----------
good[0];

//---------------
need_calibration;

index;
# ----------------------------------------
firstItem_6 = List.FirstItem(list=code_block_211.need_calibration@L2)
toLine_12 = Geometry.Curves.ToLine(curve=firstItem_6)
code_block_215 = CodeBlock(PCD=code_block_207.PCD) { PCD; }
filterByBoolMask_4 = List.FilterByBoolMask(list=code_block_215@L3, mask=lt_9@L2)

# group: PCD direction
closestPointTo_22 = Geometry.ClosestPointTo(geometry=toLine_12@L1, other=filterByBoolMask_4.in@L2, lacing=Longest)
origin_6 = Point.Origin()
byTwoPoints = Vector.ByTwoPoints(start=closestPointTo_22, end=filterByBoolMask_4.in)
average_15 = Custom[Vector.Average](vectors=byTwoPoints@L2)
length_8 = Vector.Length(vector=byTwoPoints)
average_16 = Math.Average(numbers=length_8@L2)
translate_4 = Geometry.Translate(geometry=origin_6, direction=average_15, distance=average_16)
byTwoPoints_2 = Vector.ByTwoPoints(start=origin_6, end=translate_4)

parameterAtPoint_11 = Curve.ParameterAtPoint(curve=toLine_12@L1, point=closestPointTo_22@L2, lacing=Longest)
code_block_216 = CodeBlock(parameter=parameterAtPoint_11) { a = 1000; parameter * a; }
startPoint_9 = Curve.StartPoint(curve=toLine_12)
direction_29 = Line.Direction(line=toLine_12)
byOriginNormal_13 = Plane.ByOriginNormal(origin=startPoint_9, normal=direction_29)
getItemAtIndex_32 = List.GetItemAtIndex(list=code_block_211.need_calibration@L2, index=code_block_135)
byPlaneRadius = Circle.ByPlaneRadius(plane=byOriginNormal_13, radius=getItemAtIndex_32)
extrude = Curve.Extrude(curve=byPlaneRadius, direction=direction_29)
code_block_217 = CodeBlock(PCD=filterByBoolMask_4.in) { PCD; }
closestPointTo_23 = Geometry.ClosestPointTo(geometry=extrude@L1, other=code_block_217@L2, lacing=Longest)
byTwoPoints_3 = Vector.ByTwoPoints(start=closestPointTo_23, end=code_block_217)
angleWithVector_20 = Vector.AngleWithVector(vector=byTwoPoints_3, otherVector=byTwoPoints_2)
cos = Math.Cos(angle=angleWithVector_20)
code_block_218 = CodeBlock(cos=cos) { a = 100; cos * a; }
byCoordinates_11 = Point.ByCoordinates(x=code_block_216.a, y=code_block_218.out1)
byBestFitThroughPoints_21 = Line.ByBestFitThroughPoints(bestFitPoints=byCoordinates_11@L2)
length_9 = Curve.Length(curve=byBestFitThroughPoints_21)
byCoordinates_12 = Point.ByCoordinates(x=length_9)
byStartPointEndPoint_2 = Line.ByStartPointEndPoint(startPoint=origin_4, endPoint=byCoordinates_12)
intersect = Geometry.Intersect(geometry=byStartPointEndPoint_2, other=byBestFitThroughPoints_21)
isEmpty = List.IsEmpty(list=intersect@@L2)
firstItem_7 = List.FirstItem(list=code_block_212.need_calibration@L2)
length_10 = Curve.Length(curve=firstItem_7)
extendStart_7 = Curve.ExtendStart(curve=firstItem_7, distance=length_10)
extendEnd_5 = Curve.ExtendEnd(curve=extendStart_7, distance=length_10)
average_17 = Custom[Vector.Average](vectors=byTwoPoints_3@L2)
average_18 = Math.Average(numbers=code_block_218.out1@L2)
code_block_219 = CodeBlock(average=average_18, a=code_block_218.a) { average/a; }

# group: translate
code_block_220 = CodeBlock(translation_direction=average_17) { translation_direction; }
code_block_221 = CodeBlock(distance=code_block_219, amplify_ratio=code_block_218.a)
# ---------- code_block_221.designscript (9 lines) ----------
distance;

a = -distance * 10;
b = distance * 10;

N = amplify_ratio/4;

//----------------------
a..b..#N;
# ----------------------------------------
translate_5 = Geometry.Translate(geometry=extendEnd_5@L1, direction=code_block_220@L1, distance=code_block_221.out4@@L2, lacing=Longest)

code_block_222 = CodeBlock(PCD=code_block_217) { PCD; }
pruneDuplicates_16 = Point.PruneDuplicates(points=code_block_222@L2, tolerance=code_block_136)

# group: translate
extended = CodeBlock(translated_lines=translate_5) { translated_lines[0]; }
count_25 = List.Count(list=extended@L2)
ofRepeatedItem_3 = List.OfRepeatedItem(item=pruneDuplicates_16@L2, amount=count_25@L1)
distanceTo_24 = Geometry.DistanceTo(geometry=ofRepeatedItem_3@@L2, other=extended@L1)
average_19 = Math.Average(numbers=distanceTo_24@L2)
code_block_223 = CodeBlock(radius=average_19) { radius*0.05; }
eq_26 = Equals(x=distanceTo_24@@L2, y=average_19@L1, tolerance=code_block_223@L1)
countTrue_29 = List.CountTrue(list=eq_26@L2)
count_26 = List.Count(list=eq_26@L2)
code_block_224 = CodeBlock(counttrue=countTrue_29, count=count_26) { counttrue/count*100; }
list_create_18 = List.Create(item0=extended, item1=average_19, item2=code_block_224)
transpose_17 = List.Transpose(lists=list_create_18)
maximumItem_16 = List.MaximumItem(list=code_block_224@L2)
indexOf_9 = List.IndexOf(list=code_block_224@L2, element=maximumItem_16@L1)
getItemAtIndex_33 = List.GetItemAtIndex(list=transpose_17@L3, index=indexOf_9@L1)

X_2 = Point.X(point=intersect)
code_block_225 = CodeBlock(param=X_2, a=code_block_216.a) { param/a; }
code_block_226 = CodeBlock(PCD_DIRECTION=byTwoPoints_2) { PCD_DIRECTION; }
code_block_227 = CodeBlock(PCD_DIRECTION=code_block_226) { PCD_DIRECTION; }

# group: rotate
firstItem_8 = List.FirstItem(list=code_block_212.need_calibration@L2)
pointAtParameter = Curve.PointAtParameter(curve=firstItem_8, param=code_block_225)
toLine_13 = Geometry.Curves.ToLine(curve=firstItem_8)
direction_30 = Line.Direction(line=toLine_13)
cross_3 = Vector.Cross(vector=direction_30, cross=code_block_227)
byOriginNormal_14 = Plane.ByOriginNormal(origin=pointAtParameter, normal=cross_3)
XAxis_4 = Vector.XAxis()
direction_31 = Line.Direction(line=byBestFitThroughPoints_21)
angleWithVector_21 = Vector.AngleWithVector(vector=XAxis_4, otherVector=direction_31)
code_block_228 = CodeBlock(angle=angleWithVector_21, amplify_ratio=code_block_218.a)
# ---------- code_block_228.designscript (9 lines) ----------
angle;

a = -angle * 10;
b = angle * 10;

N = amplify_ratio/4;

//----------------------
a..b..#N;
# ----------------------------------------
rotate = Geometry.Rotate(geometry=extendEnd_5@L1, basePlane=byOriginNormal_14@L1, degrees=code_block_228.out4@@L2, lacing=Longest)

# group: rotate
extended_2 = CodeBlock(rotated_lines=rotate) { rotated_lines; }
count_27 = List.Count(list=extended_2@L2)
ofRepeatedItem_4 = List.OfRepeatedItem(item=pruneDuplicates_16@L2, amount=count_27@L1)
distanceTo_25 = Geometry.DistanceTo(geometry=ofRepeatedItem_4@@L2, other=extended_2@L1)
average_20 = Math.Average(numbers=distanceTo_25@L2)
code_block_229 = CodeBlock(radius=average_20) { radius*0.05; }
eq_27 = Equals(x=distanceTo_25@@L2, y=average_20@L1, tolerance=code_block_229@L1)
countTrue_30 = List.CountTrue(list=eq_27@L2)
count_28 = List.Count(list=eq_27@L2)
code_block_230 = CodeBlock(counttrue=countTrue_30, count=count_28) { counttrue/count*100; }
list_create_19 = List.Create(item0=extended_2, item1=average_20, item2=code_block_230)
transpose_18 = List.Transpose(lists=list_create_19)
maximumItem_17 = List.MaximumItem(list=code_block_230@L2)
indexOf_10 = List.IndexOf(list=code_block_230@L2, element=maximumItem_17@L1)
getItemAtIndex_34 = List.GetItemAtIndex(list=transpose_18@L3, index=indexOf_10@L1)

if_13 = RefactoredIf(test=isEmpty@@L1, true=getItemAtIndex_33@L2, false=getItemAtIndex_34@L2)
code_block_231 = CodeBlock(PCD=code_block_222) { PCD; }

# group: trim
code_block_232 = CodeBlock { 0; }
firstItem_9 = List.FirstItem(list=if_13@L2)
closestPointTo_24 = Geometry.ClosestPointTo(geometry=firstItem_9@L2, other=code_block_231)
parameterAtPoint_12 = Curve.ParameterAtPoint(curve=firstItem_9, point=closestPointTo_24)
minimumItem_14 = List.MinimumItem(list=parameterAtPoint_12@L2)
maximumItem_18 = List.MaximumItem(list=parameterAtPoint_12@L2)
trimByParameter_11 = Curve.TrimByParameter(curve=firstItem_9, startParameter=minimumItem_14, endParameter=maximumItem_18)
replaceItemAtIndex = List.ReplaceItemAtIndex(list=if_13@L2, index=code_block_232, item=trimByParameter_11@L1)

# group: sort output
join_4 = List.Join(list0=code_block_214.out0, list1=replaceItemAtIndex)
count_29 = List.Count(list=join_4@L3)
code_block_233 = CodeBlock(x=count_29) { 0..x-1; }
removeItemAtIndex = List.RemoveItemAtIndex(list=code_block_233@L2, indices=code_block_214.index)
join_5 = List.Join(list0=removeItemAtIndex, list1=code_block_214.index)
flatten_5 = List.Flatten(list=join_5)
sortByKey_7 = List.SortByKey(list=join_4@L3, keys=flatten_5@L2)

code_block_234 = CodeBlock(LINE=sortByKey_7.sortedList, PCD=code_block_215) { LINE; PCD; }

# group: ANGLE COMPROMISE TO ABSOLUTE HORIZONTAL/VERTICAL
ZAxis_18 = Vector.ZAxis()
code_block_235 = CodeBlock(LINE=code_block_234.LINE, PCD=code_block_234.PCD) { LINE; PCD; }
firstItem_10 = List.FirstItem(list=code_block_235.LINE@L2)
direction_32 = Line.Direction(line=firstItem_10)
angleWithVector_22 = Vector.AngleWithVector(vector=ZAxis_18, otherVector=direction_32)
code_block_236 = CodeBlock()
# ---------- code_block_236.designscript (9 lines) ----------
//----------
//HORIZONTAL
90;
10;

//----------
//VERTICAL
0;
10;
# ----------------------------------------
eq_28 = Equals(x=angleWithVector_22, y=code_block_236.out2, tolerance=code_block_236.out3)
startPoint_10 = Curve.StartPoint(curve=firstItem_10)
ZAxis_19 = Vector.ZAxis()
byOriginNormal_15 = Plane.ByOriginNormal(origin=startPoint_10, normal=ZAxis_19)
eq_29 = Equals(x=angleWithVector_22, y=code_block_236.out0, tolerance=code_block_236.out1)
deconstruct_7 = WombatDynamo.Vector.Deconstruct(vector=direction_32)
byCoordinates_13 = Vector.ByCoordinates(x=deconstruct_7.X, y=deconstruct_7.Y)
byOriginNormal_16 = Plane.ByOriginNormal(origin=startPoint_10, normal=byCoordinates_13)
byOriginNormal_17 = Plane.ByOriginNormal(origin=startPoint_10, normal=direction_32)
if_14 = RefactoredIf(test=eq_29@@L1, true=byOriginNormal_16@L1, false=byOriginNormal_17@L1, lacing=Longest)
if_15 = RefactoredIf(test=eq_28@@L1, true=byOriginNormal_15@L1, false=if_14@L1, lacing=Longest)
code_block_237 = CodeBlock(plane=if_15) { plane; }
normal_10 = Plane.Normal(plane=code_block_237)
code_block_238 = CodeBlock { 1; }
code_block_239 = CodeBlock(original=code_block_235.LINE) { original; }

# group: ANGLE COMPROMISE TO ABSOLUTE HORIZONTAL/VERTICAL
code_block_240 = CodeBlock(PCD=code_block_235.PCD) { PCD; }
distanceTo_26 = Geometry.DistanceTo(geometry=code_block_240@L2, other=if_15@L1, lacing=Longest)
length_11 = Curve.Length(curve=firstItem_10)
code_block_241 = CodeBlock(LENGTH=length_11) { LENGTH/20; }
code_block_242 = CodeBlock(distance=distanceTo_26, a=code_block_241) { DSCore.Math.Floor(distance/a); }
groupByKey_8 = List.GroupByKey(list=code_block_240@@L2, keys=code_block_242@L2)
firstItem_11 = List.FirstItem(list=groupByKey_8.groups@@L2)
normal_11 = Plane.Normal(plane=if_15)
byOriginNormal_18 = Plane.ByOriginNormal(origin=firstItem_11@@L2, normal=normal_11@L1, lacing=Longest)
closestPointTo_25 = Geometry.ClosestPointTo(geometry=byOriginNormal_18@L1, other=groupByKey_8.groups@@L2, lacing=Longest)
byBestFitThroughPoints_22 = Circle.ByBestFitThroughPoints(points=closestPointTo_25@@L2)
clean_6 = Orchid.Common.List.Clean(list=byBestFitThroughPoints_22@L2)

# group (continued): ANGLE COMPROMISE TO ABSOLUTE HORIZONTAL/VERTICAL
centerPoint_10 = Circle.CenterPoint(circle=clean_6)
closestPointTo_26 = Geometry.ClosestPointTo(geometry=code_block_237@L1, other=centerPoint_10@@L2, lacing=Longest)
code_block_243 = CodeBlock(length=length_11) { length * 1.5; }
byStartPointDirectionLength_8 = Line.ByStartPointDirectionLength(startPoint=closestPointTo_26@@L2, direction=normal_10@L1, length=code_block_243@L1, lacing=Longest)
code_block_244 = CodeBlock(pcd=code_block_240) { pcd; }
closestPointTo_27 = Geometry.ClosestPointTo(geometry=code_block_237@L1, other=code_block_244@@L2, lacing=Longest)
pruneDuplicates_17 = Point.PruneDuplicates(points=closestPointTo_27@@L2, tolerance=code_block_238@L1)
count_30 = List.Count(list=clean_6@L2)
ofRepeatedItem_5 = List.OfRepeatedItem(item=pruneDuplicates_17@@L2, amount=count_30@L1)
code_block_245 = CodeBlock(pcd=code_block_244) { pcd; }

# group: ANGLE COMPROMISE TO ABSOLUTE HORIZONTAL/VERTICAL > min stdv
distanceTo_27 = Geometry.DistanceTo(geometry=byStartPointDirectionLength_8@@L1, other=ofRepeatedItem_5@L2, lacing=Longest)
average_21 = Math.Average(numbers=distanceTo_27@@L2)
sub_3 = distanceTo_27@@L2 - average_21@L1  # lacing=Longest
code_block_246 = CodeBlock { 2; }
pow_2 = Math.Pow(number=sub_3, power=code_block_246)
sum_4 = Math.Sum(values=pow_2@@L2)
count_31 = List.Count(list=distanceTo_27@L2)
div = sum_4 / count_31
sqrt_2 = Math.Sqrt(number=div)

# group: ANGLE COMPROMISE TO ABSOLUTE HORIZONTAL/VERTICAL > output
minimumItem_15 = List.MinimumItem(list=sqrt_2@L2)
indexOf_11 = List.IndexOf(list=sqrt_2@L2, element=minimumItem_15@L1)
getItemAtIndex_35 = List.GetItemAtIndex(list=byStartPointDirectionLength_8@L2, index=indexOf_11@L1)
closestPointTo_28 = Geometry.ClosestPointTo(geometry=getItemAtIndex_35@L1, other=code_block_245@@L2, lacing=Longest)
parameterAtPoint_13 = Curve.ParameterAtPoint(curve=getItemAtIndex_35@L1, point=closestPointTo_28@L2, lacing=Longest)
minimumItem_16 = List.MinimumItem(list=parameterAtPoint_13@L2)
maximumItem_19 = List.MaximumItem(list=parameterAtPoint_13@L2)
trimByParameter_12 = Curve.TrimByParameter(curve=getItemAtIndex_35, startParameter=minimumItem_16, endParameter=maximumItem_19)
getItemAtIndex_36 = List.GetItemAtIndex(list=average_21@L2, index=indexOf_11@L1)
distanceTo_28 = Geometry.DistanceTo(geometry=getItemAtIndex_35@@L1, other=code_block_245@L2, lacing=Longest)
average_22 = Math.Average(numbers=distanceTo_28@@L2)
code_block_247 = CodeBlock(radius=average_22) { radius * 0.05; }
eq_30 = Equals(x=distanceTo_28@@L2, y=average_22@L1, tolerance=code_block_247@L1, lacing=Longest)
countTrue_31 = List.CountTrue(list=eq_30@L2)
count_32 = List.Count(list=eq_30@L2)
code_block_248 = CodeBlock(counttrue=countTrue_31, count=count_32) { counttrue/count*100; }

# group: ANGLE COMPROMISE TO ABSOLUTE HORIZONTAL/VERTICAL > output compare
list_create_20 = List.Create(item0=trimByParameter_12, item1=getItemAtIndex_36, item2=code_block_248)
transpose_19 = List.Transpose(lists=list_create_20)
code_block_249 = CodeBlock { 2; }
getItemAtIndex_37 = List.GetItemAtIndex(list=transpose_19@L2, index=code_block_249)
code_block_250 = CodeBlock { 85; }
ge_3 = getItemAtIndex_37 >= code_block_250
if_16 = RefactoredIf(test=ge_3@@L1, true=transpose_19@L2, false=code_block_239@L2, lacing=Longest)

# group: METHOD4: just change RADIUS LINE from NIM STDV
code_block_251 = CodeBlock()  # frozen; unwired: LINE1, RADIUS1, LINE2, RADIUS2, LINE3, RADIUS3
# ---------- code_block_251.designscript (17 lines) ----------
//FROM_METHOD1;
LINE1;
RADIUS1;




//FROM_METHOD2;
LINE2;
RADIUS2;




//FROM_METHOD3;
LINE3;
RADIUS3;
# ----------------------------------------
list_create_21 = List.Create(item0=code_block_251.LINE1, item1=code_block_251.LINE2, item2=code_block_251.LINE3)
transpose_20 = List.Transpose(lists=list_create_21)
code_block_252 = CodeBlock { DSCore.Math.Floor(x * 0.5); }  # unwired: x
code_block_253 = CodeBlock { PCD; }  # unwired: PCD
code_block_254 = CodeBlock { 1; }
code_block_255 = CodeBlock(PCD=code_block_253) { PCD; }
code_block_256 = CodeBlock()  # unwired: LINE_x, R_average; same code as code_block_128
code_block_257 = CodeBlock { 0..359..45; }

# group: METHOD4: just change RADIUS LINE from NIM STDV
code_block_258 = CodeBlock(LINE2=getItemAtIndex_29, RADIUS2=getItemAtIndex_30)  # frozen; same code as code_block_70
toLine_14 = Geometry.Curves.ToLine(curve=code_block_258.LINE2)
startPoint_11 = Curve.StartPoint(curve=toLine_14)
direction_33 = Line.Direction(line=toLine_14)
byOriginNormal_19 = Plane.ByOriginNormal(origin=startPoint_11, normal=direction_33)
code_block_259 = CodeBlock { test_SLICE_CIRCLE; }  # frozen; unwired: test_SLICE_CIRCLE
centerPoint_11 = Circle.CenterPoint(circle=code_block_259)
closestPointTo_29 = Geometry.ClosestPointTo(geometry=byOriginNormal_19@L1, other=centerPoint_11@L2, lacing=Longest)
code_block_260 = CodeBlock { 0.5; }
closestPointTo_30 = Geometry.ClosestPointTo(geometry=byOriginNormal_19@L1, other=code_block_253@L2, lacing=Longest)
length_12 = Curve.Length(curve=code_block_258.LINE2)

# group (continued): METHOD4: just change RADIUS LINE from NIM STDV
byPlaneRadius_2 = Circle.ByPlaneRadius(plane=byOriginNormal_19, radius=code_block_252)
byPatch = Surface.ByPatch(closedCurve=byPlaneRadius_2)
intersect_2 = Geometry.Intersect(geometry=closestPointTo_29@L2, other=byPatch@L1, lacing=Longest)
flatten_6 = List.Flatten(list=intersect_2@L3)
pruneDuplicates_18 = Point.PruneDuplicates(points=closestPointTo_30@L2, tolerance=code_block_254)
code_block_261 = CodeBlock(LENGTH=length_12) { LENGTH*1.5; }

# group (continued): METHOD4: just change RADIUS LINE from NIM STDV
pruneDuplicates_19 = Point.PruneDuplicates(points=flatten_6@L2, tolerance=code_block_260)

# group (continued): METHOD4: just change RADIUS LINE from NIM STDV
count_33 = List.Count(list=pruneDuplicates_19@L2)
ofRepeatedItem_6 = List.OfRepeatedItem(item=pruneDuplicates_18@L2, amount=count_33@L1)  # frozen
distanceTo_29 = Geometry.DistanceTo(geometry=pruneDuplicates_19@@L1, other=ofRepeatedItem_6@L2, lacing=Longest)

# group: METHOD4: just change RADIUS LINE from NIM STDV > best LINE == MIN STDV
average_23 = Math.Average(numbers=distanceTo_29@@L2)
sub_4 = distanceTo_29@@L2 - average_23@L1  # lacing=Longest
code_block_262 = CodeBlock { 2; }
pow_3 = Math.Pow(number=sub_4, power=code_block_262)
sum_5 = Math.Sum(values=pow_3@@L2)
count_34 = List.Count(list=distanceTo_29@@L2)
stdv2_2 = sum_5 / count_34
sqrt_3 = Math.Sqrt(number=stdv2_2)

# group (continued): METHOD4: just change RADIUS LINE from NIM STDV
minimumItem_17 = List.MinimumItem(list=sqrt_3@@L2)
indexOf_12 = List.IndexOf(list=sqrt_3@@L2, element=minimumItem_17@L1)
list_getitematindex_2 = List.GetItemAtIndex(list=closestPointTo_29@L2, index=indexOf_12@L1)
byStartPointDirectionLength_9 = Line.ByStartPointDirectionLength(startPoint=list_getitematindex_2, direction=direction_33, length=code_block_261)
distanceTo_30 = Geometry.DistanceTo(geometry=byStartPointDirectionLength_9@@L1, other=code_block_255@L2, lacing=Longest)
average_24 = Math.Average(numbers=distanceTo_30@L2)
ceiling = Math.Ceiling(number=distanceTo_30)

# group: METHOD4: just change RADIUS LINE from NIM STDV > radius from method 2
code_block_263 = CodeBlock { 10; }
eq_31 = Equals(x=distanceTo_30@L2, y=average_24@L1, tolerance=code_block_263@L1, lacing=Longest)
countTrue_32 = List.CountTrue(list=eq_31@L2)
count_35 = List.Count(list=eq_31@L2)
mod_22 = CodeBlock(TRUE=countTrue_32, COUNT=count_35) { TRUE/COUNT * 100; }
