# Dynamo graph LTA PIPE_Step2_Connectivity_Calibration  (29-MAY) .dyn "LTA PIPE_Step2_Connectivity_Calibration (29-MAY)" (Dynamo 2.13.1.3887)
# packages: Hot Gear 2017.11.9, Clockwork for Dynamo 2.x 2.4.0, WombatDynamo 1.3.2, DynaMEP 1.2.8, Orchid 216.3.0.5842, Data-Shapes 2022.2.103

# group: pipe lines: ALL
importCSV = Data.ImportCSV()  # unwired: filePath
file_path = Filename("..\REVISION-Newst\pipes.xls")
file_from_path = FileObject(path=file_path)
code_block = CodeBlock { "STEP1_output (no calibration)"; }
code_block_2 = CodeBlock { false; }
importExcel = Data.ImportExcel(file=file_from_path, sheetName=code_block, readAsStrings=code_block_2, showExcel=code_block_2)
transpose = List.Transpose(lists=importExcel)
code_block_3 = CodeBlock(x=transpose)
# ---------- code_block_3.designscript (20 lines) ----------
//start point//
x[0];
x[1];
x[2];

//end point//
x[3];
x[4];
x[5];

///radius///
x[6];


// accuracy% //
x[7];


// angle with Z
x[8];
# ----------------------------------------
byCoordinates = Point.ByCoordinates(x=code_block_3.out0, y=code_block_3.out1, z=code_block_3.out2)
byCoordinates_2 = Point.ByCoordinates(x=code_block_3.out3, y=code_block_3.out4, z=code_block_3.out5)
byPointsRadius = Cylinder.ByPointsRadius(startPoint=byCoordinates, endPoint=byCoordinates_2, radius=code_block_3.out6)
color_palette = ColorPalette({R: 0, G: 128, B: 128, A: 115})
byGeometryColor = Modifiers.GeometryColor.ByGeometryColor(geometry=byPointsRadius, color=color_palette)
byStartPointEndPoint = Line.ByStartPointEndPoint(startPoint=byCoordinates, endPoint=byCoordinates_2)
list_create = List.Create(item0=byStartPointEndPoint, item1=code_block_3.out6, item2=code_block_3.out7)
transpose_2 = List.Transpose(lists=list_create)

file_path_2 = Filename(".\PIPE_0_000003.csv")  # frozen
importCSV_2 = Data.ImportCSV(filePath=file_path_2)
file_path_3 = Filename(".\PIPE_0_000004.csv")  # frozen
importCSV_3 = Data.ImportCSV(filePath=file_path_3)
file_path_4 = Filename("..\REVISION-Newst\TEST 1\TEST_Short_Pipe__000000.csv")
importCSV_4 = Data.ImportCSV(filePath=file_path_4)
file_path_5 = Filename("..\REVISION-Newst\TEST 1\TEST_Short_Pipe__000001.csv")
importCSV_5 = Data.ImportCSV(filePath=file_path_5)
file_path_6 = Filename("..\REVISION-Newst\TEST 1\TEST_Short_Pipe__000002.csv")
importCSV_6 = Data.ImportCSV(filePath=file_path_6)
list_create_2 = List.Create(item0=importCSV_4, item1=importCSV_5, item2=importCSV_6)
code_block_4 = CodeBlock { 0; 1; 2; }
getItemAtIndex = List.GetItemAtIndex(list=list_create_2@L3, index=code_block_4.out0)
getItemAtIndex_2 = List.GetItemAtIndex(list=list_create_2@L3, index=code_block_4.out1)
getItemAtIndex_3 = List.GetItemAtIndex(list=list_create_2@L3, index=code_block_4.out2)
byCoordinates_3 = Point.ByCoordinates(x=getItemAtIndex, y=getItemAtIndex_2, z=getItemAtIndex_3)
color_palette_2 = ColorPalette({R: 255, G: 228, B: 196, A: 255})
byGeometryColor_2 = Modifiers.GeometryColor.ByGeometryColor(geometry=byCoordinates_3, color=color_palette_2)

# group: assumed connect point 1 on the pipe extended line: best fit line of PCDshort pipe 1pipe may contains >=2 connection
all = Watch()  # frozen; unwired: arg0
code_block_5 = CodeBlock { Line_B_to_be_connected_by_shortpipe; Lines_A_where_shortpipe_starts; index_of_Line_A; PCD_of_shortpipes; }  # unwired: Line_B_to_be_connected_by_shortpipe, Lines_A_where_shortpipe_starts, index_of_Line_A, PCD_of_shortpipes
lines_index_shortp_from = Watch(code_block_5.index_of_Line_A)
getItemAtIndex_4 = List.GetItemAtIndex(list=all@@L3, index=lines_index_shortp_from)
lines_shortp_from = Watch(getItemAtIndex_4)
lines_to_be_connected = Watch(code_block_5.Line_B_to_be_connected_by_shortpipe)
lines_to_be_connected_2 = Watch(lines_to_be_connected)
code_block_6 = CodeBlock { 0; }
getItemAtIndex_5 = List.GetItemAtIndex(list=all@@L2, index=code_block_6)
code_block_7 = CodeBlock { 0; }
getItemAtIndex_6 = List.GetItemAtIndex(list=lines_to_be_connected@L2, index=code_block_7)
indexOf = List.IndexOf(list=getItemAtIndex_5, element=getItemAtIndex_6)
code_block_8 = CodeBlock { 0; 1; }
getItemAtIndex_7 = List.GetItemAtIndex(list=getItemAtIndex_4@@L2, index=code_block_8.out0)
getItemAtIndex_8 = List.GetItemAtIndex(list=getItemAtIndex_4@@L2, index=code_block_8.out1)
code_block_9 = CodeBlock(radius=getItemAtIndex_8) { radius*5; }
extendEnd = Curve.ExtendEnd(curve=getItemAtIndex_7, distance=code_block_9)
extendStart = Curve.ExtendStart(curve=extendEnd, distance=code_block_9)
pcd_of_short_pipe = Watch(code_block_5.PCD_of_shortpipes)
byBestFitThroughPoints = Line.ByBestFitThroughPoints(bestFitPoints=pcd_of_short_pipe@L2)
code_block_10 = CodeBlock { 400; }
extendEnd_2 = Curve.ExtendEnd(curve=byBestFitThroughPoints, distance=code_block_10)
extendStart_2 = Curve.ExtendStart(curve=extendEnd_2, distance=code_block_10)
closestPointTo = Geometry.ClosestPointTo(geometry=extendStart@L2, other=extendStart_2@L2)
getItemAtIndex_9 = List.GetItemAtIndex(list=all@L3, index=indexOf@L2, lacing=Longest)
code_block_11 = CodeBlock { 0; 1; }
getItemAtIndex_10 = List.GetItemAtIndex(list=getItemAtIndex_9@@L2, index=code_block_11.out0)
getItemAtIndex_11 = List.GetItemAtIndex(list=getItemAtIndex_9@@L2, index=code_block_11.out1)
code_block_12 = CodeBlock(radius=getItemAtIndex_11) { radius*5; }
extendEnd_3 = Curve.ExtendEnd(curve=getItemAtIndex_10, distance=code_block_12)
extendStart_3 = Curve.ExtendStart(curve=extendEnd_3, distance=code_block_12)
closestPointTo_2 = Geometry.ClosestPointTo(geometry=extendStart_3@L2, other=extendStart_2@L2)
byStartPointEndPoint_2 = Line.ByStartPointEndPoint(startPoint=closestPointTo, endPoint=closestPointTo_2)
pcd_of_short_pipe_2 = Watch(pcd_of_short_pipe)

# group: which 2 pipes that the short pipe should connects
all_2 = Watch(all)
linesindex_shortp_from = Watch(lines_index_shortp_from)
linesindex_to_be_connected = Watch(indexOf)

# group: which 2 pipes that the short pipe should connects
all_3 = Watch(all_2)
linesindex_shortp_from_2 = Watch(linesindex_shortp_from)
linesindex_to_be_connected_2 = Watch(linesindex_to_be_connected)

all_4 = Watch()  # frozen; unwired: arg0

# group: all intersect points (result might not contains single lines)
watch = Watch(all_4)
code_block_13 = CodeBlock { 0; }
getItemAtIndex_12 = List.GetItemAtIndex(list=watch@L2, index=code_block_13)
count = List.Count(list=getItemAtIndex_12)
code_block_14 = CodeBlock(x=count) { 0..x-1; }
removeItemAtIndex = List.RemoveItemAtIndex(list=getItemAtIndex_12@@L2, indices=code_block_14, lacing=CrossProduct)
intersect = Geometry.Intersect(geometry=getItemAtIndex_12@L1, other=removeItemAtIndex@@L2, lacing=Longest)

# group: all intersect points (result might not contains single lines) > list == line intersection on line
flatten = List.Flatten(list=intersect@L3)

# group (continued): all intersect points (result might not contains single lines)
flatten_2 = List.Flatten(list=flatten)

# group: all intersect points (result might not contains single lines) > unique item: intersect points 不然一个位置会有>= 2 个points
string_from_object = FromObject(object=flatten_2)
uniqueItems = List.UniqueItems(list=string_from_object@L2)
indexOf_2 = List.IndexOf(list=string_from_object@L2, element=uniqueItems@L1, lacing=CrossProduct)

# group: all intersect points (result might not contains single lines) > intersection all
getItemAtIndex_13 = List.GetItemAtIndex(list=flatten_2, index=indexOf_2)

all_intersection = Watch(getItemAtIndex_13)
all_intersection_2 = Watch(all_intersection)

# group: curve to line
lines_new_all = Watch(all_4)
code_block_15 = CodeBlock { 0; 1; }
getItemAtIndex_14 = List.GetItemAtIndex(list=lines_new_all@L2, index=code_block_15.out0)
startPoint = Curve.StartPoint(curve=getItemAtIndex_14)
endPoint = Curve.EndPoint(curve=getItemAtIndex_14)
byStartPointEndPoint_3 = Line.ByStartPointEndPoint(startPoint=startPoint, endPoint=endPoint)
getItemAtIndex_15 = List.GetItemAtIndex(list=lines_new_all@L2, index=code_block_15.out1)
list_create_3 = List.Create(item0=byStartPointEndPoint_3, item1=getItemAtIndex_15)
transpose_3 = List.Transpose(lists=list_create_3)

lines_new_all_2 = Watch(transpose_3)
lines_new_all_3 = Watch(lines_new_all_2)

# group: Method1: projection, BestFitLine as central line
n3method_begin_with_rough_line = Watch(byStartPointEndPoint_2)  # "3method; begin with rough line"
flatten_3 = List.Flatten(list=n3method_begin_with_rough_line)
startPoint_2 = Curve.StartPoint(curve=flatten_3)
direction = Line.Direction(line=flatten_3)
byOriginNormal = Plane.ByOriginNormal(origin=startPoint_2, normal=direction)
pcd_of_short_pipe_3 = Watch(pcd_of_short_pipe_2)
flatten_4 = List.Flatten(list=pcd_of_short_pipe_3@L3)
closestPointTo_3 = Geometry.ClosestPointTo(geometry=byOriginNormal@L1, other=flatten_4@L2, lacing=Longest)
byBestFitThroughPoints_2 = Circle.ByBestFitThroughPoints(points=closestPointTo_3@L2)
radius = Circle.Radius(circle=byBestFitThroughPoints_2)
list_create_4 = List.Create(item0=flatten_3, item1=radius)
transpose_4 = List.Transpose(lists=list_create_4)
code_block_16 = CodeBlock { 0; }
getItemAtIndex_16 = List.GetItemAtIndex(list=transpose_4@L2, index=code_block_16)
code_block_17 = CodeBlock { 1; }
getItemAtIndex_17 = List.GetItemAtIndex(list=transpose_4@L2, index=code_block_17)

# group: Method2: Slicing
pcd_of_short_pipe_4 = Watch(pcd_of_short_pipe_2)
flatten_5 = List.Flatten(list=pcd_of_short_pipe_4@L3)
n3method_begin_with_bestfitline = Watch(byStartPointEndPoint_2)  # "3method; begin with bestfitline"
flatten_6 = List.Flatten(list=n3method_begin_with_bestfitline)
code_block_18 = CodeBlock { 5000; }
extendEnd_4 = Curve.ExtendEnd(curve=flatten_6, distance=code_block_18)
extendStart_4 = Curve.ExtendStart(curve=extendEnd_4, distance=code_block_18)
startPoint_3 = Curve.StartPoint(curve=extendStart_4)
distanceTo = Geometry.DistanceTo(geometry=flatten_5@L2, other=startPoint_3@L1, lacing=Longest)
code_block_19 = CodeBlock { 5; }
code_block_20 = CodeBlock { 0; }
code_block_21 = CodeBlock { 1; }

# group: Method2: Slicing > slicing step
code_block_22 = CodeBlock(x=distanceTo) { DSCore.Math.Floor(x/3); }

# group (continued): Method2: Slicing
groupByKey = List.GroupByKey(list=flatten_5@L2, keys=code_block_22@L2)
count_2 = List.Count(list=groupByKey.groups@@L2)
le = count_2@@L2 <= code_block_19
filterByBoolMask = List.FilterByBoolMask(list=groupByKey.groups@L3, mask=le@@L2)
byBestFitThroughPoints_3 = Circle.ByBestFitThroughPoints(points=filterByBoolMask.out@@L2)
centerPoint = Circle.CenterPoint(circle=byBestFitThroughPoints_3@@L2)
byBestFitThroughPoints_4 = Line.ByBestFitThroughPoints(bestFitPoints=centerPoint)
radius_2 = Circle.Radius(circle=byBestFitThroughPoints_3)
average = Math.Average(numbers=radius_2@L2)
list_create_5 = List.Create(item0=byBestFitThroughPoints_4, item1=average)
transpose_5 = List.Transpose(lists=list_create_5)
getItemAtIndex_18 = List.GetItemAtIndex(list=transpose_5@L2, index=code_block_20)
getItemAtIndex_19 = List.GetItemAtIndex(list=transpose_5@L2, index=code_block_21)

# group: Method3: only horizontal/vertical
n3method_begin_with_rough_line_2 = Watch(byStartPointEndPoint_2)  # "3method; begin with rough line"
flatten_7 = List.Flatten(list=n3method_begin_with_rough_line_2)
startPoint_4 = Curve.StartPoint(curve=flatten_7)
direction_2 = Line.Direction(line=flatten_7)
X = Vector.X(vector=direction_2)
Y = Vector.Y(vector=direction_2)
byCoordinates_4 = Vector.ByCoordinates(x=X, y=Y)
angleWithVector = Vector.AngleWithVector(vector=byCoordinates_4, otherVector=direction_2)
code_block_23 = CodeBlock { 45; }
lt = angleWithVector < code_block_23
ZAxis = Vector.ZAxis()
if_ = RefactoredIf(test=lt@L1, true=byCoordinates_4@L1, false=ZAxis)
byOriginNormal_2 = Plane.ByOriginNormal(origin=startPoint_4, normal=if_)
pcd_of_short_pipe_5 = Watch(pcd_of_short_pipe_2)
flatten_8 = List.Flatten(list=pcd_of_short_pipe_5@L3)
closestPointTo_4 = Geometry.ClosestPointTo(geometry=byOriginNormal_2@L1, other=flatten_8@L2, lacing=Longest)
byBestFitThroughPoints_5 = Circle.ByBestFitThroughPoints(points=closestPointTo_4@L2)
centerPoint_2 = Circle.CenterPoint(circle=byBestFitThroughPoints_5)
length = Curve.Length(curve=flatten_7)
translate = Geometry.Translate(geometry=centerPoint_2, direction=if_, distance=length)
byStartPointEndPoint_4 = Line.ByStartPointEndPoint(startPoint=centerPoint_2, endPoint=translate)
radius_3 = Circle.Radius(circle=byBestFitThroughPoints_5)
list_create_6 = List.Create(item0=byStartPointEndPoint_4, item1=radius_3)
transpose_6 = List.Transpose(lists=list_create_6)
code_block_24 = CodeBlock { 0; }
getItemAtIndex_20 = List.GetItemAtIndex(list=transpose_6@L2, index=code_block_24)
code_block_25 = CodeBlock { 1; }
getItemAtIndex_21 = List.GetItemAtIndex(list=transpose_6@L2, index=code_block_25)

# group: best choice > line: method 123 radius: from method 123
list_create_7 = List.Create(item0=getItemAtIndex_16, item1=getItemAtIndex_18, item2=getItemAtIndex_20)
transpose_7 = List.Transpose(lists=list_create_7)
list_create_8 = List.Create(item0=getItemAtIndex_17, item1=getItemAtIndex_19, item2=getItemAtIndex_21)
transpose_8 = List.Transpose(lists=list_create_8)

pcd_of_short_pipe_6 = Watch(pcd_of_short_pipe_2)
pcd_of_short_pipe_7 = Watch(pcd_of_short_pipe_6)

# group: Method 1+23
pcd_of_short_pipe_8 = Watch(pcd_of_short_pipe_7)
line_from_method = Watch(transpose_4)
code_block_26 = CodeBlock { 0; 1; }
getItemAtIndex_22 = List.GetItemAtIndex(list=line_from_method@L2, index=code_block_26.out0)
code_block_27 = CodeBlock { 500; }
extendEnd_5 = Curve.ExtendEnd(curve=getItemAtIndex_22, distance=code_block_27)
extendStart_5 = Curve.ExtendStart(curve=extendEnd_5, distance=code_block_27)
distanceTo_2 = Geometry.DistanceTo(geometry=pcd_of_short_pipe_8@@L2, other=extendStart_5@L1)
getItemAtIndex_23 = List.GetItemAtIndex(list=line_from_method@L2, index=code_block_26.out1)
code_block_28 = CodeBlock(x=getItemAtIndex_23) { x; 10; }
code_block_29 = CodeBlock(x=code_block_28.x, a=code_block_28.out1) { x-a; x+a; }
ge = distanceTo_2@@L2 >= code_block_29.out0@L1
le_2 = distanceTo_2@@L2 <= code_block_29.out1@L1
and_ = Custom[And](Bool=ge@@L1, Bool_2=le_2@L1)  # package Hot Gear
countTrue = List.CountTrue(list=and_@L2)

# group: Method 1+23 > radius from method 2
code_block_30 = CodeBlock(x=getItemAtIndex_19) { x; 10; }
code_block_31 = CodeBlock(x=code_block_30.x, a=code_block_30.out1) { x-a; x+a; }
ge_2 = distanceTo_2@@L2 >= code_block_31.out0@L1
le_3 = distanceTo_2@@L2 <= code_block_31.out1@L1
and_2 = Custom[And](Bool=ge_2@@L1, Bool_2=le_3@L1)
countTrue_2 = List.CountTrue(list=and_2@L2)

# group: Method 1+23 > radius from method 3
code_block_32 = CodeBlock(x=getItemAtIndex_21) { x; 10; }
code_block_33 = CodeBlock(x=code_block_32.x, a=code_block_32.out1) { x-a; x+a; }
ge_3 = distanceTo_2@@L2 >= code_block_33.out0@L1
le_4 = distanceTo_2@@L2 <= code_block_33.out1@L1
and_3 = Custom[And](Bool=ge_3@@L1, Bool_2=le_4@L1)
countTrue_3 = List.CountTrue(list=and_3@L2)

# group: Method 2+13
pcd_of_short_pipe_9 = Watch(pcd_of_short_pipe_7)
line_from_method_2 = Watch(transpose_4)
code_block_34 = CodeBlock { 0; 1; }
getItemAtIndex_24 = List.GetItemAtIndex(list=line_from_method_2@L2, index=code_block_34.out0)
code_block_35 = CodeBlock { 500; }
extendEnd_6 = Curve.ExtendEnd(curve=getItemAtIndex_24, distance=code_block_35)
extendStart_6 = Curve.ExtendStart(curve=extendEnd_6, distance=code_block_35)
distanceTo_3 = Geometry.DistanceTo(geometry=pcd_of_short_pipe_9@@L2, other=extendStart_6@L1, lacing=Longest)
getItemAtIndex_25 = List.GetItemAtIndex(list=line_from_method_2@L2, index=code_block_34.out1)
code_block_36 = CodeBlock(x=getItemAtIndex_25) { x; 10; }
code_block_37 = CodeBlock(x=code_block_36.x, a=code_block_36.out1) { x-a; x+a; }
ge_4 = distanceTo_3@@L2 >= code_block_37.out0@L1
le_5 = distanceTo_3@@L2 <= code_block_37.out1@L1
and_4 = Custom[And](Bool=ge_4@@L1, Bool_2=le_5@L1)
countTrue_4 = List.CountTrue(list=and_4@L2)

# group: Method 2+13 > radius from method 1
code_block_38 = CodeBlock(x=getItemAtIndex_17) { x; 10; }
code_block_39 = CodeBlock(x=code_block_38.x, a=code_block_38.out1) { x-a; x+a; }
ge_5 = distanceTo_3@@L2 >= code_block_39.out0@L1
le_6 = distanceTo_3@@L2 <= code_block_39.out1@L1
and_5 = Custom[And](Bool=ge_5@@L1, Bool_2=le_6@L1)
countTrue_5 = List.CountTrue(list=and_5@L2)

# group: Method 2+13 > radius from method 3
code_block_40 = CodeBlock(x=getItemAtIndex_21) { x; 10; }
code_block_41 = CodeBlock(x=code_block_40.x, a=code_block_40.out1) { x-a; x+a; }
ge_6 = distanceTo_3@@L2 >= code_block_41.out0@L1
le_7 = distanceTo_3@@L2 <= code_block_41.out1@L1
and_6 = Custom[And](Bool=ge_6@@L1, Bool_2=le_7@L1)
countTrue_6 = List.CountTrue(list=and_6@L2)

# group: Method 3+12
pcd_of_short_pipe_10 = Watch(pcd_of_short_pipe_7)
line_from_method_3 = Watch(transpose_6)
code_block_42 = CodeBlock { 0; 1; }
getItemAtIndex_26 = List.GetItemAtIndex(list=line_from_method_3@L2, index=code_block_42.out0)
code_block_43 = CodeBlock { 500; }
extendEnd_7 = Curve.ExtendEnd(curve=getItemAtIndex_26, distance=code_block_43)
extendStart_7 = Curve.ExtendStart(curve=extendEnd_7, distance=code_block_43)
distanceTo_4 = Geometry.DistanceTo(geometry=pcd_of_short_pipe_10@@L2, other=extendStart_7@L1)
getItemAtIndex_27 = List.GetItemAtIndex(list=line_from_method_3@L2, index=code_block_42.out1)
code_block_44 = CodeBlock(x=getItemAtIndex_27) { x; 10; }
code_block_45 = CodeBlock(x=code_block_44.x, a=code_block_44.out1) { x-a; x+a; }
ge_7 = distanceTo_4@@L2 >= code_block_45.out0@L1
le_8 = distanceTo_4@@L2 <= code_block_45.out1@L1
and_7 = Custom[And](Bool=ge_7@@L1, Bool_2=le_8@L2)
countTrue_7 = List.CountTrue(list=and_7@L2)

# group: Method 3+12 > radius from method 1
code_block_46 = CodeBlock(x=getItemAtIndex_17) { x; 10; }
code_block_47 = CodeBlock(x=code_block_46.x, a=code_block_46.out1) { x-a; x+a; }
ge_8 = distanceTo_4@@L2 >= code_block_47.out0@L1
le_9 = distanceTo_4@@L2 <= code_block_47.out1@L1
and_8 = Custom[And](Bool=ge_8@@L1, Bool_2=le_9@L2)
countTrue_8 = List.CountTrue(list=and_8@L2)

# group: Method 3+12 > radius from method 3
code_block_48 = CodeBlock(x=getItemAtIndex_19) { x; 10; }
code_block_49 = CodeBlock(x=code_block_48.x, a=code_block_48.out1) { x-a; x+a; }
ge_9 = distanceTo_4@@L2 >= code_block_49.out0@L1
le_10 = distanceTo_4@@L2 <= code_block_49.out1@L1
and_9 = Custom[And](Bool=ge_9@@L1, Bool_2=le_10@L2)
countTrue_9 = List.CountTrue(list=and_9@L2)

# group: best choice > method1 (radius123) method2 (radius123) method3 (radius123)
list_create_9 = List.Create(item0=countTrue, item1=countTrue_2, item2=countTrue_3, item3=countTrue_5, item4=countTrue_4, item5=countTrue_6, item6=countTrue_8, item7=countTrue_9, item8=countTrue_7)
transpose_9 = List.Transpose(lists=list_create_9)

# group: best choice
code_block_50 = CodeBlock { 3; }
chop = List.Chop(list=transpose_9@L2, lengths=code_block_50)
maximumItem = List.MaximumItem(list=transpose_9@L2)
eq = chop@@L3 == maximumItem@L1  # lacing=Longest
anyTrue = List.AnyTrue(list=eq@@L2)
boolean = BoolSelector(true)
list_indexof_method = List.IndexOf(list=anyTrue@L2, element=boolean)
list_getitematindex_method = List.GetItemAtIndex(list=transpose_7@L2, index=list_indexof_method@L1)
flatten_9 = List.Flatten(list=list_getitematindex_method)
getItemAtIndex_28 = List.GetItemAtIndex(list=eq@L3, index=list_indexof_method@L1)
list_indexof_radius = List.IndexOf(list=getItemAtIndex_28@L2, element=boolean)
getItemAtIndex_29 = List.GetItemAtIndex(list=transpose_8@L2, index=list_indexof_radius@L1, lacing=Longest)
list_create_10 = List.Create(item0=flatten_9, item1=getItemAtIndex_29)
transpose_10 = List.Transpose(lists=list_create_10)

# group: create short pipes & add to list end > which 2 pipes that the short pipe should connects
current_all = Watch(all_3)
linesindex_shortp_from_3 = Watch(linesindex_shortp_from_2)
linesindex_to_be_connected_3 = Watch(linesindex_to_be_connected_2)
short_pipe_its_2_connecting = Watch(transpose_10)  # "short pipe & its 2 connecting pipes"

# group: create short pipes & add to list end
getItemAtIndex_30 = List.GetItemAtIndex(list=current_all@@L3, index=linesindex_shortp_from_3)
code_block_51 = CodeBlock { 0; 1; }
getItemAtIndex_31 = List.GetItemAtIndex(list=getItemAtIndex_30@@L2, index=code_block_51.out1)
getItemAtIndex_32 = List.GetItemAtIndex(list=current_all@@L3, index=linesindex_to_be_connected_3)
code_block_52 = CodeBlock { 0; 1; }
getItemAtIndex_33 = List.GetItemAtIndex(list=getItemAtIndex_32@@L2, index=code_block_52.out1)
code_block_53 = CodeBlock { 0; }
code_block_54 = CodeBlock { 0; 1; }
getItemAtIndex_34 = List.GetItemAtIndex(list=getItemAtIndex_30@@L2, index=code_block_51.out0)
code_block_55 = CodeBlock { 1000; }
extendEnd_8 = Curve.ExtendEnd(curve=getItemAtIndex_34, distance=code_block_55)
extendStart_8 = Curve.ExtendStart(curve=extendEnd_8, distance=code_block_55)
getItemAtIndex_35 = List.GetItemAtIndex(list=getItemAtIndex_32@@L2, index=code_block_52.out0)
code_block_56 = CodeBlock { 1000; }
extendEnd_9 = Curve.ExtendEnd(curve=getItemAtIndex_35, distance=code_block_56)
extendStart_9 = Curve.ExtendStart(curve=extendEnd_9, distance=code_block_56)
code_block_57 = CodeBlock { 0; 1; }
getItemAtIndex_36 = List.GetItemAtIndex(list=short_pipe_its_2_connecting@@L2, index=code_block_57.out0)
code_block_58 = CodeBlock { 1000; }
extendEnd_10 = Curve.ExtendEnd(curve=getItemAtIndex_36, distance=code_block_58)
extendStart_10 = Curve.ExtendStart(curve=extendEnd_10, distance=code_block_58)
closestPointTo_5 = Geometry.ClosestPointTo(geometry=extendStart_8@L2, other=extendStart_10@L2)
parameterAtPoint = Curve.ParameterAtPoint(curve=extendStart_8, point=closestPointTo_5)
closestPointTo_6 = Geometry.ClosestPointTo(geometry=extendStart_9@L2, other=extendStart_10@L2)
parameterAtPoint_2 = Curve.ParameterAtPoint(curve=extendStart_9, point=closestPointTo_6)
getItemAtIndex_37 = List.GetItemAtIndex(list=short_pipe_its_2_connecting@@L2, index=code_block_57.out1)

current_all_2 = Watch(current_all)

# group: create short pipes & add to list end > trim existing pipes group bcs pipes may repeat/overlap
code_block_59 = CodeBlock(x=getItemAtIndex_30, y=getItemAtIndex_32) { x[0]; y[0]; }
join = List.Join(list0=code_block_59.out0, list1=code_block_59.out1)
join_2 = List.Join(list0=linesindex_shortp_from_3, list1=linesindex_to_be_connected_3)
list_groupbykey_pipe = List.GroupByKey(list=join@L3, keys=join_2)
grouped_existing_pipes = Watch(list_groupbykey_pipe.groups)

# group (continued): create short pipes & add to list end
getItemAtIndex_38 = List.GetItemAtIndex(list=grouped_existing_pipes@@L3, index=code_block_53)
getItemAtIndex_39 = List.GetItemAtIndex(list=getItemAtIndex_38@L2, index=code_block_54.out0)
getItemAtIndex_40 = List.GetItemAtIndex(list=getItemAtIndex_38@L2, index=code_block_54.out1)

# group: replace trimed pipes (has connection with short pipe)
all_5 = Watch(current_all_2)
code_block_60 = CodeBlock { 0; }
getItemAtIndex_41 = List.GetItemAtIndex(list=all_5@L2, index=code_block_60)
indexOf_3 = List.IndexOf(list=getItemAtIndex_41, element=getItemAtIndex_39)

# group: create short pipes & add to list end > grouping extended lines
code_block_61 = CodeBlock(x=extendStart_8, y=extendStart_9) { x[0]; y[0]; }
join_3 = List.Join(list0=code_block_61.out0, list1=code_block_61.out1)
list_groupbykey_pipe_2 = List.GroupByKey(list=join_3, keys=join_2)
code_block_62 = CodeBlock { 0; }
getItemAtIndex_42 = List.GetItemAtIndex(list=list_groupbykey_pipe_2.groups@L2, index=code_block_62)
grouped_existing_pipes_2 = Watch(getItemAtIndex_42)

# group: create short pipes & add to list end > grouping param
startPoint_5 = Curve.StartPoint(curve=getItemAtIndex_34)
parameterAtPoint_3 = Curve.ParameterAtPoint(curve=extendStart_8, point=startPoint_5)
flatten_10 = List.Flatten(list=parameterAtPoint_3)
endPoint_2 = Curve.EndPoint(curve=getItemAtIndex_34)
parameterAtPoint_4 = Curve.ParameterAtPoint(curve=extendStart_8, point=endPoint_2)
flatten_11 = List.Flatten(list=parameterAtPoint_4)
flatten_12 = List.Flatten(list=parameterAtPoint)
list_create_11 = List.Create(item0=flatten_10, item1=flatten_11, item2=flatten_12)
transpose_11 = List.Transpose(lists=list_create_11)
startPoint_6 = Curve.StartPoint(curve=getItemAtIndex_35)
parameterAtPoint_5 = Curve.ParameterAtPoint(curve=extendStart_9, point=startPoint_6)
flatten_13 = List.Flatten(list=parameterAtPoint_5)
endPoint_3 = Curve.EndPoint(curve=getItemAtIndex_35)
parameterAtPoint_6 = Curve.ParameterAtPoint(curve=extendStart_9, point=endPoint_3)
flatten_14 = List.Flatten(list=parameterAtPoint_6)
flatten_15 = List.Flatten(list=parameterAtPoint_2)
list_create_12 = List.Create(item0=flatten_13, item1=flatten_14, item2=flatten_15)
transpose_12 = List.Transpose(lists=list_create_12)
join_4 = List.Join(list0=transpose_11, list1=transpose_12)
list_groupbykey_param = List.GroupByKey(list=join_4@L3, keys=join_2)
flatten_16 = List.Flatten(list=list_groupbykey_param.groups@L3)
grouped_existing_pipe_param = Watch(flatten_16)

# group: create short pipes & add to list end > trim existing pipes at param define param min: trimStart max: trimEnd
minimumItem = List.MinimumItem(list=grouped_existing_pipe_param@@L2)
maximumItem_2 = List.MaximumItem(list=grouped_existing_pipe_param@@L2)
trimByParameter = Curve.TrimByParameter(curve=grouped_existing_pipes_2, startParameter=minimumItem, endParameter=maximumItem_2)

# group (continued): create short pipes & add to list end
list_create_13 = List.Create(item0=trimByParameter, item1=getItemAtIndex_40)
transpose_13 = List.Transpose(lists=list_create_13)

# group: create short pipes & add to list end > created short pipes
byStartPointEndPoint_5 = Line.ByStartPointEndPoint(startPoint=closestPointTo_5@L2, endPoint=closestPointTo_6@L2)
flatten_17 = List.Flatten(list=byStartPointEndPoint_5)
list_create_14 = List.Create(item0=flatten_17, item1=getItemAtIndex_37)
transpose_14 = List.Transpose(lists=list_create_14)

# group (continued): create short pipes & add to list end
watch_2 = Watch(transpose_14)

# group: replacement
python_script = Python(IN[0]=all_5, IN[1]=indexOf_3, IN[2]=transpose_13)  # CPython3
# ---------- python_script.python (8 lines) ----------
#list, index, replace item#

lst = IN[0]
ind = IN[1]
rep = IN[2]
for i,x in zip(ind,rep):
	lst[i]=x
OUT = lst
# ----------------------------------------
join_5 = List.Join(list0=python_script, list1=watch_2)

# group: end elbow==>to equipment
all_6 = Watch(join_5)
pcd_only_has_end_elbow = Watch()  # unwired: arg0
flatten_18 = List.Flatten(list=pcd_only_has_end_elbow@L3)
byBestFit = Sphere.ByBestFit(points=flatten_18@L2)
code_block_63 = CodeBlock { 0; }
getItemAtIndex_43 = List.GetItemAtIndex(list=all_6@L2, index=code_block_63)
distanceTo_5 = Geometry.DistanceTo(geometry=byBestFit@L1, other=getItemAtIndex_43@L2, lacing=CrossProduct)
minimumItem_2 = List.MinimumItem(list=distanceTo_5@L2)
eq_2 = distanceTo_5@L2 == minimumItem_2@L1  # lacing=Longest
boolean_2 = BoolSelector(true)
allIndicesOf = List.AllIndicesOf(list=eq_2@L2, item=boolean_2@L1, lacing=Longest)
getItemAtIndex_44 = List.GetItemAtIndex(list=all_6@L3, index=allIndicesOf@L1, lacing=Longest)
code_block_64 = CodeBlock { 0; 1; }
getItemAtIndex_45 = List.GetItemAtIndex(list=getItemAtIndex_44@L2, index=code_block_64.out0)
code_block_65 = CodeBlock { 600; }
extendEnd_11 = Curve.ExtendEnd(curve=getItemAtIndex_45, distance=code_block_65)
extendStart_11 = Curve.ExtendStart(curve=extendEnd_11, distance=code_block_65)
startPoint_7 = Curve.StartPoint(curve=getItemAtIndex_45)
parameterAtPoint_7 = Curve.ParameterAtPoint(curve=extendStart_11, point=startPoint_7)
code_block_66 = CodeBlock { 1; }  # frozen
chop_2 = List.Chop(list=parameterAtPoint_7, lengths=code_block_66)
endPoint_4 = Curve.EndPoint(curve=getItemAtIndex_45)
parameterAtPoint_8 = Curve.ParameterAtPoint(curve=extendStart_11, point=endPoint_4)
code_block_67 = CodeBlock { 1; }  # frozen
chop_3 = List.Chop(list=parameterAtPoint_8, lengths=code_block_67)
pcd_only_has_end_elbow_2 = Watch(flatten_18)
closestPointTo_7 = Geometry.ClosestPointTo(geometry=extendStart_11@L1, other=pcd_only_has_end_elbow_2@L2, lacing=Longest)
parameterAtPoint_9 = Curve.ParameterAtPoint(curve=extendStart_11@L1, point=closestPointTo_7@L2)
getItemAtIndex_46 = List.GetItemAtIndex(list=getItemAtIndex_44@L2, index=code_block_64.out1)
radius_4 = Watch(getItemAtIndex_46)

all_7 = Watch(all_6)

# group: replace trimed pipes (has connection with short pipe)
all_8 = Watch(all_7)
code_block_68 = CodeBlock { 0; }
getItemAtIndex_47 = List.GetItemAtIndex(list=all_8@L2, index=code_block_68)
code_block_69 = CodeBlock { 0; }
getItemAtIndex_48 = List.GetItemAtIndex(list=getItemAtIndex_44@L2, index=code_block_69)
indexOf_4 = List.IndexOf(list=getItemAtIndex_47, element=getItemAtIndex_48)

# group: end elbow==>to equipment > tentative end point & param on extended line
code_block_70 = CodeBlock(extended_lines=extendStart_11) { extended_lines; }
minimumItem_3 = List.MinimumItem(list=parameterAtPoint_9@L2)
maximumItem_3 = List.MaximumItem(list=parameterAtPoint_9@L2)
min = Math.Min(value1=minimumItem_3, value2=maximumItem_3)
code_block_71 = CodeBlock { 0.5; }
gt = min > code_block_71
max = Math.Max(value1=minimumItem_3, value2=maximumItem_3)
if_2 = RefactoredIf(test=gt@L1, true=max@L1, false=min@L1)
pointAtParameter = Curve.PointAtParameter(curve=code_block_70, param=if_2)
code_block_72 = CodeBlock { 0.5; }
pointAtParameter_2 = Curve.PointAtParameter(curve=code_block_70, param=code_block_72)
byTwoPoints = Vector.ByTwoPoints(start=pointAtParameter, end=pointAtParameter_2)
code_block_73 = CodeBlock(radius_inward_translate=getItemAtIndex_46) { radius_inward_translate; }
translate_2 = Geometry.Translate(geometry=pointAtParameter, direction=byTwoPoints, distance=code_block_73)
parameterAtPoint_10 = Curve.ParameterAtPoint(curve=code_block_70, point=translate_2, lacing=Longest)

# group (continued): end elbow==>to equipment
code_block_74 = CodeBlock(extended_lines=code_block_70) { extended_lines; }
list_create_15 = List.Create(item0=parameterAtPoint_7, item1=parameterAtPoint_8, item2=parameterAtPoint_10)
transpose_15 = List.Transpose(lists=list_create_15)
minimumItem_4 = List.MinimumItem(list=transpose_15@L2)
maximumItem_4 = List.MaximumItem(list=transpose_15@L2)
trimByParameter_2 = Curve.TrimByParameter(curve=code_block_74, startParameter=minimumItem_4, endParameter=maximumItem_4)
list_create_16 = List.Create(item0=trimByParameter_2, item1=radius_4)
transpose_16 = List.Transpose(lists=list_create_16)

# group: replacement
python_script_2 = Python(IN[0]=all_8, IN[1]=indexOf_4, IN[2]=transpose_16)  # CPython3; same code as python_script

all_9 = Watch(python_script_2)

# group: inspect if there is unconnected pipes eg. pipes are connected, but there is NO PCD for defining connection relationship, in the process of elbow/short pipe calibration
all_10 = Watch(all_9)
code_block_75 = CodeBlock { 0; 1; }
getItemAtIndex_49 = List.GetItemAtIndex(list=all_10@L2, index=code_block_75.out0)
getItemAtIndex_50 = List.GetItemAtIndex(list=all_10@L2, index=code_block_75.out1)
code_block_76 = CodeBlock(radius=getItemAtIndex_50) { radius*2; }
extendEnd_12 = Curve.ExtendEnd(curve=getItemAtIndex_49, distance=code_block_76)
extendStart_12 = Curve.ExtendStart(curve=extendEnd_12, distance=code_block_76)
count_3 = List.Count(list=extendStart_12)
code_block_77 = CodeBlock(x=count_3) { 0..x-1; }
removeItemAtIndex_2 = List.RemoveItemAtIndex(list=getItemAtIndex_49@L2, indices=code_block_77@L1, lacing=CrossProduct)
all_11 = Watch(all_10)
count_4 = List.Count(list=getItemAtIndex_49)
code_block_78 = CodeBlock(x=count_4) { 0..x-1; }
list_removeitematindex_original = List.RemoveItemAtIndex(list=all_11@L3, indices=code_block_78@L1, lacing=CrossProduct)

# group: inspect if there is unconnected pipes eg. pipes are connected, but there is NO PCD for defining connection relationship, in the process of elbow/short pipe calibration > distance to its neighbor filter1: anytrue==filter out single pipes, thus, rest of pipes has connections on filter2: true at sublist level==filter out irrelative pipes to the list pipe condition 1 : distance<radius
distanceTo_6 = Geometry.DistanceTo(geometry=getItemAtIndex_49@L1, other=removeItemAtIndex_2@L2, lacing=Longest)
le_11 = distanceTo_6@L2 <= getItemAtIndex_50@L1  # lacing=Longest
anyTrue_2 = List.AnyTrue(list=le_11@L2)
boolean_3 = BoolSelector(true)
allIndicesOf_2 = List.AllIndicesOf(list=anyTrue_2@L2, item=boolean_3@L1, lacing=Longest)
removeItemAtIndex_3 = List.RemoveItemAtIndex(list=distanceTo_6@L3, indices=allIndicesOf_2@L1, lacing=Longest)
removeItemAtIndex_4 = List.RemoveItemAtIndex(list=le_11@L3, indices=allIndicesOf_2@L1, lacing=Longest)
getItemAtIndex_51 = List.GetItemAtIndex(list=distanceTo_6@L3, index=allIndicesOf_2@L1, lacing=Longest)
getItemAtIndex_52 = List.GetItemAtIndex(list=le_11@L3, index=allIndicesOf_2@L1, lacing=Longest)
boolean_4 = BoolSelector(true)
allIndicesOf_3 = List.AllIndicesOf(list=getItemAtIndex_52@L2, item=boolean_4)
getItemAtIndex_53 = List.GetItemAtIndex(list=getItemAtIndex_51@L2, index=allIndicesOf_3@@L2, lacing=Longest)
getItemAtIndex_54 = List.GetItemAtIndex(list=list_removeitematindex_original@L4, index=allIndicesOf_2@L1, lacing=Longest)
getItemAtIndex_55 = List.GetItemAtIndex(list=getItemAtIndex_54@L3, index=allIndicesOf_3@@L2, lacing=Longest)

removeItemAtIndex_5 = List.RemoveItemAtIndex(list=all_11@L3, indices=allIndicesOf_2@L1, lacing=Longest)

# group (continued): inspect if there is unconnected pipes eg. pipes are connected, but there is NO PCD for defining connection relationship, in the process of elbow/short pipe calibration
getItemAtIndex_56 = List.GetItemAtIndex(list=all_11@L3, index=allIndicesOf_2@L1, lacing=Longest)

all_intersection_3 = Watch(all_intersection)
all_12 = Watch(all_11)
all_13 = Watch(all_12)

# group: inspect if there is unconnected pipes eg. pipes are connected, but there is NO PCD for defining connection relationship, in the process of elbow/short pipe calibration > condition 2: distance < radius; condition 3: within the radius but NOT intersected yet (ie. distance>0) filter1: ==>anytrue==filter out pipes that are well connected (ie. without 未连接好的neighbouring pipes) filter2: filter out intersected pipes to the list pipe
code_block_79 = CodeBlock { 1; }
getItemAtIndex_57 = List.GetItemAtIndex(list=getItemAtIndex_56@L2, index=code_block_79)
le_12 = getItemAtIndex_53@@L2 <= getItemAtIndex_57@L1  # lacing=Longest
code_block_80 = CodeBlock { 0; }
gt_2 = getItemAtIndex_53@@L2 > code_block_80  # lacing=Longest
and_10 = Custom[And](Bool=le_12@@L1, Bool_2=gt_2@L1)
anyTrue_3 = List.AnyTrue(list=and_10@L2)
boolean_5 = BoolSelector(true)
allIndicesOf_4 = List.AllIndicesOf(list=anyTrue_3@L2, item=boolean_5)
getItemAtIndex_58 = List.GetItemAtIndex(list=getItemAtIndex_53@L3, index=allIndicesOf_4@L1, lacing=Longest)
getItemAtIndex_59 = List.GetItemAtIndex(list=and_10@L3, index=allIndicesOf_4@L1, lacing=Longest)
boolean_6 = BoolSelector(true)
allIndicesOf_5 = List.AllIndicesOf(list=getItemAtIndex_59@L2, item=boolean_6)
getItemAtIndex_60 = List.GetItemAtIndex(list=getItemAtIndex_58@L2, index=allIndicesOf_5@@L1, lacing=Longest)
code_block_81 = CodeBlock { 0; }
eq_3 = getItemAtIndex_53@@L2 == code_block_81  # lacing=Longest
contains = List.Contains(list=getItemAtIndex_53@@L2, item=code_block_81, lacing=Longest)
code_block_82 = CodeBlock { 0; }
getItemAtIndex_61 = List.GetItemAtIndex(list=all_13@L2, index=code_block_82)
pipes_that_have_connections_on = Watch(getItemAtIndex_56)
getItemAtIndex_62 = List.GetItemAtIndex(list=pipes_that_have_connections_on@L3, index=allIndicesOf_4@L1, lacing=Longest)
pipe_a_that_have_connections_on = Watch(getItemAtIndex_62)
code_block_83 = CodeBlock { 0; }
getItemAtIndex_63 = List.GetItemAtIndex(list=pipe_a_that_have_connections_on@L2, index=code_block_83)
indexOf_5 = List.IndexOf(list=getItemAtIndex_61, element=getItemAtIndex_63)
getItemAtIndex_64 = List.GetItemAtIndex(list=getItemAtIndex_55@L4, index=allIndicesOf_4@L1, lacing=Longest)
getItemAtIndex_65 = List.GetItemAtIndex(list=getItemAtIndex_64@L3, index=allIndicesOf_5@@L1, lacing=Longest)
pipes_b_connect_to_a = Watch(getItemAtIndex_65)
code_block_84 = CodeBlock { 0; }
getItemAtIndex_66 = List.GetItemAtIndex(list=pipes_b_connect_to_a@L2, index=code_block_84)
indexOf_6 = List.IndexOf(list=getItemAtIndex_61, element=getItemAtIndex_66)

all_14 = Watch(all_13)
all_15 = Watch(all_14)

# group: inspect if there is unconnected pipes eg. pipes are connected, but there is NO PCD for defining connection relationship, in the process of elbow/short pipe calibration > remove repeat group
list_create_17 = List.Create(item0=indexOf_5, item1=indexOf_6)
transpose_17 = List.Transpose(lists=list_create_17)
sort = List.Sort(list=transpose_17@L2)
uniqueItems_2 = List.UniqueItems(list=sort@L3)

# group: inspect if there is unconnected pipes eg. pipes are connected, but there is NO PCD for defining connection relationship, in the process of elbow/short pipe calibration
index_in_group = Watch(uniqueItems_2)
flatten_19 = List.Flatten(list=index_in_group)
all_16 = Watch(all_14)
getItemAtIndex_67 = List.GetItemAtIndex(list=all_16@L3, index=uniqueItems_2@@L2, lacing=Longest)
code_block_85 = CodeBlock { 0; 1; }
getItemAtIndex_68 = List.GetItemAtIndex(list=getItemAtIndex_67@@L2, index=code_block_85.out0)
code_block_86 = CodeBlock()
# ---------- code_block_86.designscript (3 lines) ----------
0;
//one of the pipe, & the other
1;
# ----------------------------------------
getItemAtIndex_69 = List.GetItemAtIndex(list=getItemAtIndex_68@L2, index=code_block_86.out0)
startPoint_8 = Curve.StartPoint(curve=getItemAtIndex_69)
getItemAtIndex_70 = List.GetItemAtIndex(list=getItemAtIndex_67@@L2, index=code_block_85.out1)
code_block_87 = CodeBlock(radius=getItemAtIndex_70) { radius*3; }
extendEnd_13 = Curve.ExtendEnd(curve=getItemAtIndex_68, distance=code_block_87)
extendStart_13 = Curve.ExtendStart(curve=extendEnd_13, distance=code_block_87)
code_block_88 = CodeBlock()  # same code as code_block_86
getItemAtIndex_71 = List.GetItemAtIndex(list=extendStart_13@L2, index=code_block_88.out0)
getItemAtIndex_72 = List.GetItemAtIndex(list=extendStart_13@L2, index=code_block_88.out1)
geometry_closestpointto_on_a_to = Geometry.ClosestPointTo(geometry=getItemAtIndex_71, other=getItemAtIndex_72)  # "Geometry.ClosestPointTo: on A to B"
distanceTo_7 = Geometry.DistanceTo(geometry=startPoint_8, other=geometry_closestpointto_on_a_to)
endPoint_5 = Curve.EndPoint(curve=getItemAtIndex_69)
distanceTo_8 = Geometry.DistanceTo(geometry=endPoint_5, other=geometry_closestpointto_on_a_to)
gt_3 = distanceTo_7 > distanceTo_8
if_3 = RefactoredIf(test=gt_3@L1, true=startPoint_8@L1, false=endPoint_5@L1)
geometry_closestpointto_on_b_to = Geometry.ClosestPointTo(geometry=getItemAtIndex_72, other=getItemAtIndex_71)  # "Geometry.ClosestPointTo: on B to A"
list_create_18 = List.Create(item0=geometry_closestpointto_on_a_to, item1=geometry_closestpointto_on_b_to)
transpose_18 = List.Transpose(lists=list_create_18)
getItemAtIndex_73 = List.GetItemAtIndex(list=getItemAtIndex_68@L2, index=code_block_86.out1)
startPoint_9 = Curve.StartPoint(curve=getItemAtIndex_73)
distanceTo_9 = Geometry.DistanceTo(geometry=startPoint_9, other=geometry_closestpointto_on_b_to)
endPoint_6 = Curve.EndPoint(curve=getItemAtIndex_73)
distanceTo_10 = Geometry.DistanceTo(geometry=endPoint_6, other=geometry_closestpointto_on_b_to)
gt_4 = distanceTo_9 > distanceTo_10
if_4 = RefactoredIf(test=gt_4@L1, true=startPoint_9@L1, false=endPoint_6@L1)

# group (continued): inspect if there is unconnected pipes eg. pipes are connected, but there is NO PCD for defining connection relationship, in the process of elbow/short pipe calibration
code_block_89 = CodeBlock(flattened_index=flatten_19) { flattened_index; }
X_2 = Point.X(point=transpose_18)
average_2 = Math.Average(numbers=X_2@L2)
Y_2 = Point.Y(point=transpose_18)
average_3 = Math.Average(numbers=Y_2@L2)
Z = Point.Z(point=transpose_18)
average_4 = Math.Average(numbers=Z@L2)
byCoordinates_5 = Point.ByCoordinates(x=average_2, y=average_3, z=average_4)
byStartPointEndPoint_6 = Line.ByStartPointEndPoint(startPoint=if_3, endPoint=byCoordinates_5)
byStartPointEndPoint_7 = Line.ByStartPointEndPoint(startPoint=if_4, endPoint=byCoordinates_5)
list_create_19 = List.Create(item0=byStartPointEndPoint_6, item1=byStartPointEndPoint_7)
transpose_19 = List.Transpose(lists=list_create_19)
radius_5 = Watch(getItemAtIndex_70)
radius_6 = Watch(radius_5)

flatten_20 = List.Flatten(list=transpose_19)
flatten_21 = List.Flatten(list=radius_6)

# group (continued): inspect if there is unconnected pipes eg. pipes are connected, but there is NO PCD for defining connection relationship, in the process of elbow/short pipe calibration
list_create_20 = List.Create(item0=flatten_20, item1=flatten_21)
transpose_20 = List.Transpose(lists=list_create_20)

# group: replacement
python_script_3 = Python(IN[0]=all_15, IN[1]=code_block_89, IN[2]=transpose_20)  # CPython3; same code as python_script

all_17 = Watch(python_script_3)

# group: cylinder check
watch_3 = Watch(all_4)
code_block_90 = CodeBlock { 0; 1; }
getItemAtIndex_74 = List.GetItemAtIndex(list=watch_3@L2, index=code_block_90.out0)
startPoint_10 = Curve.StartPoint(curve=getItemAtIndex_74)
endPoint_7 = Curve.EndPoint(curve=getItemAtIndex_74)
getItemAtIndex_75 = List.GetItemAtIndex(list=watch_3@L2, index=code_block_90.out1)
byPointsRadius_2 = Cylinder.ByPointsRadius(startPoint=startPoint_10, endPoint=endPoint_7, radius=getItemAtIndex_75)

# group: cylinder check
watch_4 = Watch(python_script_2)  # frozen
code_block_91 = CodeBlock { 0; 1; }
getItemAtIndex_76 = List.GetItemAtIndex(list=watch_4@L2, index=code_block_91.out0)
startPoint_11 = Curve.StartPoint(curve=getItemAtIndex_76)
endPoint_8 = Curve.EndPoint(curve=getItemAtIndex_76)
getItemAtIndex_77 = List.GetItemAtIndex(list=watch_4@L2, index=code_block_91.out1)
byPointsRadius_3 = Cylinder.ByPointsRadius(startPoint=startPoint_11, endPoint=endPoint_8, radius=getItemAtIndex_77)

code_block_92 = CodeBlock(ALL=transpose_2, PCD=byCoordinates_3)
# ---------- code_block_92.designscript (10 lines) ----------
[21,31,35];

//sort
[35,31,21];


//----------
ALL;

PCD;
# ----------------------------------------
getItemAtIndex_78 = List.GetItemAtIndex(list=code_block_92.ALL@L3, index=code_block_92.out1@L2)

# group: calibration type 1. augment angle 20 times angle calibration == rotate position C == translate
code_block_93 = CodeBlock(LINE_INFO=getItemAtIndex_78, PCD=code_block_92.PCD) { LINE_INFO; PCD; }
code_block_94 = CodeBlock(line=code_block_93.LINE_INFO) { line; }
code_block_95 = CodeBlock(PCD=code_block_93.PCD) { PCD; }
code_block_96 = CodeBlock(PCD=code_block_93.PCD) { PCD; }
code_block_97 = CodeBlock(PCD=code_block_96) { PCD; }
code_block_98 = CodeBlock { 1; }
pruneDuplicates = Point.PruneDuplicates(points=code_block_97@L2, tolerance=code_block_98)
code_block_99 = CodeBlock(pruned_PCD=pruneDuplicates) { pruned_PCD; }
code_block_100 = CodeBlock(PCD=code_block_97) { PCD; }

# group: calibration type 1. augment angle 20 times angle calibration == rotate position C == translate > IN == need calibration
code_block_101 = CodeBlock { 2; }
getItemAtIndex_79 = List.GetItemAtIndex(list=code_block_94@L2, index=code_block_101)
code_block_102 = CodeBlock { 90; }
le_13 = getItemAtIndex_79 <= code_block_102
filterByBoolMask_2 = List.FilterByBoolMask(list=code_block_94@@L3, mask=le_13@L2)
code_block_103 = CodeBlock { true; }
allIndicesOf_6 = List.AllIndicesOf(list=le_13, item=code_block_103)

# group (continued): calibration type 1. augment angle 20 times angle calibration == rotate position C == translate
code_block_104 = CodeBlock(DO_NOT_NEED_CALIBRATION=filterByBoolMask_2.out, NEED_CALIBRATION=filterByBoolMask_2.in, INDEX=allIndicesOf_6)
# ---------- code_block_104.designscript (8 lines) ----------
DO_NOT_NEED_CALIBRATION;



//----------------------
NEED_CALIBRATION;

INDEX;
# ----------------------------------------
code_block_105 = CodeBlock(DO_NOT_NEED_CALIBRATION=code_block_104.DO_NOT_NEED_CALIBRATION, NEED_CALIBRATION=code_block_104.NEED_CALIBRATION, INDEX=code_block_104.INDEX)  # same code as code_block_104
list_firstitem_line = List.FirstItem(list=filterByBoolMask_2.in@L2)
firstItem = List.FirstItem(list=code_block_105.NEED_CALIBRATION@L2)

# group: calibration type 1. augment angle 20 times angle calibration == rotate position C == translate > PCD scanned data direction //V
code_block_106 = CodeBlock { 1; }  # frozen
list_getitematindex_r = List.GetItemAtIndex(list=filterByBoolMask_2.in@L2, index=code_block_106)
closestPointTo_8 = Geometry.ClosestPointTo(geometry=list_firstitem_line@L1, other=code_block_95@L2, lacing=Longest)
origin = Point.Origin()
byTwoPoints_2 = Vector.ByTwoPoints(start=closestPointTo_8, end=code_block_95)
average_5 = Custom[Vector.Average](vectors=byTwoPoints_2@L2)  # package Clockwork for Dynamo 2.x; Determines the average vector of a list of vectors
length_2 = Vector.Length(vector=byTwoPoints_2)
average_6 = Math.Average(numbers=length_2@L2)
translate_3 = Geometry.Translate(geometry=origin, direction=average_5, distance=average_6)
vector_bytwopoints_v_pcd = Vector.ByTwoPoints(start=origin, end=translate_3)

# group: calibration type 1. augment angle 20 times angle calibration == rotate position C == translate > SURFACE
startPoint_12 = Curve.StartPoint(curve=list_firstitem_line)
direction_3 = Line.Direction(line=list_firstitem_line)
byOriginNormal_3 = Plane.ByOriginNormal(origin=startPoint_12, normal=direction_3)
code_block_107 = CodeBlock { 1; }
getItemAtIndex_80 = List.GetItemAtIndex(list=filterByBoolMask_2.in@L2, index=code_block_107)
byPlaneRadius = Circle.ByPlaneRadius(plane=byOriginNormal_3, radius=getItemAtIndex_80)
extrude = Curve.Extrude(curve=byPlaneRadius, distance=direction_3)

# group: calibration type 1. augment angle 20 times angle calibration == rotate position C == translate > if: ROTATION plane origin == around which point on the curve plane normal == PCDdirection X CURVEdirection
dot = Vector.Dot(lacing=Longest)  # frozen; unwired: vector, vec
origin_2 = Point.Origin()
parameterAtPoint_11 = Curve.ParameterAtPoint(curve=list_firstitem_line@@L1, point=closestPointTo_8@L2, lacing=Longest)
code_block_108 = CodeBlock(param=parameterAtPoint_11)
# ---------- code_block_108.designscript (6 lines) ----------
augment = 1000;
// augment X
param * augment;
//ie.   0= =0
//		0.5 = =500
//		1 == 1000
# ----------------------------------------
closestPointTo_9 = Geometry.ClosestPointTo(geometry=extrude@L1, other=code_block_95@L2, lacing=Longest)
byTwoPoints_3 = Vector.ByTwoPoints(start=closestPointTo_9, end=code_block_95)
angleWithVector_2 = Vector.AngleWithVector(vector=byTwoPoints_3@@L2, otherVector=vector_bytwopoints_v_pcd@L1, lacing=Longest)
cos = Math.Cos(angle=angleWithVector_2)
code_block_109 = CodeBlock(cos=cos) { a = 50; cos * a; }
byCoordinates_6 = Point.ByCoordinates(x=code_block_108.out1, y=code_block_109.out1)
byBestFitThroughPoints_6 = Line.ByBestFitThroughPoints(bestFitPoints=byCoordinates_6@L2)
length_3 = Curve.Length(curve=byBestFitThroughPoints_6)
byCoordinates_7 = Point.ByCoordinates(x=length_3)
byStartPointEndPoint_8 = Line.ByStartPointEndPoint(startPoint=origin_2, endPoint=byCoordinates_7)
intersect_2 = Geometry.Intersect(geometry=byStartPointEndPoint_8@L1, other=byBestFitThroughPoints_6@L1, lacing=Longest)
isEmpty = List.IsEmpty(list=intersect_2@L2, lacing=Longest)
deconstruct = WombatDynamo.Point.Deconstruct(point=intersect_2)
code_block_110 = CodeBlock(augment=code_block_108.augment)
# ---------- code_block_110.designscript (2 lines) ----------
//---------------
augment;
# ----------------------------------------
code_block_111 = CodeBlock(min=deconstruct.X, augment=code_block_110)
# ---------- code_block_111.designscript (3 lines) ----------
// rotation point param
//on line
min/augment;
# ----------------------------------------

# group: calibration type 1. augment angle 20 times angle calibration == rotate position C == translate > extend
length_4 = Curve.Length(curve=firstItem)
code_block_112 = CodeBlock(length=length_4) { length/10; }
extendStart_14 = Curve.ExtendStart(curve=firstItem, distance=code_block_112)
extendEnd_14 = Curve.ExtendEnd(curve=extendStart_14, distance=code_block_112)

# group (continued): calibration type 1. augment angle 20 times angle calibration == rotate position C == translate
average_7 = Custom[Vector.Average](vectors=byTwoPoints_3@L2)
average_8 = Math.Average(numbers=code_block_109.out1@L2)
code_block_113 = CodeBlock(average=average_8, a=code_block_109.a) { average/a; }

# group: calibration type 1. augment angle 20 times angle calibration == rotate position C == translate > translate
code_block_114 = CodeBlock(PCD_direction=average_7) { PCD_direction; }
code_block_115 = CodeBlock(AUGMENT=code_block_109.a, x=code_block_113) { a = AUGMENT/2; b = -x*2; c = x*2; b..c..#a; }
translate_4 = Geometry.Translate(geometry=extendEnd_14@L1, direction=code_block_114@L1, distance=code_block_115.out3@@L2, lacing=Longest)

# group: calibration type 1. augment angle 20 times angle calibration == rotate position C == translate > translation: select maximum accuracy
code_block_116 = CodeBlock { 10; }  # frozen
count_5 = List.Count(list=translate_4@L2)
ofRepeatedItem = List.OfRepeatedItem(item=pruneDuplicates@@L2, amount=count_5@L1)
distanceTo_11 = Geometry.DistanceTo(geometry=ofRepeatedItem@@L2, other=translate_4@L1)
average_9 = Math.Average(numbers=distanceTo_11@@L2)
code_block_117 = CodeBlock(radius=average_9) { radius * 0.1; }
eq_4 = Equals(x=distanceTo_11@@L2, y=average_9@L1, tolerance=code_block_117, lacing=Longest)
countTrue_10 = List.CountTrue(list=eq_4@@L2)
count_6 = List.Count(list=eq_4@@L2)
mod = CodeBlock(counttrue=countTrue_10, count=count_6) { counttrue/count*100; }
maximumItem_5 = List.MaximumItem(list=mod@L2)
indexOf_7 = List.IndexOf(list=mod@L2, element=maximumItem_5@L1)
getItemAtIndex_81 = List.GetItemAtIndex(list=translate_4@L2, index=indexOf_7@L1)
getItemAtIndex_82 = List.GetItemAtIndex(list=average_9@L2, index=indexOf_7@L1)
getItemAtIndex_83 = List.GetItemAtIndex(list=mod@L2, index=indexOf_7@L1)
list_create_21 = List.Create(item0=getItemAtIndex_81, item1=getItemAtIndex_82, item2=getItemAtIndex_83)
transpose_21 = List.Transpose(lists=list_create_21)

# group: calibration type 1. augment angle 20 times angle calibration == rotate position C == translate > rotation
code_block_118 = CodeBlock(line=list_firstitem_line) { line; }
pointAtParameter_3 = Curve.PointAtParameter(curve=code_block_118, param=code_block_111)
direction_4 = Line.Direction(line=code_block_118)
cross = Vector.Cross(vector=direction_4, cross=vector_bytwopoints_v_pcd)
byOriginNormal_4 = Plane.ByOriginNormal(origin=pointAtParameter_3@L1, normal=cross@L1, lacing=Longest)
direction_5 = Line.Direction(line=byBestFitThroughPoints_6)
XAxis = Vector.XAxis()
angleWithVector_3 = Vector.AngleWithVector(vector=direction_5, otherVector=XAxis)

# group: calibration type 1. augment angle 20 times angle calibration == rotate position C == translate > rotation angle to align with PCD noticeable: gradient has been amplified
YAxis = Vector.YAxis()
angleWithVector_4 = Vector.AngleWithVector(vector=direction_5, otherVector=YAxis)
code_block_119 = CodeBlock { 90; }
ge_10 = angleWithVector_4 >= code_block_119
code_block_120 = CodeBlock(angle=angleWithVector_3) { angle; -angle; }
if_5 = RefactoredIf(test=ge_10@L1, true=code_block_120.angle@L1, false=code_block_120.out1@L1, lacing=Longest)

# group (continued): calibration type 1. augment angle 20 times angle calibration == rotate position C == translate > rotation
code_block_121 = CodeBlock(AUGMENT=code_block_109.a, x=if_5) { a = AUGMENT/2; b = -x*2; c = x*2; b..c..#a; }
code_block_122 = CodeBlock(PLANE=byOriginNormal_4, ANGLE=code_block_121.out3) { PLANE; ANGLE; }
rotate = Geometry.Rotate(geometry=extendEnd_14@L1, basePlane=code_block_122.PLANE@L1, degrees=code_block_122.ANGLE@@L2, lacing=Longest)

# group: calibration type 1. augment angle 20 times angle calibration == rotate position C == translate > rotation: select maximum accuracy
code_block_123 = CodeBlock { 10; }  # frozen
count_7 = List.Count(list=rotate@L2)
ofRepeatedItem_2 = List.OfRepeatedItem(item=pruneDuplicates@@L2, amount=count_7@L1)
distanceTo_12 = Geometry.DistanceTo(geometry=ofRepeatedItem_2@@L2, other=rotate@L1)
average_10 = Math.Average(numbers=distanceTo_12@@L2)
code_block_124 = CodeBlock(radius=average_10) { radius * 0.1; }
eq_5 = Equals(x=distanceTo_12@@L2, y=average_10@L1, tolerance=code_block_124, lacing=Longest)
countTrue_11 = List.CountTrue(list=eq_5@@L2)
count_8 = List.Count(list=eq_5@@L2)
mod_2 = CodeBlock(counttrue=countTrue_11, count=count_8) { counttrue/count*100; }
maximumItem_6 = List.MaximumItem(list=mod_2@L2)
indexOf_8 = List.IndexOf(list=mod_2@L2, element=maximumItem_6@L1)
getItemAtIndex_84 = List.GetItemAtIndex(list=rotate@L2, index=indexOf_8@L1)
getItemAtIndex_85 = List.GetItemAtIndex(list=average_10@L2, index=indexOf_8@L1)
getItemAtIndex_86 = List.GetItemAtIndex(list=mod_2@L2, index=indexOf_8@L1)
list_create_22 = List.Create(item0=getItemAtIndex_84, item1=getItemAtIndex_85, item2=getItemAtIndex_86)
transpose_22 = List.Transpose(lists=list_create_22)

# group: STDV
code_block_125 = CodeBlock { all_line_info; }  # frozen; unwired: all_line_info
code_block_126 = CodeBlock()
# ---------- code_block_126.designscript (2 lines) ----------
2;
//radius
# ----------------------------------------
getItemAtIndex_87 = List.GetItemAtIndex(list=code_block_125@L2, index=code_block_126)
firstItem_2 = List.FirstItem(list=code_block_125@L2)
code_block_127 = CodeBlock { PCD; }  # unwired: PCD
distanceTo_13 = Geometry.DistanceTo(geometry=firstItem_2@L1, other=code_block_127@L2, lacing=Longest)
average_11 = Math.Average(numbers=distanceTo_13@L2)
sub = distanceTo_13@L2 - average_11@L1  # lacing=Longest
code_block_128 = CodeBlock { 2; }
pow = Math.Pow(number=sub, power=code_block_128)
sum = Math.Sum(values=pow@L2)
count_9 = List.Count(list=distanceTo_13@L2)
div = sum / count_9
math_sqrt_stdv = Math.Sqrt(number=div)
code_block_129 = CodeBlock(ACCURACY=getItemAtIndex_87, STDV=math_sqrt_stdv)
# ---------- code_block_129.designscript (5 lines) ----------
//ACCURACY_IN_DECIMAL
A = ACCURACY/100;

//connection point candidates within radius
STDV * 0.5;
# ----------------------------------------
code_block_130 = CodeBlock()
# ---------- code_block_130.designscript (2 lines) ----------
1;
//radius
# ----------------------------------------
getItemAtIndex_88 = List.GetItemAtIndex(list=code_block_125@L2, index=code_block_130)
code_block_131 = CodeBlock(radius=getItemAtIndex_88) { radius * 2; }
extendEnd_15 = Curve.ExtendEnd(curve=firstItem_2, distance=code_block_131)
extendStart_15 = Curve.ExtendStart(curve=extendEnd_15, distance=code_block_131)
startPoint_13 = Curve.StartPoint(curve=extendStart_15)
endPoint_9 = Curve.EndPoint(curve=extendStart_15)
byPointsRadius_4 = Cylinder.ByPointsRadius(startPoint=startPoint_13, endPoint=endPoint_9, radius=math_sqrt_stdv)
count_10 = List.Count(list=byPointsRadius_4)
ofRepeatedItem_3 = List.OfRepeatedItem(item=byPointsRadius_4@L2, amount=count_10)
code_block_132 = CodeBlock(x=count_10) { 0..x-1; }
removeItemAtIndex_6 = List.RemoveItemAtIndex(list=ofRepeatedItem_3@L2, indices=code_block_132@L1)
intersectAll = Geometry.IntersectAll(geometry=byPointsRadius_4@L1, others=removeItemAtIndex_6@L2, lacing=Longest)
flatten_22 = List.Flatten(list=intersectAll)
pruneDuplicates_2 = Custom[Geometry.PruneDuplicates](GeometryList=flatten_22)  # package Data-Shapes; Removes all duplicate geometries from list.

code_block_133 = CodeBlock(LINE_INFVO=transpose_2) { LINE_INFVO; }
code_block_134 = CodeBlock(PIPE=byCoordinates_3) { PIPE; }  # frozen

# group: absolute horizontal/vertical: angle adjustment <=5， output may ↓ but still >=85%
code_block_135 = CodeBlock(line_info=code_block_133, PCD=code_block_134) { line_info; PCD; }
ZAxis_2 = Vector.ZAxis()
firstItem_3 = List.FirstItem(list=code_block_135.line_info@L2)
direction_6 = Line.Direction(line=firstItem_3)
angleWithVector_5 = Vector.AngleWithVector(vector=ZAxis_2, otherVector=direction_6)
code_block_136 = CodeBlock()
# ---------- code_block_136.designscript (5 lines) ----------
90;
10;
//--------
0;
10;
# ----------------------------------------
eq_6 = Equals(x=angleWithVector_5, y=code_block_136.out0, tolerance=code_block_136.out1)
eq_7 = Equals(x=angleWithVector_5, y=code_block_136.out2, tolerance=code_block_136.out3)
or_ = eq_6 || eq_7
startPoint_14 = Curve.StartPoint(curve=firstItem_3)
ZAxis_3 = Vector.ZAxis()
byOriginNormal_5 = Plane.ByOriginNormal(origin=startPoint_14, normal=ZAxis_3)
deconstruct_2 = WombatDynamo.Vector.Deconstruct(vector=direction_6)
byCoordinates_8 = Vector.ByCoordinates(x=deconstruct_2.X, y=deconstruct_2.Y)
byOriginNormal_6 = Plane.ByOriginNormal(origin=startPoint_14, normal=byCoordinates_8)
byOriginNormal_7 = Plane.ByOriginNormal(origin=startPoint_14, normal=direction_6)
if_6 = RefactoredIf(test=eq_6@L1, true=byOriginNormal_6@L1, false=byOriginNormal_7@L1, lacing=Longest)
if_7 = RefactoredIf(test=eq_7@L1, true=byOriginNormal_5@L1, false=if_6@L1, lacing=Longest)
code_block_137 = CodeBlock(reference_pipes=code_block_135.line_info) { reference_pipes; }
code_block_138 = CodeBlock(reference_pipes=code_block_137) { reference_pipes; }

# group: absolute horizontal/vertical: angle adjustment <=5， output may ↓ but still >=85% > to abs horizontal/vertical baseline accuracy: 85%
code_block_139 = CodeBlock(reference_pipe_PCD=code_block_135.PCD) { reference_pipe_PCD; }
code_block_140 = CodeBlock(PCD=code_block_139) { PCD; }
code_block_141 = CodeBlock(PCD=code_block_140) { PCD; }
code_block_142 = CodeBlock(projection_plane=if_7) { projection_plane; }
distanceTo_14 = Geometry.DistanceTo(geometry=code_block_139@L2, other=if_7@L1, lacing=Longest)
length_5 = Curve.Length(curve=firstItem_3)
code_block_143 = CodeBlock(length=length_5) { length/20; }
code_block_144 = CodeBlock(d=distanceTo_14, a=code_block_143) { DSCore.Math.Floor(d/a); }
groupByKey_2 = List.GroupByKey(list=code_block_139@@L2, keys=code_block_144@L2)
firstItem_4 = List.FirstItem(list=groupByKey_2.groups@@L2)
normal = Plane.Normal(plane=if_7)
byOriginNormal_8 = Plane.ByOriginNormal(origin=firstItem_4@@L2, normal=normal@L1, lacing=Longest)
closestPointTo_10 = Geometry.ClosestPointTo(geometry=byOriginNormal_8@L1, other=groupByKey_2.groups@@L2, lacing=Longest)
byBestFitThroughPoints_7 = Circle.ByBestFitThroughPoints(points=closestPointTo_10@@L2)
clean = Orchid.Common.List.Clean(list=byBestFitThroughPoints_7@L2)
centerPoint_3 = Circle.CenterPoint(circle=clean)
closestPointTo_11 = Geometry.ClosestPointTo(geometry=code_block_142@L1, other=centerPoint_3@@L2, lacing=Longest)
normal_2 = Plane.Normal(plane=code_block_142)
code_block_145 = CodeBlock(length=length_5) { length * 1.5; }
byStartPointDirectionLength = Line.ByStartPointDirectionLength(startPoint=closestPointTo_11@@L2, direction=normal_2@L1, length=code_block_145@L1, lacing=Longest)
closestPointTo_12 = Geometry.ClosestPointTo(geometry=code_block_142@L1, other=code_block_140@@L2, lacing=Longest)
code_block_146 = CodeBlock { 1; }
pruneDuplicates_3 = Point.PruneDuplicates(points=closestPointTo_12@@L2, tolerance=code_block_146)
count_11 = List.Count(list=clean@L2)
ofRepeatedItem_4 = List.OfRepeatedItem(item=pruneDuplicates_3@@L2, amount=count_11@L1)
distanceTo_15 = Geometry.DistanceTo(geometry=byStartPointDirectionLength@@L1, other=ofRepeatedItem_4@L2, lacing=Longest)
average_12 = Math.Average(numbers=distanceTo_15@@L2)
sub_2 = distanceTo_15@@L2 - average_12@L1  # lacing=Longest
code_block_147 = CodeBlock { 2; }
pow_2 = Math.Pow(number=sub_2, power=code_block_147)
sum_2 = Math.Sum(values=pow_2@@L2)
count_12 = List.Count(list=distanceTo_15@L2)
div_2 = sum_2 / count_12
math_sqrt_stdv_2 = Math.Sqrt(number=div_2)
minimumItem_5 = List.MinimumItem(list=math_sqrt_stdv_2@L2)
indexOf_9 = List.IndexOf(list=math_sqrt_stdv_2@L2, element=minimumItem_5@L1)
getItemAtIndex_89 = List.GetItemAtIndex(list=byStartPointDirectionLength@L2, index=indexOf_9@L1)
closestPointTo_13 = Geometry.ClosestPointTo(geometry=getItemAtIndex_89@L1, other=code_block_141@L2, lacing=Longest)
parameterAtPoint_12 = Curve.ParameterAtPoint(curve=getItemAtIndex_89@L1, point=closestPointTo_13@L2, lacing=Longest)
minimumItem_6 = List.MinimumItem(list=parameterAtPoint_12@L2)
maximumItem_7 = List.MaximumItem(list=parameterAtPoint_12@L2)
trimByParameter_3 = Curve.TrimByParameter(curve=getItemAtIndex_89, startParameter=minimumItem_6, endParameter=maximumItem_7)
getItemAtIndex_90 = List.GetItemAtIndex(list=average_12@L2, index=indexOf_9@L1)
distanceTo_16 = Geometry.DistanceTo(geometry=getItemAtIndex_89@L1, other=code_block_141@L2, lacing=Longest)
average_13 = Math.Average(numbers=distanceTo_16@L2)
code_block_148 = CodeBlock(radius=average_13) { radius * 0.05; }
eq_8 = Equals(x=distanceTo_16@L2, y=average_13@L1, tolerance=code_block_148, lacing=Longest)
countTrue_12 = List.CountTrue(list=eq_8@L2)
count_13 = List.Count(list=eq_8@L2)
code_block_149 = CodeBlock(counttrue=countTrue_12, count=count_13) { counttrue/count * 100; }

# group (continued): absolute horizontal/vertical: angle adjustment <=5， output may ↓ but still >=85%
code_block_150 = CodeBlock(PCD=code_block_141) { PCD; }
list_create_23 = List.Create(item0=trimByParameter_3, item1=getItemAtIndex_90, item2=code_block_149)
transpose_23 = List.Transpose(lists=list_create_23)

# group: calibration type 1. augment angle 20 times angle calibration == rotate position C == translate
removeItemAtIndex_7 = List.RemoveItemAtIndex(list=code_block_92.ALL@L3, indices=code_block_92.out1@L2)
code_block_151 = CodeBlock(x=removeItemAtIndex_7) { x[0]; [35,31,21]; }

# group: manual
code_block_152 = CodeBlock(x=getItemAtIndex_78) { x[0][0]; x[0][1]; }
list_create_24 = List.Create(item0=code_block_152.out0, item1=code_block_152.out1)
join_6 = List.Join()  # unwired: list0, list1
code_block_153 = CodeBlock(PCD=code_block_92.PCD, replace_index=code_block_92.out1, all_lines=code_block_92.ALL) { PCD; replace_index; all_lines; }

code_block_154 = CodeBlock(x=transpose_22) { x[2]; }
list_create_25 = List.Create(item0=code_block_154)
join_7 = List.Join(list0=list_create_24, list1=list_create_25)
code_block_155 = CodeBlock { 2; 33; }
replaceItemAtIndex = List.ReplaceItemAtIndex(list=join_7@L2, index=code_block_155.out0@L1, item=code_block_155.out1@L1, lacing=Longest)
list_create_26 = List.Create(item0=replaceItemAtIndex)

# group: calibration type 1. augment angle 20 times angle calibration == rotate position C == translate
code_block_156 = CodeBlock(x=list_create_26) { x; }
code_block_157 = CodeBlock {  }

# group: calibration type 1. augment angle 20 times angle calibration == rotate position C == translate > trim
firstItem_5 = List.FirstItem(list=code_block_156@L2)
closestPointTo_14 = Geometry.ClosestPointTo(geometry=firstItem_5@L1, other=code_block_99@L2, lacing=Longest)
parameterAtPoint_13 = Curve.ParameterAtPoint(curve=firstItem_5@L1, point=closestPointTo_14@L2, lacing=Longest)
minimumItem_7 = List.MinimumItem(list=parameterAtPoint_13@L2)
maximumItem_8 = List.MaximumItem(list=parameterAtPoint_13@L2)
trimByParameter_4 = Curve.TrimByParameter(curve=firstItem_5, startParameter=minimumItem_7, endParameter=maximumItem_8)

# group: calibration type 1. augment angle 20 times angle calibration == rotate position C == translate > improved output
code_block_158 = CodeBlock(DO_NOT_NEED_CALIBRATION=code_block_105.DO_NOT_NEED_CALIBRATION, NEED_CALIBRATION=code_block_105.NEED_CALIBRATION, INDEX=code_block_105.INDEX)  # same code as code_block_104
code_block_159 = CodeBlock { 2; }
getItemAtIndex_91 = List.GetItemAtIndex(list=code_block_158.NEED_CALIBRATION@L2, index=code_block_159)
if_8 = RefactoredIf(test=isEmpty@L1, true=transpose_21@@L2, false=transpose_22@L2, lacing=Longest)
getItemAtIndex_92 = List.GetItemAtIndex(list=if_8@L2, index=code_block_159)
ge_11 = getItemAtIndex_91 >= getItemAtIndex_92
if_9 = RefactoredIf(test=ge_11@L1, true=code_block_158.NEED_CALIBRATION@@L2, false=if_8@L2, lacing=Longest)
code_block_160 = CodeBlock(x=code_block_156) { x[0]; }
code_block_161 = CodeBlock { 0; }
toLine = Geometry.Curves.ToLine(curve=trimByParameter_4)
replaceItemAtIndex_2 = List.ReplaceItemAtIndex(list=code_block_160@L2, index=code_block_161, item=toLine@L1)
join_8 = List.Join(list0=code_block_151.out0, list1=replaceItemAtIndex_2)
clean_2 = Orchid.Common.List.Clean(list=join_8)
count_14 = List.Count(list=join_8@L3)
code_block_162 = CodeBlock(x=count_14) { 0..x-1; }
flatten_23 = List.Flatten(list=code_block_162)
code_block_163 = CodeBlock(calibration_index=code_block_151.out1) { calibration_index; }
flatten_24 = List.Flatten(list=code_block_163)
removeItemAtIndex_8 = List.RemoveItemAtIndex(list=flatten_23, indices=flatten_24)
join_9 = List.Join(list0=removeItemAtIndex_8, list1=flatten_24)
sortByKey = List.SortByKey(list=clean_2@L3, keys=join_9@L2)

# group (continued): calibration type 1. augment angle 20 times angle calibration == rotate position C == translate
code_block_164 = CodeBlock(line_info=sortByKey.sortedList, PCD=code_block_100) { line_info; PCD; }

# group: calibration with accuracy < xx%
code_block_165 = CodeBlock(lines_info=code_block_164.line_info) { lines_info; }  # frozen
code_block_166 = CodeBlock { 2; }
getItemAtIndex_93 = List.GetItemAtIndex(list=code_block_165@L2, index=code_block_166)
code_block_167 = CodeBlock { 85; }
ge_12 = getItemAtIndex_93 >= code_block_167
filterByBoolMask_3 = List.FilterByBoolMask(list=code_block_165@L3, mask=ge_12@L2)
code_block_168 = CodeBlock(good=filterByBoolMask_3.in, need_calibration=filterByBoolMask_3.out) { good; need_calibration; }
code_block_169 = CodeBlock(x=code_block_168.good) { x[0]; }  # frozen
ZAxis_4 = Vector.ZAxis()
firstItem_6 = List.FirstItem(list=code_block_168.need_calibration@L2)
toLine_2 = Geometry.Curves.ToLine(curve=firstItem_6)
direction_7 = Line.Direction(line=toLine_2)
startPoint_15 = Curve.StartPoint(curve=toLine_2)
ZAxis_5 = Vector.ZAxis()
firstItem_7 = List.FirstItem(list=code_block_165@L2)
toLine_3 = Geometry.Curves.ToLine(curve=firstItem_7)
direction_8 = Line.Direction(line=toLine_3)
angleWithVector_6 = Vector.AngleWithVector(vector=ZAxis_5, otherVector=direction_8)
ZAxis_6 = Vector.ZAxis()
byOriginNormal_9 = Plane.ByOriginNormal(origin=startPoint_15, normal=direction_7)
length_6 = Curve.Length(curve=firstItem_6)
code_block_170 = CodeBlock(PCD=code_block_164.PCD) { PCD; }
filterByBoolMask_4 = List.FilterByBoolMask(list=code_block_170@L3, mask=ge_12@L2)
code_block_171 = CodeBlock(CALIVBRATION_PCD=filterByBoolMask_4.out) { CALIVBRATION_PCD; }
code_block_172 = CodeBlock(TENTATIVE_LENGTH=length_6, CALIVBRATION_PCD=code_block_171) { TENTATIVE_LENGTH; CALIVBRATION_PCD; }
code_block_173 = CodeBlock(lines_info=code_block_165) { lines_info; }
code_block_174 = CodeBlock(lines_info=code_block_165, PCD=code_block_170) { lines_info; PCD; }
code_block_175 = CodeBlock { false; }
allIndicesOf_7 = List.AllIndicesOf(list=ge_12, item=code_block_175)

# group: calibration with accuracy < xx% > space horizontal direction
code_block_176 = CodeBlock { 90; 5; }
eq_9 = Equals(x=angleWithVector_6, y=code_block_176.out0, tolerance=code_block_176.out1)
filterByBoolMask_5 = List.FilterByBoolMask(list=code_block_165@L3, mask=eq_9@L2)
lastItem = List.LastItem(list=filterByBoolMask_5.in@L2)
sortByKey_2 = List.SortByKey(list=filterByBoolMask_5.in@L3, keys=lastItem@L2)
firstItem_8 = List.FirstItem(list=sortByKey_2.sortedList@L2)
lastItem_2 = List.LastItem(list=firstItem_8@L2)
toLine_4 = Geometry.Curves.ToLine(curve=lastItem_2)
direction_9 = Line.Direction(line=toLine_4)
deconstruct_3 = WombatDynamo.Vector.Deconstruct(vector=direction_9)
byCoordinates_9 = Vector.ByCoordinates(x=deconstruct_3.X, y=deconstruct_3.Y)

# group (continued): calibration with accuracy < xx%
cross_2 = Vector.Cross(vector=byCoordinates_9, cross=ZAxis_6)

# group: calibration with accuracy < xx% > parallel
angleWithVector_7 = Vector.AngleWithVector(vector=byCoordinates_9, otherVector=direction_7, lacing=Longest)
code_block_177 = CodeBlock { 0; 20; }
eq_10 = Equals(x=angleWithVector_7, y=code_block_177.out0, tolerance=code_block_177.out1)
byOriginNormal_10 = Plane.ByOriginNormal(origin=startPoint_15, normal=byCoordinates_9)
code_block_178 = CodeBlock { 180; 20; }
eq_11 = Equals(x=angleWithVector_7, y=code_block_178.out0, tolerance=code_block_178.out1)
endPoint_10 = Curve.EndPoint(curve=toLine_2)
reverse = Vector.Reverse(vector=byCoordinates_9)
byOriginNormal_11 = Plane.ByOriginNormal(origin=endPoint_10, normal=reverse)
if_10 = RefactoredIf(test=eq_11@@L1, true=byOriginNormal_11@L1, false=byOriginNormal_9@L1, lacing=Longest)
if_11 = RefactoredIf(test=eq_10@@L1, true=byOriginNormal_10@L1, false=if_10@L1, lacing=Longest)

# group: calibration with accuracy < xx% > horizontally vertical
angleWithVector_8 = Vector.AngleWithVector(vector=cross_2, otherVector=direction_7, lacing=Longest)
code_block_179 = CodeBlock { 0; 20; }
eq_12 = Equals(x=angleWithVector_8, y=code_block_179.out0, tolerance=code_block_179.out1)
byOriginNormal_12 = Plane.ByOriginNormal(origin=startPoint_15, normal=cross_2)
code_block_180 = CodeBlock { 180; 20; }
eq_13 = Equals(x=angleWithVector_8, y=code_block_180.out0, tolerance=code_block_180.out1)
endPoint_11 = Curve.EndPoint(curve=toLine_2)
reverse_2 = Vector.Reverse(vector=cross_2)
byOriginNormal_13 = Plane.ByOriginNormal(origin=endPoint_11, normal=reverse_2)
if_12 = RefactoredIf(test=eq_13@@L1, true=byOriginNormal_13@L1, false=if_11@L1, lacing=Longest)
if_13 = RefactoredIf(test=eq_12@@L1, true=byOriginNormal_12@L1, false=if_12@L1, lacing=Longest)

# group: calibration with accuracy < xx% > parallel to Z
angleWithVector_9 = Vector.AngleWithVector(vector=ZAxis_4, otherVector=direction_7, lacing=Longest)
code_block_181 = CodeBlock { 0; 20; }
eq_14 = Equals(x=angleWithVector_9, y=code_block_181.out0, tolerance=code_block_181.out1)
byOriginNormal_14 = Plane.ByOriginNormal(origin=startPoint_15, normal=ZAxis_4)
code_block_182 = CodeBlock { 180; 20; }
eq_15 = Equals(x=angleWithVector_9, y=code_block_182.out0, tolerance=code_block_182.out1)
endPoint_12 = Curve.EndPoint(curve=toLine_2)
reverse_3 = Vector.Reverse(vector=ZAxis_4)
byOriginNormal_15 = Plane.ByOriginNormal(origin=endPoint_12, normal=reverse_3)
if_14 = RefactoredIf(test=eq_15@@L1, true=byOriginNormal_15@L1, false=if_13@L1, lacing=Longest)
if_15 = RefactoredIf(test=eq_14@@L1, true=byOriginNormal_14@L1, false=if_14@L1, lacing=Longest)

# group: calibration with accuracy < xx% > circle from 3 points (align with space ddirection from best pipe)
code_block_183 = CodeBlock { 5; }
closestPointTo_15 = Geometry.ClosestPointTo(geometry=if_15@L1, other=code_block_172.CALIVBRATION_PCD@L2, lacing=Longest)
byBestFitThroughPoints_8 = Circle.ByBestFitThroughPoints(points=closestPointTo_15)
radius_7 = Circle.Radius(circle=byBestFitThroughPoints_8)
code_block_184 = CodeBlock(radius=radius_7) { radius * 0.5; }
pruneDuplicates_4 = Point.PruneDuplicates(points=closestPointTo_15@L2, tolerance=code_block_184)
code_block_185 = CodeBlock { 3; false; }
combinations = List.Combinations(list=pruneDuplicates_4@@L2, length=code_block_185.out0, replace=code_block_185.out1)
shuffle = List.Shuffle(list=combinations@@L3)
code_block_186 = CodeBlock { 2; }
takeEveryNthItem = List.TakeEveryNthItem(list=shuffle@@L3, n=code_block_186)
flatten_25 = List.Flatten(list=takeEveryNthItem@@L4)
code_block_187 = CodeBlock { 3; }
chop_4 = List.Chop(list=flatten_25@@L2, lengths=code_block_187)
code_block_188 = CodeBlock { 0; 1; 2; }
getItemAtIndex_94 = List.GetItemAtIndex(list=chop_4@@L2, index=code_block_188.out0)
getItemAtIndex_95 = List.GetItemAtIndex(list=chop_4@@L2, index=code_block_188.out1)
getItemAtIndex_96 = List.GetItemAtIndex(list=chop_4@@L2, index=code_block_188.out2)
byThreePoints = Circle.ByThreePoints(p1=getItemAtIndex_94, p2=getItemAtIndex_95, p3=getItemAtIndex_96)
radius_8 = Circle.Radius(circle=byThreePoints)
code_block_189 = CodeBlock { 1; }
getItemAtIndex_97 = List.GetItemAtIndex(list=code_block_173@L2, index=code_block_189)
maximumItem_9 = List.MaximumItem(list=getItemAtIndex_97)
minimumItem_8 = List.MinimumItem(list=getItemAtIndex_97)
code_block_190 = CodeBlock(max=maximumItem_9, min=minimumItem_8) { max; min/4; }
code_block_191 = CodeBlock(min=code_block_190.out1, max=code_block_190.max) { DSCore.Math.Average(min + max); (max - min)/2; }
eq_16 = Equals(x=radius_8, y=code_block_191.out0, tolerance=code_block_191.out1)
centerPoint_4 = Circle.CenterPoint(circle=byBestFitThroughPoints_8)
normal_3 = Plane.Normal(plane=if_15)
byOriginNormal_16 = Plane.ByOriginNormal(origin=centerPoint_4, normal=normal_3)
code_block_192 = CodeBlock(radius=radius_7) { radius * 4; }
byPlaneRadius_2 = Circle.ByPlaneRadius(plane=byOriginNormal_16, radius=code_block_192)
byPatch = Surface.ByPatch(closedCurve=byPlaneRadius_2)
centerPoint_5 = Circle.CenterPoint(circle=byThreePoints)
doesIntersect = Geometry.DoesIntersect(geometry=byPatch@L1, other=centerPoint_5@L2, lacing=Longest)
and_11 = eq_16 && doesIntersect
filterByBoolMask_6 = List.FilterByBoolMask(list=byThreePoints@@L2, mask=and_11@L2)
radius_9 = Circle.Radius(circle=filterByBoolMask_6.in)
sortByKey_3 = List.SortByKey(list=filterByBoolMask_6.in@@L2, keys=radius_9@L2)
count_15 = List.Count(list=sortByKey_3.sortedList@L2)
code_block_193 = CodeBlock(count=count_15) { a = DSCore.Math.Floor(count/10); -a*2; }
dropItems = List.DropItems(list=sortByKey_3.sortedList@@L2, amount=code_block_193.a@L1)
dropItems_2 = List.DropItems(list=dropItems@@L2, amount=code_block_193.out1@L1)
code_block_194 = CodeBlock(PCD=code_block_172.CALIVBRATION_PCD, PROJECTED_PCD=closestPointTo_15, tentative_length=code_block_172.TENTATIVE_LENGTH) { PCD; PROJECTED_PCD; tentative_length; }
code_block_195 = CodeBlock(PCD=code_block_194.PCD, PROJECTED_PCD=code_block_194.PROJECTED_PCD, tentative_length=code_block_194.tentative_length) { PCD; PROJECTED_PCD; tentative_length; }
shuffle_2 = List.Shuffle(list=code_block_195.PROJECTED_PCD@L2)
code_block_196 = CodeBlock { 200; }
takeItems = List.TakeItems(list=shuffle_2@L2, amount=code_block_196)
centerPoint_6 = Circle.CenterPoint(circle=dropItems_2)
count_16 = List.Count(list=centerPoint_6@L2)
ofRepeatedItem_5 = List.OfRepeatedItem(item=takeItems@@L2, amount=count_16@L1)
distanceTo_17 = Geometry.DistanceTo(geometry=ofRepeatedItem_5@@L2, other=centerPoint_6@L1, lacing=Longest)
radius_10 = Circle.Radius(circle=dropItems_2)
code_block_197 = CodeBlock(radius=radius_10) { radius* 0.4; }
eq_17 = Equals(x=distanceTo_17@@L2, y=radius_10@L1, tolerance=code_block_197@L1, lacing=Longest)
allTrue = List.AllTrue(list=eq_17@@L2)
filterByBoolMask_7 = List.FilterByBoolMask(list=dropItems_2@@L2, mask=allTrue@L2)
radius_11 = Circle.Radius(circle=filterByBoolMask_7.in)
sortByKey_4 = List.SortByKey(list=filterByBoolMask_7.in@@L2, keys=radius_11@L2)
code_block_198 = CodeBlock { 2; 1; }
takeEveryNthItem_2 = List.TakeEveryNthItem(list=sortByKey_4.sortedList@L2, n=code_block_198.out0, offset=code_block_198.out1)
code_block_199 = CodeBlock { 1; }
pruneDuplicates_5 = Point.PruneDuplicates(points=code_block_195.PROJECTED_PCD@L2, tolerance=code_block_199)
count_17 = List.Count(list=takeEveryNthItem_2@L2)
ofRepeatedItem_6 = List.OfRepeatedItem(item=pruneDuplicates_5@@L2, amount=count_17@L1)
centerPoint_7 = Circle.CenterPoint(circle=takeEveryNthItem_2)
distanceTo_18 = Geometry.DistanceTo(geometry=ofRepeatedItem_6@@L2, other=centerPoint_7@L1, lacing=Longest)
radius_12 = Circle.Radius(circle=takeEveryNthItem_2)
code_block_200 = CodeBlock(radius=radius_12) { radius* 0.1; }
eq_18 = Equals(x=distanceTo_18@@L2, y=radius_12@L1, tolerance=code_block_200@L1, lacing=Longest)
countTrue_13 = List.CountTrue(list=eq_18@@L2)
maximumItem_10 = List.MaximumItem(list=countTrue_13@L2)
eq_19 = countTrue_13@L2 == maximumItem_10@L1  # lacing=Longest
code_block_201 = CodeBlock { true; }
allIndicesOf_8 = List.AllIndicesOf(list=eq_19@L2, item=code_block_201)
firstItem_9 = List.FirstItem(list=allIndicesOf_8@L2)
getItemAtIndex_98 = List.GetItemAtIndex(list=takeEveryNthItem_2@L2, index=firstItem_9@L1)
code_block_202 = CodeBlock(PCD=code_block_195.PCD, tentative_length=code_block_195.tentative_length) { PCD; tentative_length * 4; }

# group (continued): calibration with accuracy < xx%
centerPoint_8 = Circle.CenterPoint(circle=getItemAtIndex_98)
normal_4 = Curve.Normal(curve=getItemAtIndex_98)
byStartPointDirectionLength_2 = Line.ByStartPointDirectionLength(startPoint=centerPoint_8, direction=normal_4, length=code_block_202.out1)
extendStart_16 = Curve.ExtendStart(curve=byStartPointDirectionLength_2, distance=code_block_202.out1)
closestPointTo_16 = Geometry.ClosestPointTo(geometry=extendStart_16@L1, other=code_block_202.PCD@L2, lacing=Longest)
parameterAtPoint_14 = Curve.ParameterAtPoint(curve=extendStart_16@L1, point=closestPointTo_16@L2, lacing=Longest)
minimumItem_9 = List.MinimumItem(list=parameterAtPoint_14@L2)
maximumItem_11 = List.MaximumItem(list=parameterAtPoint_14@L2)
trimByParameter_5 = Curve.TrimByParameter(curve=extendStart_16, startParameter=minimumItem_9, endParameter=maximumItem_11)
radius_13 = Circle.Radius(circle=getItemAtIndex_98)
distanceTo_19 = Geometry.DistanceTo(geometry=code_block_202.PCD@L2, other=extendStart_16@L1, lacing=Longest)
code_block_203 = CodeBlock(radius=radius_13) { radius; radius * 0.1; }
eq_20 = Equals(x=distanceTo_19@L2, y=code_block_203.radius@L1, tolerance=code_block_203.out1@L1, lacing=Longest)
countTrue_14 = List.CountTrue(list=eq_20@L2)
count_18 = List.Count(list=eq_20@L2)
code_block_204 = CodeBlock(counttrue=countTrue_14, count=count_18) { counttrue / count * 100; }
list_create_27 = List.Create(item0=trimByParameter_5, item1=radius_13, item2=code_block_204)
transpose_24 = List.Transpose(lists=list_create_27)
join_10 = List.Join(list0=code_block_169, list1=transpose_24)

# group: calibration with accuracy < xx% > output sorting
clean_3 = Orchid.Common.List.Clean()  # unwired: list
code_block_205 = CodeBlock(lines_info=code_block_174.lines_info, PCD=code_block_174.PCD) { lines_info; PCD; }
code_block_206 = CodeBlock(calibration_index=allIndicesOf_7) { calibration_index; }
removeItemAtIndex_9 = List.RemoveItemAtIndex(list=code_block_205.lines_info@L3, indices=code_block_206@L2)
code_block_207 = CodeBlock(x=removeItemAtIndex_9) { x[0]; }
join_11 = List.Join(list0=code_block_207, list1=transpose_24)
count_19 = List.Count(list=code_block_205.lines_info@L3)
code_block_208 = CodeBlock(x=count_19) { 0..x-1; }
flatten_26 = List.Flatten(list=code_block_208)
removeItemAtIndex_10 = List.RemoveItemAtIndex(list=flatten_26, indices=code_block_206)
join_12 = List.Join(list0=removeItemAtIndex_10, list1=code_block_206)
sortByKey_5 = List.SortByKey(list=join_11@L3, keys=join_12@L2)

# group: calibration with accuracy < xx% > output abs horizontal/vertical
code_block_209 = CodeBlock { 2; }
getItemAtIndex_99 = List.GetItemAtIndex(list=code_block_205.lines_info@L2, index=code_block_209)
getItemAtIndex_100 = List.GetItemAtIndex(list=sortByKey_5.sortedList@L2, index=code_block_209)
ge_13 = getItemAtIndex_99 >= getItemAtIndex_100
if_16 = RefactoredIf(test=ge_13@@L1, true=code_block_205.lines_info@L2, false=sortByKey_5.sortedList@L2, lacing=Longest)

# group (continued): calibration with accuracy < xx%
code_block_210 = CodeBlock(line_info=if_16, PCD=code_block_205.PCD) { line_info; PCD; }

code_block_211 = CodeBlock { 1000; }  # frozen
scale = Geometry.Scale(xamount=code_block_211, yamount=code_block_211, zamount=code_block_211)  # unwired: geometry
code_block_212 = CodeBlock { 1000; }  # frozen
scale_2 = Geometry.Scale(xamount=code_block_212, yamount=code_block_212, zamount=code_block_212)  # unwired: geometry
code_block_213 = CodeBlock(x=scale_2) { x[0][0]; }
byOrigin = CoordinateSystem.ByOrigin(origin=code_block_213)
byOrigin_2 = CoordinateSystem.ByOrigin()
transform = Geometry.Transform(geometry=scale@L3, fromCoordinateSystem=byOrigin, contextCoordinateSystem=byOrigin_2)
code_block_214 = CodeBlock(x=scale) { x[0][0]; }  # frozen
file_path_7 = Filename("..\REVISION-Newst\TEST 1\TEST_Elbow__000000.csv")
importCSV_7 = Data.ImportCSV(filePath=file_path_7)
file_path_8 = Filename("..\REVISION-Newst\TEST 1\TEST_Elbow__000001.csv")
importCSV_8 = Data.ImportCSV(filePath=file_path_8)
file_path_9 = Filename("..\REVISION-Newst\TEST 1\TEST_Elbow__000002.csv")
importCSV_9 = Data.ImportCSV(filePath=file_path_9)
file_path_10 = Filename("..\REVISION-Newst\TEST 1\TEST_Elbow__000003.csv")
importCSV_10 = Data.ImportCSV(filePath=file_path_10)
file_path_11 = Filename("..\REVISION-Newst\TEST 1\TEST_Elbow__000004.csv")
importCSV_11 = Data.ImportCSV(filePath=file_path_11)
file_path_12 = Filename("..\REVISION-Newst\TEST 1\TEST_Elbow__000005.csv")
importCSV_12 = Data.ImportCSV(filePath=file_path_12)
file_path_13 = Filename("..\REVISION-Newst\TEST 1\TEST_Elbow__000006.csv")
importCSV_13 = Data.ImportCSV(filePath=file_path_13)
file_path_14 = Filename("..\REVISION-Newst\TEST 1\TEST_Elbow__000007.csv")
importCSV_14 = Data.ImportCSV(filePath=file_path_14)
file_path_15 = Filename("..\REVISION-Newst\TEST 1\TEST_Elbow__000008.csv")
importCSV_15 = Data.ImportCSV(filePath=file_path_15)
file_path_16 = Filename("..\REVISION-Newst\TEST 1\TEST_Elbow__000009.csv")
importCSV_16 = Data.ImportCSV(filePath=file_path_16)
file_path_17 = Filename("..\REVISION-Newst\TEST 1\TEST_Elbow__000010.csv")
importCSV_17 = Data.ImportCSV(filePath=file_path_17)
file_path_18 = Filename("..\REVISION-Newst\TEST 1\TEST_Elbow__000011.csv")
importCSV_18 = Data.ImportCSV(filePath=file_path_18)
file_path_19 = Filename("..\REVISION-Newst\TEST 1\TEST_Elbow__000012.csv")
importCSV_19 = Data.ImportCSV(filePath=file_path_19)
file_path_20 = Filename("..\REVISION-Newst\TEST 1\TEST_Elbow__000013.csv")
importCSV_20 = Data.ImportCSV(filePath=file_path_20)
file_path_21 = Filename("..\REVISION-Newst\TEST 1\TEST_Elbow__000014.csv")
importCSV_21 = Data.ImportCSV(filePath=file_path_21)
file_path_22 = Filename("..\REVISION-Newst\TEST 1\TEST_Elbow__000015.csv")
importCSV_22 = Data.ImportCSV(filePath=file_path_22)
file_path_23 = Filename("..\REVISION-Newst\TEST 1\TEST_Elbow__000016.csv")
importCSV_23 = Data.ImportCSV(filePath=file_path_23)
file_path_24 = Filename("..\REVISION-Newst\TEST 1\TEST_Elbow__000017.csv")
importCSV_24 = Data.ImportCSV(filePath=file_path_24)
file_path_25 = Filename("..\REVISION-Newst\TEST 1\TEST_Elbow__000018.csv")
importCSV_25 = Data.ImportCSV(filePath=file_path_25)
file_path_26 = Filename("..\REVISION-Newst\TEST 1\TEST_Elbow__000019.csv")
importCSV_26 = Data.ImportCSV(filePath=file_path_26)
file_path_27 = Filename("..\REVISION-Newst\TEST 1\TEST_Elbow__000020.csv")
importCSV_27 = Data.ImportCSV(filePath=file_path_27)
file_path_28 = Filename("..\REVISION-Newst\TEST 1\TEST_Elbow__000021.csv")
importCSV_28 = Data.ImportCSV(filePath=file_path_28)
file_path_29 = Filename("..\REVISION-Newst\TEST 1\TEST_Elbow__000022.csv")
importCSV_29 = Data.ImportCSV(filePath=file_path_29)
file_path_30 = Filename("..\REVISION-Newst\TEST 1\TEST_Elbow__000023.csv")
importCSV_30 = Data.ImportCSV(filePath=file_path_30)
file_path_31 = Filename("..\REVISION-Newst\TEST 1\TEST_Elbow__000024.csv")
importCSV_31 = Data.ImportCSV(filePath=file_path_31)
file_path_32 = Filename("..\REVISION-Newst\TEST 1\TEST_Elbow__000025.csv")
importCSV_32 = Data.ImportCSV(filePath=file_path_32)
file_path_33 = Filename("..\REVISION-Newst\TEST 1\TEST_Elbow__000026.csv")
importCSV_33 = Data.ImportCSV(filePath=file_path_33)
file_path_34 = Filename("..\REVISION-Newst\TEST 1\TEST_Elbow__000027.csv")
importCSV_34 = Data.ImportCSV(filePath=file_path_34)
list_create_28 = List.Create(item0=importCSV_7, item1=importCSV_8, item2=importCSV_9, item3=importCSV_10, item4=importCSV_11, item5=importCSV_12, item6=importCSV_13, item7=importCSV_14, item8=importCSV_15, item9=importCSV_16, item10=importCSV_17, item11=importCSV_18, item12=importCSV_19, item13=importCSV_20, item14=importCSV_21, item15=importCSV_22, item16=importCSV_23, item17=importCSV_24, item18=importCSV_25, item19=importCSV_26, item20=importCSV_27, item21=importCSV_28, item22=importCSV_29, item23=importCSV_30, item24=importCSV_31, item25=importCSV_32, item26=importCSV_33, item27=importCSV_34)
code_block_215 = CodeBlock { 0; 1; 2; }
getItemAtIndex_101 = List.GetItemAtIndex(list=list_create_28@L3, index=code_block_215.out0)
getItemAtIndex_102 = List.GetItemAtIndex(list=list_create_28@L3, index=code_block_215.out1)
getItemAtIndex_103 = List.GetItemAtIndex(list=list_create_28@L3, index=code_block_215.out2)
byCoordinates_10 = Point.ByCoordinates(x=getItemAtIndex_101, y=getItemAtIndex_102, z=getItemAtIndex_103)
color_palette_3 = ColorPalette({R: 127, G: 255, B: 212, A: 178})
byGeometryColor_3 = Modifiers.GeometryColor.ByGeometryColor(geometry=byCoordinates_10, color=color_palette_3)
byOrigin_3 = CoordinateSystem.ByOrigin(origin=code_block_213)
byOrigin_4 = CoordinateSystem.ByOrigin()
transform_2 = Geometry.Transform(geometry=scale_2@L3, fromCoordinateSystem=byOrigin_3, contextCoordinateSystem=byOrigin_4)
shuffle_3 = List.Shuffle(list=transform_2)
code_block_216 = CodeBlock { 3; }
takeEveryNthItem_3 = List.TakeEveryNthItem(list=shuffle_3@L2, n=code_block_216)
code_block_217 = CodeBlock(PCD=byCoordinates_10) { PCD; }
code_block_218 = CodeBlock(PCD=code_block_217) { PCD; }

# group: absolute horizontal/vertical: angle adjustment <=5， output may ↓ but still >=85% > output abs horizontal/vertical
code_block_219 = CodeBlock { 2; }
getItemAtIndex_104 = List.GetItemAtIndex(list=transpose_23@L2, index=code_block_219)
code_block_220 = CodeBlock { 85; }
ge_14 = getItemAtIndex_104 >= code_block_220
if_17 = RefactoredIf(test=ge_14@@L1, true=transpose_23@L2, false=code_block_138@L2, lacing=Longest)

code_block_221 = CodeBlock(LINE_INFVO=if_17) { LINE_INFVO; }
code_block_222 = CodeBlock(LINE_INFVO=code_block_133) { LINE_INFVO; }
code_block_223 = CodeBlock(PCD=code_block_217) { PCD; }

# group: define connectivity via inspection of PCD closest 2 pipes
code_block_224 = CodeBlock(all_line_info=code_block_222) { all_line_info; }
code_block_225 = CodeBlock(PCD=code_block_223) { PCD; }
code_block_226 = CodeBlock { 2; }

# group: define connectivity via inspection of PCD closest 2 pipes > EXTEND by radius* 2
firstItem_10 = List.FirstItem(list=code_block_224@L2)  # frozen
code_block_227 = CodeBlock()  # same code as code_block_130
getItemAtIndex_105 = List.GetItemAtIndex(list=code_block_224@L2, index=code_block_227)
code_block_228 = CodeBlock(radius=getItemAtIndex_105) { radius * 2; }
extendEnd_16 = Curve.ExtendEnd(curve=firstItem_10, distance=code_block_228)
extendStart_17 = Curve.ExtendStart(curve=extendEnd_16, distance=code_block_228)

# group (continued): define connectivity via inspection of PCD closest 2 pipes
count_20 = List.Count(list=extendStart_17@L2)
ofRepeatedItem_7 = List.OfRepeatedItem(item=code_block_224, amount=count_20)
ofRepeatedItem_8 = List.OfRepeatedItem(item=extendStart_17, amount=count_20)
count_21 = List.Count(list=ofRepeatedItem_8@L2)

# group: define connectivity via inspection of PCD closest 2 pipes > random xx points
shuffle_4 = List.Shuffle(list=code_block_225@L2)
code_block_229 = CodeBlock { 2000; }
takeItems_2 = List.TakeItems(list=shuffle_4@L2, amount=code_block_229)

# group (continued): define connectivity via inspection of PCD closest 2 pipes
ofRepeatedItem_9 = List.OfRepeatedItem(item=takeItems_2@@L2, amount=count_21@L1)  # frozen
distanceTo_20 = Geometry.DistanceTo(geometry=ofRepeatedItem_9@@L2, other=ofRepeatedItem_8@L1, lacing=Longest)
average_14 = Math.Average(numbers=distanceTo_20@@L2)
sort_2 = List.Sort(list=average_14@@L2)
takeItems_3 = List.TakeItems(list=sort_2@@L2, amount=code_block_226)
indexOf_10 = List.IndexOf(list=average_14@@L2, element=takeItems_3@L2)
getItemAtIndex_106 = List.GetItemAtIndex(list=ofRepeatedItem_7@@L3, index=indexOf_10@L2)

# group: define connectivity via inspection of PCD closest 2 pipes > PCD connect 2 pipes closest 2 lines'' extension (extend by radius* 2) mutual distance < min|radius
code_block_230 = CodeBlock(line_info=getItemAtIndex_106) { line_info[0]; }
firstItem_11 = List.FirstItem(list=code_block_230@@L2)
toLine_5 = Geometry.Curves.ToLine(curve=firstItem_11)
code_block_231 = CodeBlock()  # same code as code_block_130
getItemAtIndex_107 = List.GetItemAtIndex(list=code_block_230@@L2, index=code_block_231)
code_block_232 = CodeBlock(radius=getItemAtIndex_107) { radius * 2; }
extendEnd_17 = Curve.ExtendEnd(curve=toLine_5, distance=code_block_232)
extendStart_18 = Curve.ExtendStart(curve=extendEnd_17, distance=code_block_232)
transpose_25 = List.Transpose(lists=extendStart_18)
code_block_233 = CodeBlock(x=transpose_25) { x[0]; x[1]; }
distanceTo_21 = Geometry.DistanceTo(geometry=code_block_233.out0, other=code_block_233.out1)
code_block_234 = CodeBlock(radius=getItemAtIndex_107) { radius; }
minimumItem_10 = List.MinimumItem(list=code_block_234@L2)

# group (continued): define connectivity via inspection of PCD closest 2 pipes
ge_15 = distanceTo_21 >= minimumItem_10
filterByBoolMask_8 = List.FilterByBoolMask(list=code_block_230@L4, mask=ge_15@L2)
filterByBoolMask_9 = List.FilterByBoolMask(list=code_block_225@L3, mask=ge_15@L2)
grouped = CodeBlock(for_elbow=filterByBoolMask_8.out, PCD=filterByBoolMask_9.out) { for_elbow[0]; PCD[0]; }

# group: define connectivity via inspection of PCD closest 2 pipes > check repeatancy: 2. further extension distance < radius
code_block_235 = CodeBlock(line_info=filterByBoolMask_8.in, PCD=filterByBoolMask_9.in) { line_info[0]; PCD[0]; }
code_block_236 = CodeBlock()  # same code as code_block_130
getItemAtIndex_108 = List.GetItemAtIndex(list=code_block_235.out0@@L2, index=code_block_236)
firstItem_12 = List.FirstItem(list=code_block_235.out0@@L2)
toLine_6 = Geometry.Curves.ToLine(curve=firstItem_12)
code_block_237 = CodeBlock(radius=getItemAtIndex_108) { radius * 100; }
extendEnd_18 = Curve.ExtendEnd(curve=toLine_6, distance=code_block_237)
extendStart_19 = Curve.ExtendStart(curve=extendEnd_18, distance=code_block_237)
transpose_26 = List.Transpose(lists=extendStart_19)
code_block_238 = CodeBlock(x=transpose_26) { x[0]; x[1]; }
distanceTo_22 = Geometry.DistanceTo(geometry=code_block_238.out0, other=code_block_238.out1)
minimumItem_11 = List.MinimumItem(list=getItemAtIndex_108@L2)
le_14 = distanceTo_22 <= minimumItem_11

# group: define connectivity via inspection of PCD closest 2 pipes > check repeatancy: 1. two lines not repeated
code_block_239 = CodeBlock { 1; }
getItemAtIndex_109 = List.GetItemAtIndex(list=grouped.out0@@L2, index=code_block_239)
sort_3 = List.Sort(list=getItemAtIndex_109@@L2)
sort_4 = List.Sort(list=getItemAtIndex_108@@L2)
count_22 = List.Count(list=sort_4@L3)
ofRepeatedItem_10 = List.OfRepeatedItem(item=sort_3, amount=count_22)
exp = Math.Exp(number=ofRepeatedItem_10)
sum_3 = Math.Sum(values=exp@@L2)
sqrt = Math.Sqrt(number=sum_3)
exp_2 = Math.Exp(number=sort_4)
sum_4 = Math.Sum(values=exp_2@@L2)
sqrt_2 = Math.Sqrt(number=sum_4)
indexOf_11 = List.IndexOf(list=sqrt@L2, element=sqrt_2@@L1)
code_block_240 = CodeBlock { -1; }
eq_21 = indexOf_11 == code_block_240

# group (continued): define connectivity via inspection of PCD closest 2 pipes
and_12 = eq_21 && le_14
filterByBoolMask_10 = List.FilterByBoolMask(list=code_block_235.out0@@L4, mask=and_12@L2)
list_filterbyboolmask_pcd = List.FilterByBoolMask(list=code_block_235.out1@@L3, mask=and_12@L2)
no_dummy = CodeBlock(line_info=filterByBoolMask_10.in, PCD=list_filterbyboolmask_pcd.in) { line_info[0]; PCD[0]; }  # frozen
DUMMY = CodeBlock(line_info=filterByBoolMask_10.out, PCD=list_filterbyboolmask_pcd.out) { line_info[0]; PCD; }

# group: define connectivity via inspection of PCD closest 2 pipes > together with previous output
join_13 = List.Join(list0=grouped.out0, list1=no_dummy.out0)
join_14 = List.Join(list0=grouped.out1, list1=no_dummy.out1)
direct_connct_no_dummy = CodeBlock(line_info=join_13, PCD=join_14) { line_info; PCD; }

# group: ELBOW/tee direct connection --- no dummy pipes
grouped_2 = CodeBlock(for_elbow=direct_connct_no_dummy.line_info, PCD=direct_connct_no_dummy.PCD) { for_elbow; PCD; }
code_block_241 = CodeBlock(line_info=grouped_2.for_elbow) { line_info; }
code_block_242 = CodeBlock(line=code_block_241) { line; }
firstItem_13 = List.FirstItem(list=code_block_241@@L2)
code_block_243 = CodeBlock()  # same code as code_block_130
getItemAtIndex_110 = List.GetItemAtIndex(list=code_block_241@@L2, index=code_block_243)
firstItem_14 = List.FirstItem(list=grouped_2.for_elbow@@L2)
toLine_7 = Geometry.Curves.ToLine(curve=firstItem_14)
code_block_244 = CodeBlock()  # same code as code_block_130
getItemAtIndex_111 = List.GetItemAtIndex(list=grouped_2.for_elbow@@L2, index=code_block_244)
code_block_245 = CodeBlock { 3; }
code_block_246 = CodeBlock(radius=getItemAtIndex_111, a=code_block_245) { radius * a; }
extendEnd_19 = Curve.ExtendEnd(curve=toLine_7, distance=code_block_246)
extendStart_20 = Curve.ExtendStart(curve=extendEnd_19, distance=code_block_246)
flatten_27 = List.Flatten(list=getItemAtIndex_110)
uniqueItems_3 = List.UniqueItems(list=flatten_27)
indexOf_12 = List.IndexOf(list=uniqueItems_3@L2, element=getItemAtIndex_110@@L1, lacing=Longest)

# group: ELBOW/tee direct connection --- no dummy pipes > PCD parameter on the line
code_block_247 = CodeBlock(line_extended=extendStart_20, R=getItemAtIndex_111) { line_extended; R; }
count_23 = List.Count(list=extendStart_20@L2)
ofRepeatedItem_11 = List.OfRepeatedItem(item=grouped_2.PCD@L2, amount=count_23@@L1)
startPoint_16 = Curve.StartPoint(curve=extendStart_20)
direction_10 = Line.Direction(line=extendStart_20)
transpose_27 = List.Transpose(lists=direction_10)
code_block_248 = CodeBlock(X=transpose_27) { X[0]; X[1]; }
cross_3 = Vector.Cross(vector=code_block_248.out0, cross=code_block_248.out1)
byOriginXAxisYAxis = Plane.ByOriginXAxisYAxis(origin=startPoint_16@@L2, xAxis=direction_10@L2, yAxis=cross_3@L1, lacing=Longest)
code_block_249 = CodeBlock { [1,0]; }
reorder = List.Reorder(list=direction_10@@L2, indices=code_block_249)
project = Point.Project(point=ofRepeatedItem_11@@L2, baseGeometry=byOriginXAxisYAxis@L1, projectionDirection=reorder@L1, lacing=Longest)
flatten_28 = List.Flatten(list=project@@L3)
closestPointTo_17 = Geometry.ClosestPointTo(geometry=code_block_247.line_extended@@L1, other=flatten_28@L2, lacing=Longest)
code_block_250 = CodeBlock(line_extended=code_block_247.line_extended, R=code_block_247.R) { line_extended; R * 1.5; }
parameterAtPoint_15 = Curve.ParameterAtPoint(curve=code_block_247.line_extended@@L1, point=closestPointTo_17@L2, lacing=Longest)
average_15 = Math.Average(numbers=parameterAtPoint_15@@L2)
parameterAtPoint_16 = Curve.ParameterAtPoint(curve=firstItem_13@L1, point=closestPointTo_17@@L2, lacing=Longest)
average_16 = Math.Average(numbers=parameterAtPoint_16@@L2)
ge_16 = average_15 >= average_16
minimumItem_12 = List.MinimumItem(list=parameterAtPoint_15@@L2)
maximumItem_12 = List.MaximumItem(list=parameterAtPoint_15@@L2)
if_18 = RefactoredIf(test=ge_16@@L1, true=minimumItem_12@L1, false=maximumItem_12@L1, lacing=Longest)
pointAtParameter_4 = Curve.PointAtParameter(curve=code_block_250.line_extended, param=if_18)
direction_11 = Line.Direction(line=code_block_250.line_extended)
reverse_4 = Vector.Reverse(vector=direction_11)
if_19 = RefactoredIf(test=ge_16@@L1, true=direction_11@L1, false=reverse_4@L1, lacing=Longest)
translate_5 = Geometry.Translate(geometry=pointAtParameter_4, direction=if_19, distance=code_block_250.out1)

# group: ELBOW/tee direct connection --- no dummy pipes > elbow/tee
toLine_8 = Geometry.Curves.ToLine(curve=firstItem_13)
startPoint_17 = Curve.StartPoint(curve=toLine_8)
direction_12 = Line.Direction(line=toLine_8)
translate_6 = Geometry.Translate(geometry=startPoint_17, direction=direction_12, distance=getItemAtIndex_110)
parameterAtPoint_17 = Curve.ParameterAtPoint(curve=toLine_8, point=translate_6)
endPoint_13 = Curve.EndPoint(curve=toLine_8)
reverse_5 = Vector.Reverse(vector=direction_12)
translate_7 = Geometry.Translate(geometry=endPoint_13, direction=reverse_5, distance=getItemAtIndex_110)
parameterAtPoint_18 = Curve.ParameterAtPoint(curve=toLine_8, point=translate_7)
trimByParameter_6 = Curve.TrimByParameter(curve=toLine_8, startParameter=parameterAtPoint_17, endParameter=parameterAtPoint_18)
parameterAtPoint_19 = Curve.ParameterAtPoint(curve=trimByParameter_6@L1, point=closestPointTo_17@@L2, lacing=Longest)
average_17 = Math.Average(numbers=parameterAtPoint_19@@L2)
code_block_251 = CodeBlock { 1; 0.002; 0; }
eq_22 = Equals(x=average_17, y=code_block_251.out0, tolerance=code_block_251.out1)
eq_23 = Equals(x=average_17, y=code_block_251.out2, tolerance=code_block_251.out1)
or_2 = eq_22 || eq_23
allTrue_2 = List.AllTrue(list=or_2@L2)

# group: ELBOW/tee direct connection --- no dummy pipes > elbow/tee
filterByBoolMask_11 = List.FilterByBoolMask(list=code_block_242@L4, mask=allTrue_2@L2)
filterByBoolMask_12 = List.FilterByBoolMask(list=indexOf_12@L3, mask=allTrue_2@L2)
filterByBoolMask_13 = List.FilterByBoolMask(list=translate_5@L3, mask=allTrue_2@L2)
code_block_252 = CodeBlock(extend_ratio=code_block_245) { extend_ratio; }

# group (continued): ELBOW/tee direct connection --- no dummy pipes
code_block_253 = CodeBlock(tee=filterByBoolMask_11.out, index=filterByBoolMask_12.out, param_on_lines=filterByBoolMask_13.out, extend_ratio=code_block_252)
# ---------- code_block_253.designscript (9 lines) ----------
//end + mid
tee;

index;

param_on_lines;

//-------------
extend_ratio;
# ----------------------------------------
code_block_254 = CodeBlock(elbow=filterByBoolMask_11.in, index=filterByBoolMask_12.in, param_on_lines=filterByBoolMask_13.in, extend_ratio=code_block_252)
# ---------- code_block_254.designscript (10 lines) ----------
// both are, end + end
elbow;

index;

param_on_lines;


//-------------
extend_ratio;
# ----------------------------------------

# group: direct connected - TEE
code_block_255 = CodeBlock(tee=code_block_253.tee, index=code_block_253.index, param_on_lines=code_block_253.param_on_lines, extend_ratio=code_block_253.extend_ratio)
# ---------- code_block_255.designscript (10 lines) ----------
//end + mid
tee;

index;

param_on_lines;


//-------------
extend_ratio;
# ----------------------------------------

# group: dummy short pipe/un-identified elbow
code_block_256 = CodeBlock(for_short_pipe=DUMMY.out0, PCD=DUMMY.PCD) { for_short_pipe; PCD; }
firstItem_15 = List.FirstItem(list=code_block_256.for_short_pipe@@L2)
toLine_9 = Geometry.Curves.ToLine(curve=firstItem_15)

# group: dummy short pipe/un-identified elbow > angle between types of dummy pipes
direction_13 = Line.Direction(line=toLine_9)
transpose_28 = List.Transpose(lists=direction_13)
code_block_257 = CodeBlock(x=transpose_28) { x[0]; x[1]; }
angleWithVector_10 = Vector.AngleWithVector(vector=code_block_257.out0, otherVector=code_block_257.out1)
code_block_258 = CodeBlock()
# ---------- code_block_258.designscript (9 lines) ----------
//----------
//parallel
0;
10;

//----------
//perpendicular
90;
10;
# ----------------------------------------
eq_24 = Equals(x=angleWithVector_10, y=code_block_258.out0, tolerance=code_block_258.out1)
eq_25 = Equals(x=angleWithVector_10, y=code_block_258.out2, tolerance=code_block_258.out3)

# group (continued): dummy short pipe/un-identified elbow
filterByBoolMask_14 = List.FilterByBoolMask(list=code_block_256.for_short_pipe@L4, mask=eq_25@L2)
filterByBoolMask_15 = List.FilterByBoolMask(list=code_block_256.PCD@L3, mask=eq_25@L2)
code_block_259 = CodeBlock(for_short_pipe=filterByBoolMask_14.in, PCD=filterByBoolMask_15.in) { for_short_pipe; PCD; }

# group: dummy short pipe/un-identified elbow > end+end ? end+mid
firstItem_16 = List.FirstItem(list=code_block_259.for_short_pipe@@L2)
closestPointTo_18 = Geometry.ClosestPointTo(geometry=firstItem_16@L1, other=code_block_259.PCD@L2, lacing=Longest)
parameterAtPoint_20 = Curve.ParameterAtPoint(curve=firstItem_16@@L1, point=closestPointTo_18@L2, lacing=Longest)
average_18 = Math.Average(numbers=parameterAtPoint_20@@L2)
sum_5 = Math.Sum(values=average_18@@L2)
code_block_260 = CodeBlock { 0; 2; 0.02; }
eq_26 = Equals(x=sum_5, y=code_block_260.out0, tolerance=code_block_260.out2)
eq_27 = Equals(x=sum_5, y=code_block_260.out1, tolerance=code_block_260.out2)
or_3 = eq_26 || eq_27

# group (continued): dummy short pipe/un-identified elbow
filterByBoolMask_16 = List.FilterByBoolMask(list=code_block_259.for_short_pipe@@L4, mask=or_3@L1)
filterByBoolMask_17 = List.FilterByBoolMask(list=code_block_259.PCD@@L3, mask=or_3@L1)
code_block_261 = CodeBlock(end_n_end=filterByBoolMask_16.in, PCD=filterByBoolMask_17.in)
# ---------- code_block_261.designscript (4 lines) ----------
end_n_end[0];
//dummy short pipe  == tee

PCD;
# ----------------------------------------
code_block_262 = CodeBlock(end_n_mid=filterByBoolMask_16.out, PCD=filterByBoolMask_17.out)
# ---------- code_block_262.designscript (4 lines) ----------
end_n_mid[0];
//dummy short pipe  == tee

PCD;
# ----------------------------------------

# group: directly connected -- ELBOW param grouping by line index
code_block_263 = CodeBlock(elbow=code_block_254.elbow, index=code_block_254.index, param_on_lines=code_block_254.param_on_lines, extend_ratio=code_block_254.extend_ratio)  # same code as code_block_254
flatten_29 = List.Flatten(list=code_block_263.index)
code_block_264 = CodeBlock(ratio=code_block_263.extend_ratio) { ratio * 5; }
code_block_265 = CodeBlock { 0.5; }

# group: directly connected -- ELBOW param grouping by line index > grouping lines
flatten_30 = List.Flatten(list=code_block_263.elbow)
count_24 = List.Count(list=code_block_263.elbow@L2)
chop_5 = List.Chop(list=flatten_30, lengths=count_24)
groupByKey_3 = List.GroupByKey(list=chop_5@@L3, keys=flatten_29@L2)

# group (continued): directly connected -- ELBOW param grouping by line index
firstItem_17 = List.FirstItem(list=groupByKey_3.groups@L3)

# group: directly connected -- ELBOW param grouping by line index > intersection ==> connectivity
code_block_266 = CodeBlock(TWO_LINE_GROUP=code_block_263.elbow) { TWO_LINE_GROUP[0]; }
firstItem_18 = List.FirstItem(list=code_block_266@@L2)
code_block_267 = CodeBlock()  # same code as code_block_130
getItemAtIndex_112 = List.GetItemAtIndex(list=code_block_266@L2, index=code_block_267)
code_block_268 = CodeBlock(radius=getItemAtIndex_112) { radius * 10; }
extendEnd_20 = Curve.ExtendEnd(curve=firstItem_18, distance=code_block_268)
extendStart_21 = Curve.ExtendStart(curve=extendEnd_20, distance=code_block_268)
startPoint_18 = Curve.StartPoint(curve=extendStart_21)
endPoint_14 = Curve.EndPoint(curve=extendStart_21)
code_block_269 = CodeBlock { 8; }
code_block_270 = CodeBlock(x=code_block_269) { 112; x-1; }
pow_3 = Math.Pow(number=code_block_270.out0, power=code_block_270.out1)
code_block_271 = CodeBlock()
# ---------- code_block_271.designscript (3 lines) ----------
2;

//accuracy
# ----------------------------------------
getItemAtIndex_113 = List.GetItemAtIndex(list=code_block_266@L2, index=code_block_271)
pow_4 = Math.Pow(number=getItemAtIndex_113, power=code_block_269)
code_block_272 = CodeBlock(radius=getItemAtIndex_112, C=pow_3, a=pow_4) { radius * C / a; }
byPointsRadius_5 = Cylinder.ByPointsRadius(startPoint=startPoint_18, endPoint=endPoint_14, radius=code_block_272)
transpose_29 = List.Transpose(lists=byPointsRadius_5)
code_block_273 = CodeBlock(x=transpose_29) { x[0]; x[1]; }
intersect_3 = Geometry.Intersect(geometry=code_block_273.out0, other=code_block_273.out1)

# group (continued): directly connected -- ELBOW param grouping by line index
code_block_274 = CodeBlock(intersection=intersect_3) { intersection; }
byGeometry = BoundingBox.ByGeometry(geom=code_block_274)
minPoint = BoundingBox.MinPoint(boundingBox=byGeometry)
maxPoint = BoundingBox.MaxPoint(boundingBox=byGeometry)
byStartPointEndPoint_9 = Line.ByStartPointEndPoint(startPoint=minPoint, endPoint=maxPoint)
pointAtParameter_5 = Curve.PointAtParameter(curve=byStartPointEndPoint_9, param=code_block_265)
code_block_275 = CodeBlock(elbow_point=pointAtParameter_5) { elbow_point; }
code_block_276 = CodeBlock(elbow_point=code_block_275) { elbow_point; }
length_7 = Curve.Length(curve=byStartPointEndPoint_9)
code_block_277 = CodeBlock(length=length_7) { length/2; }

# group: directly connected -- ELBOW param grouping by line index > grouping connectivity point (from which 2 lines)
count_25 = List.Count(list=code_block_266@L3)
ofRepeatedItem_12 = List.OfRepeatedItem(item=code_block_276@@L1, amount=count_25@L1)
flatten_31 = List.Flatten(list=ofRepeatedItem_12)
groupByKey_4 = List.GroupByKey(list=flatten_31, keys=flatten_29)

# group: directly connected -- ELBOW param grouping by line index > grouping corresponding param
flatten_32 = List.Flatten(list=code_block_263.param_on_lines)
groupByKey_5 = List.GroupByKey(list=flatten_32, keys=flatten_29)

# group: directly connected -- ELBOW param grouping by line index > trim to end (candidate with max length)
code_block_278 = CodeBlock { 0; }
firstItem_19 = List.FirstItem(list=firstItem_17@L2)
code_block_279 = CodeBlock { 1; }
getItemAtIndex_114 = List.GetItemAtIndex(list=firstItem_17@L2, index=code_block_279)
code_block_280 = CodeBlock(radius=getItemAtIndex_114, a=code_block_264) { radius * a; }
extendEnd_21 = Curve.ExtendEnd(curve=firstItem_19, distance=code_block_280)
extendStart_22 = Curve.ExtendStart(curve=extendEnd_21, distance=code_block_280)
closestPointTo_19 = Geometry.ClosestPointTo(geometry=extendStart_22@L1, other=groupByKey_4.groups@@L2, lacing=Longest)
parameterAtPoint_21 = Curve.ParameterAtPoint(curve=extendStart_22@L1, point=closestPointTo_19@@L2, lacing=Longest)
startPoint_19 = Curve.StartPoint(curve=firstItem_19)
parameterAtPoint_22 = Curve.ParameterAtPoint(curve=extendStart_22, point=startPoint_19)
endPoint_15 = Curve.EndPoint(curve=firstItem_19)
parameterAtPoint_23 = Curve.ParameterAtPoint(curve=extendStart_22, point=endPoint_15)
addItemToEnd = List.AddItemToEnd(item=parameterAtPoint_22@@L1, list=parameterAtPoint_23@L1, lacing=Longest)
parameterAtPoint_24 = Curve.ParameterAtPoint(curve=extendStart_22@L1, point=groupByKey_5.groups@@L2, lacing=Longest)
addItemToEnd_2 = List.AddItemToEnd(item=addItemToEnd@@L2, list=parameterAtPoint_24@L2, lacing=Longest)
flatten_33 = List.Flatten(list=addItemToEnd_2@@L3)
addItemToEnd_3 = List.AddItemToEnd(item=parameterAtPoint_21@@L2, list=flatten_33@L2, lacing=Longest)
flatten_34 = List.Flatten(list=addItemToEnd_3@@L3)
minimumItem_13 = List.MinimumItem(list=flatten_34@L2)
maximumItem_13 = List.MaximumItem(list=flatten_34@L2)
trimByParameter_7 = Curve.TrimByParameter(curve=extendStart_22, startParameter=minimumItem_13, endParameter=maximumItem_13)
replaceItemAtIndex_3 = List.ReplaceItemAtIndex(list=firstItem_17@L2, index=code_block_278@L1, item=trimByParameter_7@L1, lacing=Longest)

code_block_281 = CodeBlock(LINES=replaceItemAtIndex_3)
# ---------- code_block_281.designscript (2 lines) ----------
LINES;
//trimed / extended
# ----------------------------------------
code_block_282 = CodeBlock(LINES=code_block_281)  # same code as code_block_281

# group: tee
code_block_283 = CodeBlock(LINES=code_block_282)  # same code as code_block_281
code_block_284 = CodeBlock(end_n_mid=code_block_262.out0, PCD=code_block_262.PCD)  # same code as code_block_262
firstItem_20 = List.FirstItem(list=code_block_284.out0@@L2)
transpose_30 = List.Transpose(lists=firstItem_20)
code_block_285 = CodeBlock(x=transpose_30) { x[0]; x[1]; }
distanceTo_23 = Geometry.DistanceTo(geometry=code_block_285.out0, other=code_block_285.out1)
extendEnd_22 = Curve.ExtendEnd(curve=firstItem_20@@L2, distance=distanceTo_23@L1, lacing=Longest)
extendStart_23 = Curve.ExtendStart(curve=extendEnd_22@@L2, distance=distanceTo_23@L1, lacing=Longest)
transpose_31 = List.Transpose(lists=extendStart_23)
code_block_286 = CodeBlock(x=transpose_31) { x[0]; x[1]; }
geometry_closestpointto_on_0 = Geometry.ClosestPointTo(geometry=code_block_286.out0, other=code_block_286.out1)
geometry_closestpointto_on_1 = Geometry.ClosestPointTo(geometry=code_block_286.out1, other=code_block_286.out0)
list_create_29 = List.Create(item0=geometry_closestpointto_on_0, item1=geometry_closestpointto_on_1)
transpose_32 = List.Transpose(lists=list_create_29)

# group: tee > ace adjusted lines
code_block_287 = CodeBlock { 1; }
getItemAtIndex_115 = List.GetItemAtIndex(list=code_block_283@L2, index=code_block_287)
code_block_288 = CodeBlock { 1; }
getItemAtIndex_116 = List.GetItemAtIndex(list=code_block_284.out0@L2, index=code_block_288)
indexOf_13 = List.IndexOf(list=getItemAtIndex_115@L2, element=getItemAtIndex_116@L2)
code_block_289 = CodeBlock { -1; }
eq_28 = indexOf_13 == code_block_289
filterByBoolMask_18 = List.FilterByBoolMask(list=indexOf_13@L2, mask=eq_28@L2)
indexOf_14 = List.IndexOf(list=getItemAtIndex_116@L2, element=getItemAtIndex_115@L2)
eq_29 = indexOf_14 == code_block_289
filterByBoolMask_19 = List.FilterByBoolMask(list=indexOf_14@L2, mask=eq_29@L2)
getItemAtIndex_117 = List.GetItemAtIndex(list=code_block_283@L3, index=filterByBoolMask_18.out@L2)
replaceItemAtIndex_4 = List.ReplaceItemAtIndex(list=code_block_284.out0@@L3, index=filterByBoolMask_19.out@L1, item=getItemAtIndex_117@L2)

# group (continued): tee
code_block_290 = CodeBlock(line_list=code_block_283, line_index=filterByBoolMask_18.out)
# ---------- code_block_290.designscript (4 lines) ----------
line_list;

line_index;
//replacement
# ----------------------------------------
code_block_291 = CodeBlock(line_list=code_block_290.line_list, line_index=code_block_290.line_index)  # same code as code_block_290
removeItemAtIndex_11 = List.RemoveItemAtIndex(list=code_block_291.line_list@@L3, indices=code_block_291.line_index@L2)
code_block_292 = CodeBlock(x=removeItemAtIndex_11) { x[0]; }
code_block_293 = CodeBlock(end_n_mid=replaceItemAtIndex_4, PCD=code_block_284.PCD)
# ---------- code_block_293.designscript (4 lines) ----------
end_n_mid;
//dummy short pipe  == tee

PCD;
# ----------------------------------------

# group: tee > dummy pipe R ==branch R
firstItem_21 = List.FirstItem(list=code_block_293.end_n_mid@@L2)
closestPointTo_20 = Geometry.ClosestPointTo(geometry=firstItem_21@@L1, other=transpose_32@L1, lacing=Longest)
parameterAtPoint_25 = Curve.ParameterAtPoint(curve=firstItem_21, point=closestPointTo_20)
code_block_294 = CodeBlock { 0; 1; }
le_15 = parameterAtPoint_25 <= code_block_294.out0
ge_17 = parameterAtPoint_25 >= code_block_294.out1
or_4 = le_15 || ge_17
filterByBoolMask_20 = List.FilterByBoolMask(list=code_block_293.end_n_mid@@L3, mask=or_4@L2)
code_block_295 = CodeBlock { 2; }
getItemAtIndex_118 = List.GetItemAtIndex(list=code_block_293.end_n_mid@@L2, index=code_block_295)
minimumItem_14 = List.MinimumItem(list=getItemAtIndex_118@@L2)
code_block_296 = CodeBlock { 1; }
getItemAtIndex_119 = List.GetItemAtIndex(list=filterByBoolMask_20.in@L2, index=code_block_296)
filterByBoolMask_21 = List.FilterByBoolMask(list=transpose_32@@L2, mask=or_4@L2)
code_block_297 = CodeBlock(line=filterByBoolMask_20.in, corresponding_point=filterByBoolMask_21.in) { line; corresponding_point; }

# group: tee > main == to be the same
code_block_298 = CodeBlock(main_pipe=filterByBoolMask_20.out) { main_pipe[0]; }

# group: tee > connect points
byStartPointEndPoint_10 = Line.ByStartPointEndPoint(startPoint=geometry_closestpointto_on_0, endPoint=geometry_closestpointto_on_1)
startPoint_20 = Curve.StartPoint(curve=byStartPointEndPoint_10)
endPoint_16 = Curve.EndPoint(curve=byStartPointEndPoint_10)
list_create_30 = List.Create(item0=startPoint_20, item1=endPoint_16)
transpose_33 = List.Transpose(lists=list_create_30)

# group: tee > dummy branch == NEW
addItemToEnd_4 = List.AddItemToEnd(item=getItemAtIndex_119@@L1, list=byStartPointEndPoint_10@L1, lacing=Longest)
addItemToEnd_5 = List.AddItemToEnd(item=minimumItem_14@L1, list=addItemToEnd_4@@L2)

# group: tee > extend branch's neighbor
code_block_299 = CodeBlock { 0; }
firstItem_22 = List.FirstItem(list=code_block_297.line@@L2)
startPoint_21 = Curve.StartPoint(curve=firstItem_22)
distanceTo_24 = Geometry.DistanceTo(geometry=code_block_297.corresponding_point, other=startPoint_21)
endPoint_17 = Curve.EndPoint(curve=firstItem_22)
distanceTo_25 = Geometry.DistanceTo(geometry=code_block_297.corresponding_point, other=endPoint_17)
lt_2 = distanceTo_24 < distanceTo_25
if_20 = RefactoredIf(test=lt_2@@L1, true=distanceTo_24@L1, false=distanceTo_25@L1, lacing=Longest)
if_21 = RefactoredIf(test=lt_2@@L1, true=startPoint_21@L1, false=endPoint_17@L1, lacing=Longest)
extend = Curve.Extend(curve=firstItem_22, distance=if_20, pickSide=if_21)
replaceItemAtIndex_5 = List.ReplaceItemAtIndex(list=code_block_297.line@@L2, index=code_block_299, item=extend@L1)
code_block_300 = CodeBlock(extended_branch=replaceItemAtIndex_5) { extended_branch[0]; }

# group (continued): tee
join_15 = List.Join(list0=code_block_298, list1=addItemToEnd_5, list2=code_block_300)
join_16 = List.Join(list0=code_block_292, list1=join_15)
code_block_301 = CodeBlock(connect_points=transpose_33) { connect_points; }
count_26 = List.Count(list=code_block_301@L2)

code_block_302 = CodeBlock(x=join_16)
# ---------- code_block_302.designscript (2 lines) ----------
// description
x;
# ----------------------------------------
code_block_303 = CodeBlock(connect_point_candidate=pointAtParameter_5, surrounding_tolerance=code_block_277) { connect_point_candidate; surrounding_tolerance; }
code_block_304 = CodeBlock(connect_point_candidate=code_block_303.connect_point_candidate, surrounding_tolerance=code_block_303.surrounding_tolerance) { connect_point_candidate; surrounding_tolerance; }

# group: tee > threshold
code_block_305 = CodeBlock()  # same code as code_block_130
getItemAtIndex_120 = List.GetItemAtIndex(list=addItemToEnd_5@L2, index=code_block_305)
code_block_306 = CodeBlock { 8; }
code_block_307 = CodeBlock(x=code_block_306) { 112; x-1; }
pow_5 = Math.Pow(number=code_block_307.out0, power=code_block_307.out1)
code_block_308 = CodeBlock()  # same code as code_block_271
getItemAtIndex_121 = List.GetItemAtIndex(list=addItemToEnd_5@L2, index=code_block_308)
pow_6 = Math.Pow(number=getItemAtIndex_121, power=code_block_306)
code_block_309 = CodeBlock(radius=getItemAtIndex_120, C=pow_5, a=pow_6) { radius * C / a; }

# group (continued): tee
ofRepeatedItem_13 = List.OfRepeatedItem(item=code_block_309@@L1, amount=count_26@L1)
code_block_310 = CodeBlock(point=code_block_301, tolerance=ofRepeatedItem_13)
# ---------- code_block_310.designscript (5 lines) ----------
// connection
point;

// threshold
tolerance;
# ----------------------------------------

code_block_311 = CodeBlock(point=code_block_310.point, tolerance=code_block_310.tolerance)  # same code as code_block_310

# group: ALL POINTS
code_block_312 = CodeBlock(x=code_block_302)  # same code as code_block_302
code_block_313 = CodeBlock(connect_point_candidate=code_block_304.connect_point_candidate, surrounding_tolerance=code_block_304.surrounding_tolerance) { connect_point_candidate; surrounding_tolerance; }
code_block_314 = CodeBlock(point=code_block_311.point, tolerance=code_block_311.tolerance)  # same code as code_block_310

# group: ALL POINTS
lines = CodeBlock(x=code_block_312)  # same code as code_block_302
code_block_315 = CodeBlock(lines=lines) { lines; }
code_block_316 = CodeBlock { 0; }
code_block_317 = CodeBlock(connect_point_candidate=code_block_313.connect_point_candidate, surrounding_tolerance=code_block_313.surrounding_tolerance) { connect_point_candidate; surrounding_tolerance; }
code_block_318 = CodeBlock(point=code_block_314.point, tolerance=code_block_314.tolerance)  # same code as code_block_310

# group: ALL POINTS > AGGREGATE
code_block_319 = CodeBlock()  # same code as code_block_130
getItemAtIndex_122 = List.GetItemAtIndex(list=lines@L2, index=code_block_319)
code_block_320 = CodeBlock { 8; }
code_block_321 = CodeBlock(x=code_block_320) { 112; x-1; }
pow_7 = Math.Pow(number=code_block_321.out0, power=code_block_321.out1)
code_block_322 = CodeBlock()  # same code as code_block_271
getItemAtIndex_123 = List.GetItemAtIndex(list=lines@L2, index=code_block_322)
pow_8 = Math.Pow(number=getItemAtIndex_123, power=code_block_320)
code_block_323 = CodeBlock(radius=getItemAtIndex_122, C=pow_7, a=pow_8) { radius * C / a; }
firstItem_23 = List.FirstItem(list=lines@L2)  # frozen
endPoint_18 = Curve.EndPoint(curve=firstItem_23)
startPoint_22 = Curve.StartPoint(curve=firstItem_23)
list_create_31 = List.Create(item0=endPoint_18, item1=startPoint_22)
transpose_34 = List.Transpose(lists=list_create_31)
count_27 = List.Count(list=transpose_34@L2)
ofRepeatedItem_14 = List.OfRepeatedItem(item=code_block_323@@L1, amount=count_27@L1)
join_17 = List.Join(list0=code_block_317.connect_point_candidate, list1=code_block_318.point)
flatten_35 = List.Flatten(list=join_17)
join_18 = List.Join(list0=code_block_317.surrounding_tolerance, list1=code_block_318.tolerance)
flatten_36 = List.Flatten(list=join_18)
byCenterPointRadius = Sphere.ByCenterPointRadius(centerPoint=flatten_35, radius=flatten_36)

# group: ALL POINTS > aligned CS
code_block_324 = CodeBlock(x=lines)  # same code as code_block_302
firstItem_24 = List.FirstItem(list=code_block_324@L2)
toLine_10 = Geometry.Curves.ToLine(curve=firstItem_24)
direction_14 = Line.Direction(line=toLine_10)
ZAxis_7 = Vector.ZAxis()
angleWithVector_11 = Vector.AngleWithVector(vector=direction_14, otherVector=ZAxis_7)
code_block_325 = CodeBlock { 90; 5; }
eq_30 = Equals(x=angleWithVector_11, y=code_block_325.out0, tolerance=code_block_325.out1)
filterByBoolMask_22 = List.FilterByBoolMask(list=code_block_324@L3, mask=eq_30@L2)
code_block_326 = CodeBlock { 2; }
getItemAtIndex_124 = List.GetItemAtIndex(list=filterByBoolMask_22.in@L2, index=code_block_326)
maximumItem_14 = List.MaximumItem(list=getItemAtIndex_124@L2)
indexOf_15 = List.IndexOf(list=getItemAtIndex_124@L2, element=maximumItem_14@L1)
getItemAtIndex_125 = List.GetItemAtIndex(list=filterByBoolMask_22.in@@L3, index=indexOf_15@L1)
firstItem_25 = List.FirstItem(list=getItemAtIndex_125@L2)
toLine_11 = Geometry.Curves.ToLine(curve=firstItem_25)
startPoint_23 = Curve.StartPoint(curve=toLine_11)
direction_15 = Line.Direction(line=toLine_11)
deconstruct_4 = WombatDynamo.Vector.Deconstruct(vector=direction_15)
byCoordinates_11 = Vector.ByCoordinates(x=deconstruct_4.X, y=deconstruct_4.Y)
ZAxis_8 = Vector.ZAxis()
cross_4 = Vector.Cross(vector=ZAxis_8, cross=byCoordinates_11)
byOriginVectors = CoordinateSystem.ByOriginVectors(origin=startPoint_23, xAxis=byCoordinates_11, yAxis=cross_4, zAxis=ZAxis_8)

# group (continued): ALL POINTS
code_block_327 = CodeBlock(R=byCenterPointRadius)
# ---------- code_block_327.designscript (5 lines) ----------
R;
// in sphere

//center P == current candidates
//R == tolerance
# ----------------------------------------

# group: ALL POINTS > TRANSFORM TO ALIGN
firstItem_26 = List.FirstItem(list=code_block_315@L2)
byOrigin_5 = CoordinateSystem.ByOrigin()
geometry_transform_line = Geometry.Transform(geometry=firstItem_26, fromCoordinateSystem=byOriginVectors, contextCoordinateSystem=byOrigin_5, lacing=Longest)
geometry_transform_connectivity = Geometry.Transform(geometry=code_block_327, fromCoordinateSystem=byOriginVectors, contextCoordinateSystem=byOrigin_5, lacing=Longest)
centerPoint_9 = Sphere.CenterPoint(sphere=geometry_transform_connectivity)
deconstruct_5 = WombatDynamo.Point.Deconstruct(point=centerPoint_9)
minimumItem_15 = List.MinimumItem(list=deconstruct_5.X)
minimumItem_16 = List.MinimumItem(list=deconstruct_5.Y)
minimumItem_17 = List.MinimumItem(list=deconstruct_5.Z)
byCoordinates_12 = Point.ByCoordinates(x=minimumItem_15, y=minimumItem_16, z=minimumItem_17)
byOrigin_6 = CoordinateSystem.ByOrigin(origin=byCoordinates_12)

# group (continued): ALL POINTS
replaceItemAtIndex_6 = List.ReplaceItemAtIndex(list=code_block_315@@L2, index=code_block_316, item=geometry_transform_line@L1)
code_block_328 = CodeBlock(LINES_IN_NEW_CS=replaceItemAtIndex_6) { LINES_IN_NEW_CS; }
code_block_329 = CodeBlock(TRANSFORMED_POINTS=geometry_transform_connectivity) { TRANSFORMED_POINTS; }

code_block_330 = CodeBlock(TRANSFORMED_lines=code_block_328)
# ---------- code_block_330.designscript (2 lines) ----------
TRANSFORMED_lines;
// TRANSFORMED
# ----------------------------------------
code_block_331 = CodeBlock(TRANSFORMED_lines=code_block_330)  # same code as code_block_330
lines_2 = CodeBlock(x=code_block_331)  # same code as code_block_302
code_block_332 = CodeBlock(TRANSFORMED_POINTS=code_block_329) { TRANSFORMED_POINTS; }
code_block_333 = CodeBlock(R=code_block_332)  # same code as code_block_327
centerPoint_10 = Sphere.CenterPoint(sphere=code_block_332)
code_block_334 = CodeBlock(CS_for_calibration=byOrigin_6) { CS_for_calibration; }
code_block_335 = CodeBlock { 1; }
getItemAtIndex_126 = List.GetItemAtIndex(list=code_block_330@L2, index=code_block_335)
minimumItem_18 = List.MinimumItem(list=getItemAtIndex_126)
code_block_336 = CodeBlock(min_R=minimumItem_18) { x = min_R / 4; DSCore.Math.Floor (x); }
code_block_337 = CodeBlock(x=code_block_336.out1)
# ---------- code_block_337.designscript (3 lines) ----------
//GROUPING DOSTANCE

x;
# ----------------------------------------

# group: Zvalue
XYPlane = CoordinateSystem.XYPlane(coordinateSystem=code_block_334)
distanceTo_26 = Geometry.DistanceTo(geometry=centerPoint_10, other=XYPlane, lacing=Longest)
flatten_37 = List.Flatten(list=distanceTo_26)
code_block_338 = CodeBlock(d=flatten_37, interval=code_block_337) { DSCore.Math.Floor(d /interval); }
groupByKey_6 = List.GroupByKey(list=code_block_333, keys=code_block_338)

centerPoint_11 = Sphere.CenterPoint(sphere=groupByKey_6.groups)
Z_2 = Point.Z(point=centerPoint_11)
code_block_339 = CodeBlock { 1; }
radius_14 = Sphere.Radius(sphere=groupByKey_6.groups)
code_block_340 = CodeBlock { 2; }
pow_9 = Math.Pow(number=radius_14, power=code_block_340)
div_3 = code_block_339 / pow_9
maximumItem_15 = List.MaximumItem(list=pow_9@@L2)
mul = div_3@L2 * maximumItem_15@@L1  # lacing=Longest
ofRepeatedItem_15 = List.OfRepeatedItem(item=Z_2@@L1, amount=mul@L1, lacing=Longest)
average_19 = Math.Average(numbers=ofRepeatedItem_15@@L2)
byCoordinates_13 = Point.ByCoordinates(z=average_19)
ZAxis_9 = Vector.ZAxis()
byOriginNormal_17 = Plane.ByOriginNormal(origin=byCoordinates_13, normal=ZAxis_9)
closestPointTo_21 = Geometry.ClosestPointTo(geometry=byOriginNormal_17, other=centerPoint_11)
byTwoPoints_4 = Vector.ByTwoPoints(start=centerPoint_11, end=closestPointTo_21)
translate_8 = Geometry.Translate(geometry=groupByKey_6.groups, direction=byTwoPoints_4)
flatten_38 = List.Flatten(list=translate_8)
count_28 = List.Count(list=centerPoint_10)
code_block_341 = CodeBlock(x=count_28) { 0..x-1; }
groupByKey_7 = List.GroupByKey(list=code_block_341, keys=code_block_338)
flatten_39 = List.Flatten(list=groupByKey_7.groups)
sortByKey_6 = List.SortByKey(list=flatten_38, keys=flatten_39)
code_block_342 = CodeBlock(calibrate_Y=sortByKey_6.sortedList) { calibrate_Y; }

# group: X
YZPlane = CoordinateSystem.YZPlane(coordinateSystem=code_block_334)
distanceTo_27 = Geometry.DistanceTo(geometry=code_block_342, other=YZPlane, lacing=Longest)
flatten_40 = List.Flatten(list=distanceTo_27)
code_block_343 = CodeBlock(d=flatten_40, interval=code_block_337) { DSCore.Math.Floor(d /interval); }
groupByKey_8 = List.GroupByKey(list=code_block_342, keys=code_block_343)

centerPoint_12 = Sphere.CenterPoint(sphere=groupByKey_8.groups)
X_3 = Point.X(point=centerPoint_12)
code_block_344 = CodeBlock { 1; }
radius_15 = Sphere.Radius(sphere=groupByKey_8.groups)
code_block_345 = CodeBlock { 2; }
pow_10 = Math.Pow(number=radius_15, power=code_block_345)
div_4 = code_block_344 / pow_10
maximumItem_16 = List.MaximumItem(list=pow_10@@L2)
mul_2 = div_4@L2 * maximumItem_16@@L1  # lacing=Longest
ofRepeatedItem_16 = List.OfRepeatedItem(item=X_3@@L1, amount=mul_2@L1, lacing=Longest)
average_20 = Math.Average(numbers=ofRepeatedItem_16@@L2)
byCoordinates_14 = Point.ByCoordinates(x=average_20)
XAxis_2 = Vector.XAxis()
byOriginNormal_18 = Plane.ByOriginNormal(origin=byCoordinates_14, normal=XAxis_2)
closestPointTo_22 = Geometry.ClosestPointTo(geometry=byOriginNormal_18, other=centerPoint_12)
byTwoPoints_5 = Vector.ByTwoPoints(start=centerPoint_12, end=closestPointTo_22)
translate_9 = Geometry.Translate(geometry=groupByKey_8.groups, direction=byTwoPoints_5)
flatten_41 = List.Flatten(list=translate_9)
groupByKey_9 = List.GroupByKey(list=code_block_341, keys=code_block_343)
flatten_42 = List.Flatten(list=groupByKey_9.groups)
sortByKey_7 = List.SortByKey(list=flatten_41, keys=flatten_42)
code_block_346 = CodeBlock(calibrate_Y=sortByKey_7.sortedList) { calibrate_Y; }

# group: Y
ZXPlane = CoordinateSystem.ZXPlane(coordinateSystem=code_block_334)
distanceTo_28 = Geometry.DistanceTo(geometry=code_block_346, other=ZXPlane, lacing=Longest)
flatten_43 = List.Flatten(list=distanceTo_28)
code_block_347 = CodeBlock(d=flatten_43, interval=code_block_337) { DSCore.Math.Floor(d /interval); }
groupByKey_10 = List.GroupByKey(list=code_block_346, keys=code_block_347)

centerPoint_13 = Sphere.CenterPoint(sphere=groupByKey_10.groups)
Y_3 = Point.Y(point=centerPoint_13)
code_block_348 = CodeBlock { 1; }
radius_16 = Sphere.Radius(sphere=groupByKey_10.groups)
code_block_349 = CodeBlock { 2; }
pow_11 = Math.Pow(number=radius_16, power=code_block_349)
div_5 = code_block_348 / pow_11
maximumItem_17 = List.MaximumItem(list=pow_11@@L2)
mul_3 = div_5@L2 * maximumItem_17@@L1  # lacing=Longest
ofRepeatedItem_17 = List.OfRepeatedItem(item=Y_3@@L1, amount=mul_3@L1, lacing=Longest)
average_21 = Math.Average(numbers=ofRepeatedItem_17@@L2)
byCoordinates_15 = Point.ByCoordinates(y=average_21)
YAxis_2 = Vector.YAxis()
byOriginNormal_19 = Plane.ByOriginNormal(origin=byCoordinates_15, normal=YAxis_2)
closestPointTo_23 = Geometry.ClosestPointTo(geometry=byOriginNormal_19, other=centerPoint_13)
byTwoPoints_6 = Vector.ByTwoPoints(start=centerPoint_13, end=closestPointTo_23)
translate_10 = Geometry.Translate(geometry=groupByKey_10.groups, direction=byTwoPoints_6)
flatten_44 = List.Flatten(list=translate_10)
groupByKey_11 = List.GroupByKey(list=code_block_341, keys=code_block_347)
flatten_45 = List.Flatten(list=groupByKey_11.groups)
sortByKey_8 = List.SortByKey(list=flatten_44, keys=flatten_45)

# group: POINTS NEIGHBORING LINES
code_block_350 = CodeBlock(ADJUSTED_INTERSWECTIONS=sortByKey_8.sortedList)
# ---------- code_block_350.designscript (2 lines) ----------
ADJUSTED_INTERSWECTIONS;
// IN SPHERE
# ----------------------------------------
centerPoint_14 = Sphere.CenterPoint(sphere=code_block_350)
lines_3 = CodeBlock(x=code_block_331)  # same code as code_block_302
lines_4 = CodeBlock(x=lines_3)  # same code as code_block_302
centerPoint_15 = Sphere.CenterPoint(sphere=code_block_350)
flatten_46 = List.Flatten(list=centerPoint_15)
count_29 = List.Count(list=flatten_46)
ofRepeatedItem_18 = List.OfRepeatedItem(item=lines_4, amount=count_29)
firstItem_27 = List.FirstItem(list=ofRepeatedItem_18@@L2)
toLine_12 = Geometry.Curves.ToLine(curve=firstItem_27)
distanceTo_29 = Geometry.DistanceTo(geometry=flatten_46@L1, other=toLine_12@@L2, lacing=Longest)
code_block_351 = CodeBlock { 0; }
eq_31 = distanceTo_29 == code_block_351
countTrue_15 = List.CountTrue(list=eq_31@L2)
code_block_352 = CodeBlock { 2; }
eq_32 = countTrue_15 == code_block_352
code_block_353 = CodeBlock { true; }
allIndicesOf_9 = List.AllIndicesOf(list=eq_31@@L2, item=code_block_353)
sort_5 = List.Sort(list=distanceTo_29@@L2)
code_block_354 = CodeBlock { 2; }
takeItems_4 = List.TakeItems(list=sort_5@@L2, amount=code_block_354)
indexOf_16 = List.IndexOf(list=distanceTo_29@@L2, element=takeItems_4@L2)
if_22 = RefactoredIf(test=eq_32@@L1, true=allIndicesOf_9@L2, false=indexOf_16@L2, lacing=Longest)
getItemAtIndex_127 = List.GetItemAtIndex(list=ofRepeatedItem_18@@L3, index=if_22@L2)
firstItem_28 = List.FirstItem(list=getItemAtIndex_127@@L2)
count_30 = List.Count(list=lines_4@L3)
code_block_355 = CodeBlock(x=count_30) { 0..x-1; }
ofRepeatedItem_19 = List.OfRepeatedItem(item=code_block_355, amount=count_29)

# group: POINTS NEIGHBORING LINES > closest point (of connectivity candidate) on line
code_block_356 = CodeBlock { 500; }
extendStart_24 = Curve.ExtendStart(curve=firstItem_28, distance=code_block_356)
extendEnd_23 = Curve.ExtendEnd(curve=extendStart_24, distance=code_block_356)
closestPointTo_24 = Geometry.ClosestPointTo(geometry=extendEnd_23@@L2, other=flatten_46@L1, lacing=Longest)

# group (continued): POINTS NEIGHBORING LINES
join_19 = List.Join(list0=centerPoint_14, list1=closestPointTo_24)
flatten_47 = List.Flatten(list=join_19)

lines_5 = CodeBlock(x=code_block_331)  # same code as code_block_302
code_block_357 = CodeBlock(from_cs=byOrigin_5, to_cs=byOriginVectors)
# ---------- code_block_357.designscript (4 lines) ----------
//reverse
from_cs;

to_cs;
# ----------------------------------------
code_block_358 = CodeBlock(from_cs=code_block_357.from_cs, to_cs=code_block_357.to_cs)  # same code as code_block_357
flatten_48 = List.Flatten(list=translate_10)  # frozen
radius_17 = Sphere.Radius(sphere=code_block_332)  # frozen
toLine_13 = Geometry.Curves.ToLine()  # unwired: curve
direction_16 = Line.Direction(line=toLine_13)
ZAxis_10 = Vector.ZAxis()
angleWithVector_12 = Vector.AngleWithVector(vector=direction_16, otherVector=ZAxis_10)
XAxis_3 = Vector.XAxis()
angleWithVector_13 = Vector.AngleWithVector(vector=direction_16, otherVector=XAxis_3)

# group: 夹角check
toLine_14 = Geometry.Curves.ToLine(curve=firstItem_28)
code_block_359 = CodeBlock { 0.5; }
pointAtParameter_6 = Curve.PointAtParameter(curve=firstItem_28, param=code_block_359)
byTwoPoints_7 = Vector.ByTwoPoints(start=flatten_46@L1, end=pointAtParameter_6@@L2, lacing=Longest)
transpose_35 = List.Transpose(lists=byTwoPoints_7)
code_block_360 = CodeBlock(x=transpose_35) { x[0]; x[1]; }
angleWithVector_14 = Vector.AngleWithVector(vector=code_block_360.out0, otherVector=code_block_360.out1)

code_block_361 = CodeBlock { 2; }
code_block_362 = CodeBlock { 0; 1; }
byGroupedCurves = PolyCurve.ByGroupedCurves()  # unwired: curves
code_block_363 = CodeBlock(PCD=code_block_153.PCD, replace_index=code_block_153.replace_index, all_lines=code_block_164.line_info) { PCD; replace_index; all_lines; }
getItemAtIndex_128 = List.GetItemAtIndex(list=code_block_363.all_lines@L3, index=code_block_363.replace_index@L2)
code_block_364 = CodeBlock(x=getItemAtIndex_128) { x[0]; }
code_block_365 = CodeBlock(x=code_block_364, all=code_block_363.all_lines) { x; all[0]; }
count_31 = List.Count()  # unwired: list

# group: adjust """RADIUS only"""" for similar lines that connect to each other define similar==> prerequisite：**2 pipes re connecting to each other, THUS, INTERSECTION PIOINT AS REFERENCE** direction angle<5degree radius difference<20mm """1 intersection == 2 lines, """"while for 2 intersection with 3 lines that linked ===> 以多条线之间最好的%为准，调整剩余 2 个的 radius
all_intersection_4 = Watch(all_intersection_2)
lines_new_all_4 = Watch(lines_new_all_3)
boolean_7 = BoolSelector(true)
boolean_8 = BoolSelector(true)
boolean_9 = BoolSelector(true)

# group: adjust """RADIUS only"""" for similar lines that connect to each other define similar==> prerequisite：**2 pipes re connecting to each other, THUS, INTERSECTION PIOINT AS REFERENCE** direction angle<5degree radius difference<20mm """1 intersection == 2 lines, """"while for 2 intersection with 3 lines that linked ===> 以多条线之间最好的%为准，调整剩余 2 个的 radius > 1 list == 1 intersetion point sublist == 2 lines in a group == 2 line with 1 intersect point
code_block_366 = CodeBlock { 0; }
getItemAtIndex_129 = List.GetItemAtIndex(list=lines_new_all_4@L2, index=code_block_366)
doesIntersect_2 = Geometry.DoesIntersect(geometry=all_intersection_4@L1, other=getItemAtIndex_129@L2, lacing=Longest)
boolean_10 = BoolSelector(true)
list_allindicesof_lines = List.AllIndicesOf(list=doesIntersect_2@L2, item=boolean_10, lacing=Longest)
getItemAtIndex_130 = List.GetItemAtIndex(list=lines_new_all_4@L3, index=list_allindicesof_lines@L2, lacing=Longest)

# group: adjust """RADIUS only"""" for similar lines that connect to each other define similar==> prerequisite：**2 pipes re connecting to each other, THUS, INTERSECTION PIOINT AS REFERENCE** direction angle<5degree radius difference<20mm """1 intersection == 2 lines, """"while for 2 intersection with 3 lines that linked ===> 以多条线之间最好的%为准，调整剩余 2 个的 radius > 3. RADIUS DIFFERENCE
code_block_367 = CodeBlock { 1; }
getItemAtIndex_131 = List.GetItemAtIndex(list=getItemAtIndex_130@@L2, index=code_block_367)
transpose_36 = List.Transpose(lists=getItemAtIndex_131)
code_block_368 = CodeBlock(X=transpose_36) { X[0]; X[1]; }
sub_3 = code_block_368.out0 - code_block_368.out1
abs = Math.Abs(number=sub_3)

# group: adjust """RADIUS only"""" for similar lines that connect to each other define similar==> prerequisite：**2 pipes re connecting to each other, THUS, INTERSECTION PIOINT AS REFERENCE** direction angle<5degree radius difference<20mm """1 intersection == 2 lines, """"while for 2 intersection with 3 lines that linked ===> 以多条线之间最好的%为准，调整剩余 2 个的 radius > define: similar radius
code_block_369 = CodeBlock { 25; }
le_16 = abs <= code_block_369

# group (continued): adjust """RADIUS only"""" for similar lines that connect to each other define similar==> prerequisite：**2 pipes re connecting to each other, THUS, INTERSECTION PIOINT AS REFERENCE** direction angle<5degree radius difference<20mm """1 intersection == 2 lines, """"while for 2 intersection with 3 lines that linked ===> 以多条线之间最好的%为准，调整剩余 2 个的 radius
allIndicesOf_10 = List.AllIndicesOf(list=le_16, item=boolean_7)
list_getitematindex_index = List.GetItemAtIndex(list=list_allindicesof_lines@L3, index=allIndicesOf_10@L1, lacing=Longest)  # frozen
list_getitematindex_line = List.GetItemAtIndex(list=getItemAtIndex_130@L4, index=allIndicesOf_10@L1, lacing=Longest)  # frozen

# group: adjust """RADIUS only"""" for similar lines that connect to each other define similar==> prerequisite：**2 pipes re connecting to each other, THUS, INTERSECTION PIOINT AS REFERENCE** direction angle<5degree radius difference<20mm """1 intersection == 2 lines, """"while for 2 intersection with 3 lines that linked ===> 以多条线之间最好的%为准，调整剩余 2 个的 radius > THE VERY VERY ORIGINAL LINES ////ONLY NEED % > xx? for reference index of true == , && does NOT change the line sequence (ie. 算是物尽其用吧)
lines_new_all_5 = Watch(lines_new_all_4)
original_lines_all = Watch()  # unwired: arg0
code_block_370 = CodeBlock { 2; }
getItemAtIndex_132 = List.GetItemAtIndex(list=original_lines_all@L2, index=code_block_370)
code_block_371 = CodeBlock { 90; }
gt_5 = getItemAtIndex_132@L2 > code_block_371@L1  # lacing=Longest
boolean_11 = BoolSelector(true)
allIndicesOf_11 = List.AllIndicesOf(list=gt_5@L2, item=boolean_11@L1, lacing=Longest)
getItemAtIndex_133 = List.GetItemAtIndex(list=lines_new_all_5@L3, index=allIndicesOf_11@L2, lacing=Longest)
getItemAtIndex_134 = List.GetItemAtIndex(list=original_lines_all@L3, index=allIndicesOf_11@L2, lacing=Longest)

# group (continued): adjust """RADIUS only"""" for similar lines that connect to each other define similar==> prerequisite：**2 pipes re connecting to each other, THUS, INTERSECTION PIOINT AS REFERENCE** direction angle<5degree radius difference<20mm """1 intersection == 2 lines, """"while for 2 intersection with 3 lines that linked ===> 以多条线之间最好的%为准，调整剩余 2 个的 radius
lines_new_all_6 = Watch(lines_new_all_5)
code_block_372 = CodeBlock(correspounding_lines_in_new_list=getItemAtIndex_133, best_percentage_index=allIndicesOf_11, best_percentage_data=getItemAtIndex_134) { correspounding_lines_in_new_list; best_percentage_index; best_percentage_data; }

# group: adjust """RADIUS only"""" for similar lines that connect to each other define similar==> prerequisite：**2 pipes re connecting to each other, THUS, INTERSECTION PIOINT AS REFERENCE** direction angle<5degree radius difference<20mm """1 intersection == 2 lines, """"while for 2 intersection with 3 lines that linked ===> 以多条线之间最好的%为准，调整剩余 2 个的 radius > 1. ANGLE
code_block_373 = CodeBlock { 0; }
getItemAtIndex_135 = List.GetItemAtIndex(list=getItemAtIndex_130@@L2, index=code_block_373)
direction_17 = Line.Direction(line=getItemAtIndex_135, lacing=Longest)
transpose_37 = List.Transpose(lists=direction_17)
code_block_374 = CodeBlock(X=transpose_37) { X[0]; X[1]; }
angleWithVector_15 = Vector.AngleWithVector(vector=code_block_374.out0, otherVector=code_block_374.out1)
code_block_375 = CodeBlock(x=angleWithVector_15) { 90; 180-x; }
gt_6 = angleWithVector_15 > code_block_375.out0
if_23 = RefactoredIf(test=gt_6@L1, true=code_block_375.out1@L1, false=angleWithVector_15@L1, lacing=Longest)

# group: adjust """RADIUS only"""" for similar lines that connect to each other define similar==> prerequisite：**2 pipes re connecting to each other, THUS, INTERSECTION PIOINT AS REFERENCE** direction angle<5degree radius difference<20mm """1 intersection == 2 lines, """"while for 2 intersection with 3 lines that linked ===> 以多条线之间最好的%为准，调整剩余 2 个的 radius > < xx degree == similar
code_block_376 = CodeBlock { 5; }
le_17 = if_23 <= code_block_376

# group (continued): adjust """RADIUS only"""" for similar lines that connect to each other define similar==> prerequisite：**2 pipes re connecting to each other, THUS, INTERSECTION PIOINT AS REFERENCE** direction angle<5degree radius difference<20mm """1 intersection == 2 lines, """"while for 2 intersection with 3 lines that linked ===> 以多条线之间最好的%为准，调整剩余 2 个的 radius
allIndicesOf_12 = List.AllIndicesOf(list=le_17, item=boolean_8)
list_getitematindex_line_2 = List.GetItemAtIndex(list=getItemAtIndex_130@L4, index=allIndicesOf_12@L1, lacing=Longest)  # frozen
list_getitematindex_index_2 = List.GetItemAtIndex(list=list_allindicesof_lines@L3, index=allIndicesOf_12@L1, lacing=Longest)  # frozen

# group: adjust """RADIUS only"""" for similar lines that connect to each other define similar==> prerequisite：**2 pipes re connecting to each other, THUS, INTERSECTION PIOINT AS REFERENCE** direction angle<5degree radius difference<20mm """1 intersection == 2 lines, """"while for 2 intersection with 3 lines that linked ===> 以多条线之间最好的%为准，调整剩余 2 个的 radius > 2. parameter both at 0/1
code_block_377 = CodeBlock { 0; }
getItemAtIndex_136 = List.GetItemAtIndex(list=getItemAtIndex_130@@L2, index=code_block_377)
parameterAtPoint_26 = Curve.ParameterAtPoint(curve=getItemAtIndex_136@@L2, point=all_intersection_4@L1, lacing=Longest)
transpose_38 = List.Transpose(lists=parameterAtPoint_26)
code_block_378 = CodeBlock(X=transpose_38) { X[0]; X[1]; }
add = code_block_378.out0 + code_block_378.out1
code_block_379 = CodeBlock { 0; 1; 2; }
eq_33 = add == code_block_379.out0
eq_34 = add == code_block_379.out1
or_5 = eq_33 || eq_34
eq_35 = add == code_block_379.out2
or_6 = or_5 || eq_35

# group (continued): adjust """RADIUS only"""" for similar lines that connect to each other define similar==> prerequisite：**2 pipes re connecting to each other, THUS, INTERSECTION PIOINT AS REFERENCE** direction angle<5degree radius difference<20mm """1 intersection == 2 lines, """"while for 2 intersection with 3 lines that linked ===> 以多条线之间最好的%为准，调整剩余 2 个的 radius
allIndicesOf_13 = List.AllIndicesOf(list=or_6, item=boolean_9)

# group: adjust """RADIUS only"""" for similar lines that connect to each other define similar==> prerequisite：**2 pipes re connecting to each other, THUS, INTERSECTION PIOINT AS REFERENCE** direction angle<5degree radius difference<20mm """1 intersection == 2 lines, """"while for 2 intersection with 3 lines that linked ===> 以多条线之间最好的%为准，调整剩余 2 个的 radius > degree √√ and && param at 0/1 √ or radius difference √√
setIntersection = List.SetIntersection(list1=allIndicesOf_12, list2=allIndicesOf_13)
setUnion = List.SetUnion(list1=allIndicesOf_10, list2=setIntersection)
list_getitematindex_index_3 = List.GetItemAtIndex(list=list_allindicesof_lines@L3, index=setUnion@L1, lacing=Longest)
list_getitematindex_line_3 = List.GetItemAtIndex(list=getItemAtIndex_130@L4, index=setUnion@L1, lacing=Longest)

# group: adjust """RADIUS only"""" for similar lines that connect to each other define similar==> prerequisite：**2 pipes re connecting to each other, THUS, INTERSECTION PIOINT AS REFERENCE** direction angle<5degree radius difference<20mm """1 intersection == 2 lines, """"while for 2 intersection with 3 lines that linked ===> 以多条线之间最好的%为准，调整剩余 2 个的 radius > middle overlapped line
code_block_380 = CodeBlock(index=list_getitematindex_index_3) { index; }
flatten_49 = List.Flatten(list=list_getitematindex_index_3)
uniqueItems_4 = List.UniqueItems(list=flatten_49)
eq_36 = uniqueItems_4@L1 == flatten_49@L2  # lacing=CrossProduct
countTrue_16 = List.CountTrue(list=eq_36@L2)
code_block_381 = CodeBlock { 2; }
ge_18 = countTrue_16 >= code_block_381
boolean_12 = BoolSelector(true)
allIndicesOf_14 = List.AllIndicesOf(list=ge_18, item=boolean_12)
getItemAtIndex_137 = List.GetItemAtIndex(list=uniqueItems_4, index=allIndicesOf_14)
contains_2 = List.Contains(list=code_block_380@@L2, item=getItemAtIndex_137@L1, lacing=CrossProduct)
transpose_39 = List.Transpose(lists=contains_2)
boolean_13 = BoolSelector(true)
allIndicesOf_15 = List.AllIndicesOf(list=transpose_39@@L2, item=boolean_13, lacing=Longest)
getItemAtIndex_138 = List.GetItemAtIndex(list=code_block_380@L3, index=allIndicesOf_15@@L2, lacing=Longest)
flatten_50 = List.Flatten(list=allIndicesOf_15)
removeItemAtIndex_12 = List.RemoveItemAtIndex(list=code_block_380@L3, indices=flatten_50)
code_block_382 = CodeBlock(x=getItemAtIndex_138, y=removeItemAtIndex_12) { x; y[0]; }

# group: adjust """RADIUS only"""" for similar lines that connect to each other define similar==> prerequisite：**2 pipes re connecting to each other, THUS, INTERSECTION PIOINT AS REFERENCE** direction angle<5degree radius difference<20mm """1 intersection == 2 lines, """"while for 2 intersection with 3 lines that linked ===> 以多条线之间最好的%为准，调整剩余 2 个的 radius > == 2 lines' pipe group 1. contains good result from the very very begainning, replacing all pipes' radius within the group by the radius from the best one 2. if NOT contains , average radius
lines_new_all_7 = Watch(lines_new_all_6)
lines_group_2_lines = Watch(code_block_382.out1)
getItemAtIndex_139 = List.GetItemAtIndex(list=lines_new_all_7@L3, index=lines_group_2_lines@@L2, lacing=Longest)
index_of_best = Watch(code_block_372.best_percentage_index)
eq_37 = lines_group_2_lines@L2 == index_of_best@@L1  # lacing=CrossProduct
transpose_40 = List.Transpose(lists=eq_37)
anyTrue_4 = List.AnyTrue(list=transpose_40@L3)
boolean_14 = BoolSelector(true)
allIndicesOf_16 = List.AllIndicesOf(list=anyTrue_4@L2, item=boolean_14@L1, lacing=Longest)
getItemAtIndex_140 = List.GetItemAtIndex(list=transpose_40@@L4, index=allIndicesOf_16@L1, lacing=Longest)
anyTrue_5 = List.AnyTrue(list=getItemAtIndex_140@@L2)
boolean_15 = BoolSelector(true)
allIndicesOf_17 = List.AllIndicesOf(list=anyTrue_5@L2, item=boolean_15@L1, lacing=Longest)
getItemAtIndex_141 = List.GetItemAtIndex(list=getItemAtIndex_139@@L4, index=allIndicesOf_17@L1, lacing=Longest)
code_block_383 = CodeBlock { 1; }
mod_3 = Watch(code_block_372.best_percentage_data)
getItemAtIndex_142 = List.GetItemAtIndex(list=mod_3@L3, index=allIndicesOf_16@L1, lacing=Longest)
code_block_384 = CodeBlock { 1; }
getItemAtIndex_143 = List.GetItemAtIndex(list=getItemAtIndex_142@L2, index=code_block_384)
replaceItemAtIndex_7 = List.ReplaceItemAtIndex(list=getItemAtIndex_141@L2, index=code_block_383, item=getItemAtIndex_143, lacing=Longest)
allFalse = List.AllFalse(list=eq_37@L3)
boolean_16 = BoolSelector(true)
allIndicesOf_18 = List.AllIndicesOf(list=allFalse@L2, item=boolean_16@L1, lacing=Longest)
getItemAtIndex_144 = List.GetItemAtIndex(list=getItemAtIndex_139@@L4, index=allIndicesOf_18@L1, lacing=Longest)
code_block_385 = CodeBlock { 0; }
getItemAtIndex_145 = List.GetItemAtIndex(list=getItemAtIndex_144@@L2, index=code_block_385)
flatten_51 = List.Flatten(list=getItemAtIndex_145)
code_block_386 = CodeBlock { 1; }
getItemAtIndex_146 = List.GetItemAtIndex(list=getItemAtIndex_144@@L2, index=code_block_386)
average_22 = Math.Average(numbers=getItemAtIndex_146@L2)
code_block_387 = CodeBlock { 2; }
ofRepeatedItem_20 = List.OfRepeatedItem(item=average_22, amount=code_block_387)
transpose_41 = List.Transpose(lists=ofRepeatedItem_20)
flatten_52 = List.Flatten(list=transpose_41)
list_create_32 = List.Create(item0=flatten_51, item1=flatten_52)
transpose_42 = List.Transpose(lists=list_create_32)
join_20 = List.Join(list0=replaceItemAtIndex_7, list1=transpose_42)
code_block_388 = CodeBlock { 0; }
code_block_389 = CodeBlock { null; }
indexOf_17 = List.IndexOf(list=join_20@L3, element=code_block_389, lacing=Longest)
removeItemAtIndex_13 = List.RemoveItemAtIndex(list=join_20@L3, indices=indexOf_17@L1, lacing=Longest)
code_block_390 = CodeBlock(x=removeItemAtIndex_13) { x[0]; }
getItemAtIndex_147 = List.GetItemAtIndex(list=code_block_390@L2, index=code_block_388)
flatten_53 = List.Flatten()  # frozen; unwired: list
uniqueItems_5 = List.UniqueItems(list=flatten_53@L2)
getItemAtIndex_148 = List.GetItemAtIndex(list=mod_3@L2, index=allIndicesOf_16@L2, lacing=Longest)  # frozen
replaceItemAtIndex_8 = List.ReplaceItemAtIndex(list=getItemAtIndex_144@L2, index=code_block_386, item=average_22, lacing=Longest)  # frozen
getItemAtIndex_149 = List.GetItemAtIndex(list=lines_group_2_lines@L3, index=allIndicesOf_17@L1, lacing=Longest)  # frozen
getItemAtIndex_150 = List.GetItemAtIndex(list=lines_group_2_lines@L3, index=allIndicesOf_18@L1, lacing=Longest)  # frozen
join_21 = List.Join(list0=getItemAtIndex_149, list1=getItemAtIndex_150)  # frozen
flatten_54 = List.Flatten(list=join_21)

# group: adjust """RADIUS only"""" for similar lines that connect to each other define similar==> prerequisite：**2 pipes re connecting to each other, THUS, INTERSECTION PIOINT AS REFERENCE** direction angle<5degree radius difference<20mm """1 intersection == 2 lines, """"while for 2 intersection with 3 lines that linked ===> 以多条线之间最好的%为准，调整剩余 2 个的 radius > >=3 lines' pipe group 1. contains good result from the very very begainning, replacing all pipes' radius within the group by the radius from the best one 2. if NOT contains , average radius
lines_new_all_8 = Watch(lines_new_all_6)
lines_new_all_9 = Watch(lines_new_all_8)
code_block_391 = CodeBlock { 0; }
getItemAtIndex_151 = List.GetItemAtIndex(list=lines_new_all_9@L2, index=code_block_391)
lines_group_2_lines_2 = Watch(code_block_382.x)
flatten_55 = List.Flatten(list=lines_group_2_lines_2@L3)
uniqueItems_6 = List.UniqueItems(list=flatten_55@L2)
getItemAtIndex_152 = List.GetItemAtIndex(list=lines_new_all_8@L3, index=uniqueItems_6@@L2, lacing=Longest)
index_of_best_2 = Watch(code_block_372.best_percentage_index)
eq_38 = uniqueItems_6@L2 == index_of_best_2@@L1  # lacing=CrossProduct
transpose_43 = List.Transpose(lists=eq_38)
anyTrue_6 = List.AnyTrue(list=transpose_43@L3)
boolean_17 = BoolSelector(true)
allIndicesOf_19 = List.AllIndicesOf(list=anyTrue_6@L2, item=boolean_17@L1, lacing=Longest)
getItemAtIndex_153 = List.GetItemAtIndex(list=transpose_43@@L4, index=allIndicesOf_19@L1, lacing=Longest)
anyTrue_7 = List.AnyTrue(list=getItemAtIndex_153@L2)
boolean_18 = BoolSelector(true)
allIndicesOf_20 = List.AllIndicesOf(list=anyTrue_7@L2, item=boolean_18@L1, lacing=Longest)
getItemAtIndex_154 = List.GetItemAtIndex(list=getItemAtIndex_152@@L4, index=allIndicesOf_20@L1, lacing=Longest)
code_block_392 = CodeBlock { 1; }
mod_4 = Watch(code_block_372.best_percentage_data)
getItemAtIndex_155 = List.GetItemAtIndex(list=mod_4@L3, index=allIndicesOf_19@L1, lacing=Longest)
code_block_393 = CodeBlock { 1; }
getItemAtIndex_156 = List.GetItemAtIndex(list=getItemAtIndex_155@L2, index=code_block_393)
replaceItemAtIndex_9 = List.ReplaceItemAtIndex(list=getItemAtIndex_154@L2, index=code_block_392, item=getItemAtIndex_156, lacing=Longest)
allFalse_2 = List.AllFalse(list=eq_38@L3)
boolean_19 = BoolSelector(true)
allIndicesOf_21 = List.AllIndicesOf(list=allFalse_2@L2, item=boolean_19@L1, lacing=Longest)
getItemAtIndex_157 = List.GetItemAtIndex(list=getItemAtIndex_152@@L4, index=allIndicesOf_21@L1, lacing=Longest)
code_block_394 = CodeBlock { 0; }
getItemAtIndex_158 = List.GetItemAtIndex(list=getItemAtIndex_157@@L2, index=code_block_394)
flatten_56 = List.Flatten(list=getItemAtIndex_158)
code_block_395 = CodeBlock { 1; }
getItemAtIndex_159 = List.GetItemAtIndex(list=getItemAtIndex_157@@L2, index=code_block_395)
average_23 = Math.Average(numbers=getItemAtIndex_159@@L2)
count_32 = List.Count(list=getItemAtIndex_158@L2)
ofRepeatedItem_21 = List.OfRepeatedItem(item=average_23@L1, amount=count_32@@L1)
flatten_57 = List.Flatten(list=ofRepeatedItem_21)
list_create_33 = List.Create(item0=flatten_56, item1=flatten_57)
transpose_44 = List.Transpose(lists=list_create_33)
join_22 = List.Join(list0=replaceItemAtIndex_9, list1=transpose_44)
code_block_396 = CodeBlock { null; }
indexOf_18 = List.IndexOf(list=join_22@L3, element=code_block_396, lacing=Longest)
removeItemAtIndex_14 = List.RemoveItemAtIndex(list=join_20@L3, indices=indexOf_18@L1, lacing=Longest)
code_block_397 = CodeBlock(x=removeItemAtIndex_14) { x[0]; }
getItemAtIndex_160 = List.GetItemAtIndex(list=code_block_397@L2, index=code_block_391)
indexOf_19 = List.IndexOf(list=getItemAtIndex_151, element=getItemAtIndex_160)
getItemAtIndex_161 = List.GetItemAtIndex(list=mod_4@L2, index=allIndicesOf_19@L2, lacing=Longest)  # frozen
getItemAtIndex_162 = List.GetItemAtIndex(list=uniqueItems_6@L3, index=allIndicesOf_20@L1, lacing=Longest)  # frozen
getItemAtIndex_163 = List.GetItemAtIndex(list=uniqueItems_6@L3, index=allIndicesOf_21@L1, lacing=Longest)  # frozen
join_23 = List.Join(list0=getItemAtIndex_162, list1=getItemAtIndex_163)
flatten_58 = List.Flatten(list=join_23)

# group: adjust """RADIUS only"""" for similar lines that connect to each other define similar==> prerequisite：**2 pipes re connecting to each other, THUS, INTERSECTION PIOINT AS REFERENCE** direction angle<5degree radius difference<20mm """1 intersection == 2 lines, """"while for 2 intersection with 3 lines that linked ===> 以多条线之间最好的%为准，调整剩余 2 个的 radius > replacement
python_script_4 = Python(IN[0]=lines_new_all_9, IN[1]=indexOf_19, IN[2]=code_block_397)  # CPython3; same code as python_script

# group (continued): adjust """RADIUS only"""" for similar lines that connect to each other define similar==> prerequisite：**2 pipes re connecting to each other, THUS, INTERSECTION PIOINT AS REFERENCE** direction angle<5degree radius difference<20mm """1 intersection == 2 lines, """"while for 2 intersection with 3 lines that linked ===> 以多条线之间最好的%为准，调整剩余 2 个的 radius > == 2 lines' pipe group 1. contains good result from the very very begainning, replacing all pipes' radius within the group by the radius from the best one 2. if NOT contains , average radius
lines_new_all_10 = Watch(python_script_4)
getItemAtIndex_164 = List.GetItemAtIndex(list=lines_new_all_10@L2, index=code_block_388)
indexOf_20 = List.IndexOf(list=getItemAtIndex_164, element=getItemAtIndex_147)

# group: adjust """RADIUS only"""" for similar lines that connect to each other define similar==> prerequisite：**2 pipes re connecting to each other, THUS, INTERSECTION PIOINT AS REFERENCE** direction angle<5degree radius difference<20mm """1 intersection == 2 lines, """"while for 2 intersection with 3 lines that linked ===> 以多条线之间最好的%为准，调整剩余 2 个的 radius > replacement
python_script_5 = Python(IN[0]=lines_new_all_10, IN[1]=indexOf_20, IN[2]=code_block_390)  # CPython3; same code as python_script

# group: split
watch_5 = Watch(python_script_5)
code_block_398 = CodeBlock { 0; 1; }
getItemAtIndex_165 = List.GetItemAtIndex(list=watch_5@L2, index=code_block_398.out0)
all_intersection_5 = Watch(all_intersection_3)  # frozen
intersect_4 = Geometry.Intersect(geometry=getItemAtIndex_165@@L1, other=all_intersection_5@L2, lacing=CrossProduct)
flatten_59 = List.Flatten(list=intersect_4@L4)
parameterAtPoint_27 = Curve.ParameterAtPoint(curve=getItemAtIndex_165@L1, point=flatten_59@L2, lacing=Longest)
splitByParameter = Curve.SplitByParameter(curve=getItemAtIndex_165@L1, parameters=parameterAtPoint_27@L2, lacing=Longest)
flatten_60 = List.Flatten(list=splitByParameter)
getItemAtIndex_166 = List.GetItemAtIndex(list=watch_5@L2, index=code_block_398.out1)
count_33 = List.Count(list=splitByParameter@L2)
ofRepeatedItem_22 = List.OfRepeatedItem(item=getItemAtIndex_166@L1, amount=count_33@@L1)
flatten_61 = List.Flatten(list=ofRepeatedItem_22)
list_create_34 = List.Create(item0=flatten_60, item1=flatten_61)
transpose_45 = List.Transpose(lists=list_create_34)
code_block_399 = CodeBlock { 0; 1; }  # frozen
eq_39 = parameterAtPoint_27@@L1 == code_block_399.out0@L1  # lacing=Longest
eq_40 = parameterAtPoint_27@@L1 == code_block_399.out1@L1  # lacing=Longest
or_7 = eq_39 || eq_40

# group: cylinder check
watch_6 = Watch(transpose_45)
code_block_400 = CodeBlock { 0; 1; }
getItemAtIndex_167 = List.GetItemAtIndex(list=watch_6@L2, index=code_block_400.out0)
startPoint_24 = Curve.StartPoint(curve=getItemAtIndex_167)
endPoint_19 = Curve.EndPoint(curve=getItemAtIndex_167)
getItemAtIndex_168 = List.GetItemAtIndex(list=watch_6@L2, index=code_block_400.out1)
byPointsRadius_6 = Cylinder.ByPointsRadius(startPoint=startPoint_24, endPoint=endPoint_19, radius=getItemAtIndex_168)

# group: export csv 2
file_path_35 = Filename(".\pipe_step2_exported_calibrated_connecion.csv")  # frozen
watch_7 = Watch(python_script_5)
code_block_401 = CodeBlock { 0; 1; }
getItemAtIndex_169 = List.GetItemAtIndex(list=watch_7@L2, index=code_block_401.out0)
startPoint_25 = Curve.StartPoint(curve=getItemAtIndex_169)
X_4 = Point.X(point=startPoint_25)
Y_4 = Point.Y(point=startPoint_25)
Z_3 = Point.Z(point=startPoint_25)
endPoint_20 = Curve.EndPoint(curve=getItemAtIndex_169)
X_5 = Point.X(point=endPoint_20)
Y_5 = Point.Y(point=endPoint_20)
Z_4 = Point.Z(point=endPoint_20)
getItemAtIndex_170 = List.GetItemAtIndex(list=watch_7@L2, index=code_block_401.out1)
list_create_35 = List.Create(item0=X_4, item1=Y_4, item2=Z_3, item3=X_5, item4=Y_5, item5=Z_4, item6=getItemAtIndex_170)
transpose_46 = List.Transpose(lists=list_create_35)
exportCSV = Data.ExportCSV(filePath=file_path_35, data=transpose_46)

# group: cylinder check
watch_8 = Watch(python_script_5)
code_block_402 = CodeBlock { 0; 1; }
getItemAtIndex_171 = List.GetItemAtIndex(list=watch_8@L2, index=code_block_402.out0)
startPoint_26 = Curve.StartPoint(curve=getItemAtIndex_171)
endPoint_21 = Curve.EndPoint(curve=getItemAtIndex_171)
getItemAtIndex_172 = List.GetItemAtIndex(list=watch_8@L2, index=code_block_402.out1)
byPointsRadius_7 = Cylinder.ByPointsRadius(startPoint=startPoint_26, endPoint=endPoint_21, radius=getItemAtIndex_172)

# group: LINES NEIGHBORING POINTS
count_34 = List.Count()  # frozen; unwired: list
ofRepeatedItem_23 = List.OfRepeatedItem(amount=count_34)  # unwired: item
getItemAtIndex_173 = List.GetItemAtIndex(list=ofRepeatedItem_23@L2)  # unwired: index
lines_6 = CodeBlock(x=lines_5)  # same code as code_block_302
firstItem_29 = List.FirstItem(list=lines_6@L2)
code_block_403 = CodeBlock()  # same code as code_block_130
getItemAtIndex_174 = List.GetItemAtIndex(list=lines_6@L2, index=code_block_403)
code_block_404 = CodeBlock(radius=getItemAtIndex_174) { radius * 0.8; }
extendStart_25 = Curve.ExtendStart(curve=firstItem_29, distance=code_block_404)
extendEnd_24 = Curve.ExtendEnd(curve=extendStart_25, distance=code_block_404)
endPoint_22 = Curve.EndPoint(curve=extendEnd_24)
startPoint_27 = Curve.StartPoint(curve=extendEnd_24)
byPointsRadius_8 = Cylinder.ByPointsRadius(startPoint=endPoint_22, endPoint=startPoint_27, radius=getItemAtIndex_174)
count_35 = List.Count(list=byPointsRadius_8)
code_block_405 = CodeBlock { true; }

# group: more intesection pointstogether with START&END
lines_7 = CodeBlock(x=lines_2)  # same code as code_block_302
firstItem_30 = List.FirstItem(list=lines_7@L2)
endPoint_23 = Curve.EndPoint(curve=firstItem_30)
startPoint_28 = Curve.StartPoint(curve=firstItem_30)
join_24 = List.Join(list0=endPoint_23, list1=startPoint_28)
code_block_406 = CodeBlock(ADJUSTED_INTERSWECTIONS=flatten_47)  # same code as code_block_350
distanceTo_30 = Geometry.DistanceTo(geometry=join_24, other=code_block_406, lacing=CrossProduct)
code_block_407 = CodeBlock { 50; }
le_18 = distanceTo_30 <= code_block_407
anyTrue_8 = List.AnyTrue(list=le_18@@L2)
filterByBoolMask_23 = List.FilterByBoolMask(list=join_24, mask=anyTrue_8)
join_25 = List.Join(list0=filterByBoolMask_23.out, list1=code_block_406)
flatten_62 = List.Flatten(list=join_25)
centerPoint_16 = Sphere.CenterPoint()  # unwired: sphere
code_block_408 = CodeBlock { 1; }
code_block_409 = CodeBlock { 2; }  # frozen
getItemAtIndex_175 = List.GetItemAtIndex(list=lines_7@L2, index=code_block_409)
code_block_410 = CodeBlock { 2; }
pow_12 = Math.Pow(number=getItemAtIndex_175, power=code_block_410)
div_6 = code_block_408 / pow_12
maximumItem_18 = List.MaximumItem(list=pow_12@@L2)
code_block_411 = CodeBlock(X=maximumItem_18) { X * 2; }
mul_4 = div_6 * code_block_411  # lacing=Longest
join_26 = List.Join(list0=mul_4, list1=mul_4)
filterByBoolMask_24 = List.FilterByBoolMask(list=join_26, mask=anyTrue_8)
byCenterPointRadius_2 = Sphere.ByCenterPointRadius(centerPoint=filterByBoolMask_23.out, radius=filterByBoolMask_24.out)
flatten_63 = List.Flatten()  # unwired: list

# group (continued): LINES NEIGHBORING POINTS
code_block_412 = CodeBlock(ADJUSTED_INTERSWECTIONS=flatten_62)  # same code as code_block_350
code_block_413 = CodeBlock(R=code_block_412)  # same code as code_block_327
byCenterPointRadius_3 = Sphere.ByCenterPointRadius(centerPoint=code_block_413)
ofRepeatedItem_24 = List.OfRepeatedItem(item=code_block_413, amount=count_35)
doesIntersect_3 = Geometry.DoesIntersect(geometry=ofRepeatedItem_24@L2, other=byPointsRadius_8@L1, lacing=Longest)
allIndicesOf_22 = List.AllIndicesOf(list=doesIntersect_3@@L2, item=code_block_405)
code_block_414 = CodeBlock(TRANSFORMED_lines=lines_6, corresponding_index=allIndicesOf_22)
# ---------- code_block_414.designscript (4 lines) ----------
TRANSFORMED_lines;
// TRANSFORMED

corresponding_index;
# ----------------------------------------

# group: CONNECTIVITY
code_block_415 = CodeBlock(TRANSFORMED_POINTS=byCenterPointRadius_3, TRANSFORMED_lines=code_block_414.TRANSFORMED_lines, CORRESPONDING_INDEX=code_block_414.corresponding_index)
# ---------- code_block_415.designscript (7 lines) ----------
TRANSFORMED_POINTS;
// IN SPHERE

TRANSFORMED_lines;
// TRANSFORMED

CORRESPONDING_INDEX;
# ----------------------------------------
code_block_416 = CodeBlock(R=code_block_415.TRANSFORMED_POINTS)  # same code as code_block_327
centerPoint_17 = Sphere.CenterPoint(sphere=code_block_415.TRANSFORMED_POINTS)
code_block_417 = CodeBlock(from_cs=code_block_358.from_cs, to_cs=code_block_358.to_cs)
# ---------- code_block_417.designscript (6 lines) ----------
//reverse
//current
from_cs;


to_cs;
# ----------------------------------------
code_block_418 = CodeBlock { 1; }
getItemAtIndex_176 = List.GetItemAtIndex(list=code_block_415.TRANSFORMED_lines@L2, index=code_block_418)
minimumItem_19 = List.MinimumItem(list=getItemAtIndex_176)
code_block_419 = CodeBlock(min_R=minimumItem_19) { x = min_R / 2; DSCore.Math.Ceiling (x); }
code_block_420 = CodeBlock(x=code_block_419.out1) { x; }
count_36 = List.Count(list=centerPoint_17)
code_block_421 = CodeBlock(x=count_36) { 0..x-1; }
code_block_422 = CodeBlock(TRANSFORMED_lines=code_block_415.TRANSFORMED_lines, CORRESPONDING_INDEX=code_block_415.CORRESPONDING_INDEX)
# ---------- code_block_422.designscript (4 lines) ----------
TRANSFORMED_lines;
// TRANSFORMED

CORRESPONDING_INDEX;
# ----------------------------------------
code_block_423 = CodeBlock(TRANSFORMED_lines=code_block_422.TRANSFORMED_lines, CORRESPONDING_INDEX=code_block_422.CORRESPONDING_INDEX)  # same code as code_block_422

# group: CONNECTIVITY > Zvalue
XYPlane_2 = CoordinateSystem.XYPlane(coordinateSystem=code_block_417.from_cs)
distanceTo_31 = Geometry.DistanceTo(geometry=centerPoint_17, other=XYPlane_2, lacing=Longest)
flatten_64 = List.Flatten(list=distanceTo_31)
code_block_424 = CodeBlock(d=flatten_64, interval=code_block_420) { DSCore.Math.Floor(d /interval); }
groupByKey_12 = List.GroupByKey(list=code_block_416, keys=code_block_424)

# group: CONNECTIVITY
centerPoint_18 = Sphere.CenterPoint(sphere=groupByKey_12.groups)
Z_5 = Point.Z(point=centerPoint_18)
code_block_425 = CodeBlock { 1; }
radius_18 = Sphere.Radius(sphere=groupByKey_12.groups)
code_block_426 = CodeBlock { 2; }  # frozen
pow_13 = Math.Pow(number=radius_18, power=code_block_426)
div_7 = code_block_425 / pow_13
maximumItem_19 = List.MaximumItem(list=pow_13@@L2)
mul_5 = div_7@L2 * maximumItem_19@@L1  # lacing=Longest
ofRepeatedItem_25 = List.OfRepeatedItem(item=Z_5@@L1, amount=mul_5@L1, lacing=Longest)
average_24 = Math.Average(numbers=Z_5@@L2)
byCoordinates_16 = Point.ByCoordinates(z=average_24)
ZAxis_11 = Vector.ZAxis()
byOriginNormal_20 = Plane.ByOriginNormal(origin=byCoordinates_16, normal=ZAxis_11)
closestPointTo_25 = Geometry.ClosestPointTo(geometry=byOriginNormal_20, other=centerPoint_18)
byTwoPoints_8 = Vector.ByTwoPoints(start=centerPoint_18, end=closestPointTo_25)
translate_11 = Geometry.Translate(geometry=groupByKey_12.groups, direction=byTwoPoints_8)

# group (continued): CONNECTIVITY
flatten_65 = List.Flatten(list=translate_11)
groupByKey_13 = List.GroupByKey(list=code_block_421, keys=code_block_424)
flatten_66 = List.Flatten(list=groupByKey_13.groups)
sortByKey_9 = List.SortByKey(list=flatten_65, keys=flatten_66)
code_block_427 = CodeBlock(calibrate_Y=sortByKey_9.sortedList) { calibrate_Y; }

# group: CONNECTIVITY > X
YZPlane_2 = CoordinateSystem.YZPlane(coordinateSystem=code_block_417.from_cs)
distanceTo_32 = Geometry.DistanceTo(geometry=code_block_427, other=YZPlane_2, lacing=Longest)
flatten_67 = List.Flatten(list=distanceTo_32)
code_block_428 = CodeBlock(d=flatten_67, interval=code_block_420) { DSCore.Math.Floor(d /interval); }
groupByKey_14 = List.GroupByKey(list=code_block_427, keys=code_block_428)

# group: CONNECTIVITY
centerPoint_19 = Sphere.CenterPoint(sphere=groupByKey_14.groups)
X_6 = Point.X(point=centerPoint_19)
code_block_429 = CodeBlock { 1; }
radius_19 = Sphere.Radius(sphere=groupByKey_14.groups)  # frozen
code_block_430 = CodeBlock { 2; }
pow_14 = Math.Pow(number=radius_19, power=code_block_430)
div_8 = code_block_429 / pow_14
maximumItem_20 = List.MaximumItem(list=pow_14@@L2)
mul_6 = div_8@L2 * maximumItem_20@@L1  # lacing=Longest
ofRepeatedItem_26 = List.OfRepeatedItem(item=X_6@@L1, amount=mul_6@L1, lacing=Longest)
average_25 = Math.Average(numbers=X_6@@L2)
byCoordinates_17 = Point.ByCoordinates(x=average_25)
XAxis_4 = Vector.XAxis()
byOriginNormal_21 = Plane.ByOriginNormal(origin=byCoordinates_17, normal=XAxis_4)
closestPointTo_26 = Geometry.ClosestPointTo(geometry=byOriginNormal_21, other=centerPoint_19)
byTwoPoints_9 = Vector.ByTwoPoints(start=centerPoint_19, end=closestPointTo_26)
translate_12 = Geometry.Translate(geometry=groupByKey_14.groups, direction=byTwoPoints_9)

# group (continued): CONNECTIVITY
flatten_68 = List.Flatten(list=translate_12)
groupByKey_15 = List.GroupByKey(list=code_block_421, keys=code_block_428)
flatten_69 = List.Flatten(list=groupByKey_15.groups)
sortByKey_10 = List.SortByKey(list=flatten_68, keys=flatten_69)
code_block_431 = CodeBlock(calibrate_Y=sortByKey_10.sortedList) { calibrate_Y; }

# group: CONNECTIVITY > Y
ZXPlane_2 = CoordinateSystem.ZXPlane(coordinateSystem=code_block_417.from_cs)
distanceTo_33 = Geometry.DistanceTo(geometry=code_block_431, other=ZXPlane_2, lacing=Longest)
flatten_70 = List.Flatten(list=distanceTo_33)
code_block_432 = CodeBlock(d=flatten_70, interval=code_block_420) { DSCore.Math.Floor(d /interval); }
groupByKey_16 = List.GroupByKey(list=code_block_431, keys=code_block_432)

# group: CONNECTIVITY
centerPoint_20 = Sphere.CenterPoint(sphere=groupByKey_16.groups)
Y_6 = Point.Y(point=centerPoint_20)
code_block_433 = CodeBlock { 1; }
radius_20 = Sphere.Radius(sphere=groupByKey_16.groups)  # frozen
code_block_434 = CodeBlock { 2; }
pow_15 = Math.Pow(number=radius_20, power=code_block_434)
div_9 = code_block_433 / pow_15
maximumItem_21 = List.MaximumItem(list=pow_15@@L2)
mul_7 = div_9@L2 * maximumItem_21@@L1  # lacing=Longest
ofRepeatedItem_27 = List.OfRepeatedItem(item=Y_6@@L1, amount=mul_7@L1, lacing=Longest)
average_26 = Math.Average(numbers=Y_6@@L2)
byCoordinates_18 = Point.ByCoordinates(y=average_26)
YAxis_3 = Vector.YAxis()
byOriginNormal_22 = Plane.ByOriginNormal(origin=byCoordinates_18, normal=YAxis_3)
closestPointTo_27 = Geometry.ClosestPointTo(geometry=byOriginNormal_22, other=centerPoint_20)
byTwoPoints_10 = Vector.ByTwoPoints(start=centerPoint_20, end=closestPointTo_27)
translate_13 = Geometry.Translate(geometry=groupByKey_16.groups, direction=byTwoPoints_10)

# group (continued): CONNECTIVITY
flatten_71 = List.Flatten(list=translate_13)
groupByKey_17 = List.GroupByKey(list=code_block_421, keys=code_block_432)
flatten_72 = List.Flatten(list=groupByKey_17.groups)
sortByKey_11 = List.SortByKey(list=flatten_71, keys=flatten_72)

# group: PRUNE POINTS
centerPoint_21 = Sphere.CenterPoint(sphere=sortByKey_11.sortedList)
pruneDuplicates_6 = Point.PruneDuplicates(points=centerPoint_21)
indexOf_21 = List.IndexOf(list=centerPoint_21, element=pruneDuplicates_6)
count_37 = List.Count(list=code_block_423.CORRESPONDING_INDEX@L3)
ofRepeatedItem_28 = List.OfRepeatedItem(item=indexOf_21@L2, amount=count_37@L1)
setIntersection_2 = List.SetIntersection(list1=ofRepeatedItem_28@L2, list2=code_block_423.CORRESPONDING_INDEX@L2)
code_block_435 = CodeBlock(TRANSFORMED_lines=code_block_423.TRANSFORMED_lines, CORRESPONDING_INDEX=setIntersection_2)  # same code as code_block_422
removeItemAtIndex_15 = List.RemoveItemAtIndex(indices=setIntersection_2@L2)  # frozen; unwired: list

code_block_436 = CodeBlock(points=pruneDuplicates_6, corresponding_index=code_block_435.CORRESPONDING_INDEX, LINE=code_block_435.TRANSFORMED_lines)
# ---------- code_block_436.designscript (6 lines) ----------
points;
// neara line
corresponding_index;

//--------------
LINE;
# ----------------------------------------
firstItem_31 = List.FirstItem(list=code_block_436.LINE@L2)
toLine_15 = Geometry.Curves.ToLine(curve=firstItem_31)
direction_18 = Line.Direction(line=toLine_15)

# group: more intesection pointstogether with START&END > POINTS VARIATION WITHIN TOLERANCE
code_block_437 = CodeBlock { 0..360..10; }
code_block_438 = CodeBlock { 2; }
centerPoint_22 = Sphere.CenterPoint(sphere=flatten_63)  # frozen
byOrigin_7 = CoordinateSystem.ByOrigin(origin=centerPoint_22)
permutations = List.Permutations()  # unwired: list, length
transpose_47 = List.Transpose(lists=permutations)
radius_21 = Sphere.Radius(sphere=flatten_63)  # frozen
code_block_439 = CodeBlock(RAEDIUS=radius_21) { RAEDIUS * 2; }
code_block_440 = CodeBlock(R=code_block_439) { 0..R..1; }
count_38 = List.Count(list=code_block_440@@L2)  # frozen
ofRepeatedItem_29 = List.OfRepeatedItem(item=transpose_47@@L3, amount=count_38@L1, lacing=Longest)
code_block_441 = CodeBlock { 0; 1; }
getItemAtIndex_177 = List.GetItemAtIndex(list=ofRepeatedItem_29@@L3, index=code_block_441.out0)
getItemAtIndex_178 = List.GetItemAtIndex(list=ofRepeatedItem_29@@L3, index=code_block_441.out1)
bySphericalCoordinates = Point.BySphericalCoordinates(coordinateSystem=byOrigin_7@L1, phi=getItemAtIndex_177@L3, theta=getItemAtIndex_178@L3, radius=code_block_440@@L1, lacing=Longest)
code_block_442 = CodeBlock { 1; }

# group (continued): more intesection pointstogether with START&END
byCenterPointRadius_4 = Sphere.ByCenterPointRadius(centerPoint=bySphericalCoordinates, radius=code_block_442)

count_39 = List.Count(list=code_block_436.corresponding_index@L3)
ofRepeatedItem_30 = List.OfRepeatedItem(item=code_block_436.points@L2, amount=count_39@L1)
getItemAtIndex_179 = List.GetItemAtIndex(list=ofRepeatedItem_30@L2, index=code_block_436.corresponding_index@@L2)
combinations_2 = List.Combinations(list=getItemAtIndex_179@@L2, length=code_block_361)
getItemAtIndex_180 = List.GetItemAtIndex(list=combinations_2@@L2, index=code_block_362.out0)
getItemAtIndex_181 = List.GetItemAtIndex(list=combinations_2@@L2, index=code_block_362.out1)
byStartPointEndPoint_11 = Line.ByStartPointEndPoint(startPoint=getItemAtIndex_180, endPoint=getItemAtIndex_181)

# group: output LINE
code_block_443 = CodeBlock { 0; }
length_8 = Curve.Length(curve=byStartPointEndPoint_11)
maximumItem_22 = List.MaximumItem(list=length_8@L2)
indexOf_22 = List.IndexOf(list=length_8@L2, element=maximumItem_22@L1)
getItemAtIndex_182 = List.GetItemAtIndex(list=byStartPointEndPoint_11@L2, index=indexOf_22@L1)
replaceItemAtIndex_10 = List.ReplaceItemAtIndex(list=code_block_436.LINE@L2, index=code_block_443, item=getItemAtIndex_182@L1)

# group: POINTS NEIGHBORING LINES 夹角check
count_40 = List.Count()  # frozen; unwired: list
code_block_444 = CodeBlock(x=count_40) { 0..x-1; }
code_block_445 = CodeBlock(ADJUSTED_INTERSWECTIONS=code_block_436.points)  # frozen; same code as code_block_350
flatten_73 = List.Flatten(list=code_block_445)
count_41 = List.Count(list=flatten_73)
ofRepeatedItem_31 = List.OfRepeatedItem(item=code_block_444, amount=count_41)
if_24 = RefactoredIf(lacing=Longest)  # unwired: test, true, false
lines_8 = CodeBlock(x=replaceItemAtIndex_10)  # same code as code_block_302
lines_9 = CodeBlock(x=lines_8)  # same code as code_block_302
firstItem_32 = List.FirstItem(list=lines_9@@L2)
ofRepeatedItem_32 = List.OfRepeatedItem(item=firstItem_32, amount=count_41)
toLine_16 = Geometry.Curves.ToLine(curve=ofRepeatedItem_32)
distanceTo_34 = Geometry.DistanceTo(geometry=flatten_73@L1, other=toLine_16@@L2, lacing=Longest)
code_block_446 = CodeBlock { 0; }
eq_41 = distanceTo_34 == code_block_446
countTrue_17 = List.CountTrue(list=eq_41@L2)
code_block_447 = CodeBlock { 2; }
eq_42 = countTrue_17 == code_block_447
code_block_448 = CodeBlock { true; }
allIndicesOf_23 = List.AllIndicesOf(list=eq_42, item=code_block_448)
getItemAtIndex_183 = List.GetItemAtIndex(list=flatten_73@@L2, index=allIndicesOf_23@L2)
getItemAtIndex_184 = List.GetItemAtIndex(list=ofRepeatedItem_32@@L3, index=allIndicesOf_23@L2)
code_block_449 = CodeBlock { true; }
allIndicesOf_24 = List.AllIndicesOf(list=eq_41@@L2, item=code_block_449)
getItemAtIndex_185 = List.GetItemAtIndex(list=allIndicesOf_24@@L3, index=allIndicesOf_23@L2)
getItemAtIndex_186 = List.GetItemAtIndex(list=getItemAtIndex_184@@L2, index=getItemAtIndex_185@L2)

# group: POINTS NEIGHBORING LINES 夹角check > 夹角check
toLine_17 = Geometry.Curves.ToLine()  # unwired: curve
code_block_450 = CodeBlock { 0.5; }
pointAtParameter_7 = Curve.PointAtParameter(curve=getItemAtIndex_186, param=code_block_450)
byTwoPoints_11 = Vector.ByTwoPoints(start=getItemAtIndex_183@L1, end=pointAtParameter_7@@L2, lacing=Longest)
code_block_451 = CodeBlock(x=byTwoPoints_11) { x[0]; }
transpose_48 = List.Transpose(lists=code_block_451)
code_block_452 = CodeBlock(x=transpose_48) { x[0]; x[1]; }
angleWithVector_16 = Vector.AngleWithVector(vector=code_block_452.out0, otherVector=code_block_452.out1)

code_block_453 = CodeBlock(POINTS=pruneDuplicates_6) { POINTS; }
code_block_454 = CodeBlock(from_cs=code_block_417.from_cs, to_cs=code_block_417.to_cs)  # same code as code_block_417

# group: OUTPUT TRANSFORM TO THE ORIGINAL CS
code_block_455 = CodeBlock(POINTS=code_block_453) { POINTS; }
code_block_456 = CodeBlock(from_cs=code_block_454.from_cs, to_cs=code_block_454.to_cs)
# ---------- code_block_456.designscript (6 lines) ----------
//reverse
//current
from_cs;

//ORIGINAL
to_cs;
# ----------------------------------------
code_block_457 = CodeBlock(OUTPUT_LINES=replaceItemAtIndex_10) { OUTPUT_LINES; }
code_block_458 = CodeBlock { 0; }
firstItem_33 = List.FirstItem(list=code_block_457@L2)
transform_3 = Geometry.Transform(geometry=firstItem_33@L2, fromCoordinateSystem=code_block_456.from_cs, contextCoordinateSystem=code_block_456.to_cs, lacing=Longest)
replaceItemAtIndex_11 = List.ReplaceItemAtIndex(list=code_block_457@L2, index=code_block_458, item=transform_3@L1)
code_block_459 = CodeBlock(OUTPUT_LINES=replaceItemAtIndex_11) { OUTPUT_LINES; }

# group: OUTPUT TRANSFORM TO THE ORIGINAL CS > POINTS NEIGHBORING LINES 夹角check
transform_4 = Geometry.Transform(geometry=code_block_455@L2, fromCoordinateSystem=code_block_456.from_cs, contextCoordinateSystem=code_block_456.to_cs, lacing=Longest)
flatten_74 = List.Flatten(list=transform_4)
firstItem_34 = List.FirstItem(list=replaceItemAtIndex_11@@L2)
count_42 = List.Count(list=flatten_74)
ofRepeatedItem_33 = List.OfRepeatedItem(item=firstItem_34, amount=count_42)
toLine_18 = Geometry.Curves.ToLine(curve=ofRepeatedItem_33)
distanceTo_35 = Geometry.DistanceTo(geometry=flatten_74@L1, other=toLine_18@@L2, lacing=Longest)
code_block_460 = CodeBlock { 0; }
eq_43 = distanceTo_35 == code_block_460
code_block_461 = CodeBlock { true; }
allIndicesOf_25 = List.AllIndicesOf(list=eq_43@@L2, item=code_block_461)
countTrue_18 = List.CountTrue(list=eq_43@L2)
code_block_462 = CodeBlock { 2; }
eq_44 = countTrue_18 == code_block_462
code_block_463 = CodeBlock { true; }
allIndicesOf_26 = List.AllIndicesOf(list=eq_44, item=code_block_463)
getItemAtIndex_187 = List.GetItemAtIndex(list=flatten_74@@L2, index=allIndicesOf_26@L2)

# group (continued): OUTPUT TRANSFORM TO THE ORIGINAL CS
code_block_464 = CodeBlock(points_intersection=getItemAtIndex_187)
# ---------- code_block_464.designscript (2 lines) ----------
// ONLY INTERSECTION
points_intersection[0];
# ----------------------------------------

# group: djust radii
exp_3 = Math.Exp()  # unwired: number
code_block_465 = CodeBlock(OUTPUT_LINES=code_block_459, points_intersection=code_block_464)
# ---------- code_block_465.designscript (4 lines) ----------
OUTPUT_LINES;

// ONLY INTERSECTION
points_intersection;
# ----------------------------------------
code_block_466 = CodeBlock { 1; }
getItemAtIndex_188 = List.GetItemAtIndex(list=code_block_465.OUTPUT_LINES@L2, index=code_block_466)
code_block_467 = CodeBlock { 5; }
code_block_468 = CodeBlock(x=getItemAtIndex_188, a=code_block_467) { DSCore.Math.Floor(x/a); }
groupByKey_18 = List.GroupByKey(list=getItemAtIndex_188, keys=code_block_468)
code_block_469 = CodeBlock { 2; }
getItemAtIndex_189 = List.GetItemAtIndex(list=code_block_465.OUTPUT_LINES@L2, index=code_block_469)
code_block_470 = CodeBlock { 2; }
pow_16 = Math.Pow(number=getItemAtIndex_189, power=code_block_470)
groupByKey_19 = List.GroupByKey(list=pow_16, keys=code_block_468)
count_43 = List.Count(list=getItemAtIndex_188)
code_block_471 = CodeBlock(x=count_43) { 0..x-1; }
groupByKey_20 = List.GroupByKey(list=code_block_471, keys=code_block_468)
code_block_472 = CodeBlock(points_intersection=code_block_465.points_intersection)
# ---------- code_block_472.designscript (2 lines) ----------
// ONLY INTERSECTION
points_intersection;
# ----------------------------------------

# group: djust radii > uniform RADII
code_block_473 = CodeBlock { 1; }
ofRepeatedItem_34 = List.OfRepeatedItem(item=groupByKey_18.groups@@L1, amount=groupByKey_19.groups@L1, lacing=Longest)
flatten_75 = List.Flatten(list=ofRepeatedItem_34@L3)
average_27 = Math.Average(numbers=flatten_75@@L2)
count_44 = List.Count(list=groupByKey_18.groups@L2)
ofRepeatedItem_35 = List.OfRepeatedItem(item=average_27@@L1, amount=count_44@L1, lacing=Longest)
flatten_76 = List.Flatten(list=ofRepeatedItem_35)
flatten_77 = List.Flatten(list=groupByKey_20.groups)
sortByKey_12 = List.SortByKey(list=flatten_76, keys=flatten_77)
round = Math.Round(number=sortByKey_12.sortedList)
replaceItemAtIndex_12 = List.ReplaceItemAtIndex(list=code_block_465.OUTPUT_LINES@L2, index=code_block_473, item=round@L1)

# group: split
code_block_474 = CodeBlock(OUTPUT_LINES=replaceItemAtIndex_12, points_intersection=code_block_472)  # same code as code_block_465
code_block_475 = CodeBlock { 0; 1; }
getItemAtIndex_190 = List.GetItemAtIndex(list=code_block_474.OUTPUT_LINES@L2, index=code_block_475.out0)
intersect_5 = Geometry.Intersect(geometry=getItemAtIndex_190@@L1, other=code_block_474.points_intersection@L2, lacing=CrossProduct)
flatten_78 = List.Flatten(list=intersect_5@L4)
splitByPoints = Curve.SplitByPoints(curve=getItemAtIndex_190@L1, points=flatten_78@L2, lacing=Longest)
flatten_79 = List.Flatten(list=splitByPoints)
getItemAtIndex_191 = List.GetItemAtIndex(list=code_block_474.OUTPUT_LINES@L2, index=code_block_475.out1)
count_45 = List.Count(list=splitByPoints@L2)
ofRepeatedItem_36 = List.OfRepeatedItem(item=getItemAtIndex_191@L1, amount=count_45@@L1)
flatten_80 = List.Flatten(list=ofRepeatedItem_36)
list_create_36 = List.Create(item0=flatten_79, item1=flatten_80)
transpose_49 = List.Transpose(lists=list_create_36)

code_block_476 = CodeBlock(lines_splitted=transpose_49) { lines_splitted; }

# group: export csv 2
file_path_36 = Filename(".\pipe_step2_exported_calibrated_connecion.csv")  # frozen
exportCSV_2 = Data.ExportCSV(filePath=file_path_36)  # unwired: data
transpose_50 = List.Transpose()  # unwired: lists
watch_9 = Watch(code_block_476)
code_block_477 = CodeBlock { 0; 1; }
getItemAtIndex_192 = List.GetItemAtIndex(list=watch_9@L2, index=code_block_477.out0)
startPoint_29 = Curve.StartPoint(curve=getItemAtIndex_192)
deconstruct_6 = WombatDynamo.Point.Deconstruct(point=startPoint_29)
endPoint_24 = Curve.EndPoint(curve=getItemAtIndex_192)
deconstruct_7 = WombatDynamo.Point.Deconstruct(point=endPoint_24)
getItemAtIndex_193 = List.GetItemAtIndex(list=watch_9@L2, index=code_block_477.out1)
list_create_37 = List.Create(item0=deconstruct_6.X, item1=deconstruct_6.Y, item2=deconstruct_6.Z, item3=deconstruct_7.X, item4=deconstruct_7.Y, item5=deconstruct_7.Z, item6=getItemAtIndex_193)

# group: export csv 2 > file
file_path_37 = Filename(".\step0.xlsx")
code_block_478 = CodeBlock { "STEP2_After_Connectivity"; }  # frozen
code_block_479 = CodeBlock { 0; 0; true; }
exportToExcel = Data.ExportToExcel(filePath=file_path_37, sheetName=code_block_478, startRow=code_block_479.out0, startColumn=code_block_479.out1, data=list_create_37, overWrite=code_block_479.out2)
