# Dynamo graph LTA PIPE_Step3_Generation_n_Fittings (29_MAY).dyn "LTA PIPE_Step3_generation_n_fittings (29_MAY)" (Dynamo 2.13.1.3887)
# packages: Gorilla17 0.0.3, MEPover 2022.1.1, bimorphNodes 4.2.1, SteamNodes 1.2.3, Genius Loci 2022.9.16, Sparrow 2021.2.1, MEPover 2022.10.30, DynaMEP 1.2.8

# group: pipe lines: ALL
importCSV = Data.ImportCSV()  # unwired: filePath
file_path = Filename(".\step0.xlsx")
file_from_path = FileObject(path=file_path)
code_block = CodeBlock { "STEP2_After_Connectivity"; }
code_block_2 = CodeBlock { false; }
importExcel = Data.ImportExcel(file=file_from_path, sheetName=code_block, showExcel=code_block_2)
code_block_3 = CodeBlock(x=importExcel)
# ---------- code_block_3.designscript (12 lines) ----------
//start point//
x[0];
x[1];
x[2];

//end point//
x[3];
x[4];
x[5];

///radius///
x[6];
# ----------------------------------------
byCoordinates = Point.ByCoordinates(x=code_block_3.out0, y=code_block_3.out1, z=code_block_3.out2)
byCoordinates_2 = Point.ByCoordinates(x=code_block_3.out3, y=code_block_3.out4, z=code_block_3.out5)
byStartPointEndPoint = Line.ByStartPointEndPoint(startPoint=byCoordinates, endPoint=byCoordinates_2)
list_create = List.Create(item0=byStartPointEndPoint, item1=code_block_3.out6)
transpose = List.Transpose(lists=list_create)
byPointsRadius = Cylinder.ByPointsRadius(startPoint=byCoordinates, endPoint=byCoordinates_2, radius=code_block_3.out6)
color_palette = ColorPalette({R: 0, G: 128, B: 128, A: 131})
byGeometryColor = Modifiers.GeometryColor.ByGeometryColor(geometry=byPointsRadius, color=color_palette)
transpose_2 = List.Transpose()  # unwired: lists

# group: curve to line (contains direcion)
watch = Watch()  # unwired: arg0
code_block_4 = CodeBlock { 0; 1; }
getItemAtIndex = List.GetItemAtIndex(list=watch@L2, index=code_block_4.out0)
startPoint = Curve.StartPoint(curve=getItemAtIndex)
endPoint = Curve.EndPoint(curve=getItemAtIndex)
byStartPointEndPoint_2 = Line.ByStartPointEndPoint(startPoint=startPoint, endPoint=endPoint)
getItemAtIndex_2 = List.GetItemAtIndex(list=watch@L2, index=code_block_4.out1)
list_create_2 = List.Create(item0=byStartPointEndPoint_2, item1=getItemAtIndex_2)
transpose_3 = List.Transpose(lists=list_create_2)

select_model_element = DSModelElementSelection()  # 1 picked in the model
select_model_element_2 = DSModelElementSelection()  # 1 picked in the model
addTee = Gorilla.MEPObjects.AddMEPFittings.AddTee(Connector2=select_model_element_2)  # unwired: Connector1, Connector3
select_model_element_3 = DSModelElementSelection()  # 1 picked in the model
select_model_element_4 = DSModelElementSelection()  # 1 picked in the model
byMEPCurves = Custom[MEPFitting.ByMEPCurves](MEPCurve1=select_model_element_3, MEPCurve2=select_model_element_4)  # package MEPover; Creates a UnionFitting or ElbowFitting by 2 MEPCurves (Ducts, Cable Trays, Pipes or Conduits). The output may not always be all the fittings created as Revit sometimes creates extra transition fittings outside of the node transactions.
addPlaceholderElbow = Gorilla.Placeholders.CreatePlaceholder.AddPlaceholderElbow()  # unwired: Placeholder1, Placeholder2
select_model_elements = DSModelElementsSelection()  # 2 picked in the model
byMEPCurves_2 = Custom[Elbow.ByMEPCurves](MEPCurves=select_model_elements)  # package MEPover; Takes in a list of MEPCurves (pipe, duct, cable tray, conduit) and will attempt to create elbows where possible. A margin can be entered for max distance between connectors

# group: cylinder
watch_2 = Watch()  # unwired: arg0
code_block_5 = CodeBlock { 0; 1; }
getItemAtIndex_3 = List.GetItemAtIndex(list=watch_2@@L2, index=code_block_5.out0)
startPoint_2 = Curve.StartPoint(curve=getItemAtIndex_3)
endPoint_2 = Curve.EndPoint(curve=getItemAtIndex_3)
getItemAtIndex_4 = List.GetItemAtIndex(list=watch_2@@L2, index=code_block_5.out1)
byPointsRadius_2 = Cylinder.ByPointsRadius(startPoint=startPoint_2, endPoint=endPoint_2, radius=getItemAtIndex_4)

# group: calibrated all extend/trim
watch_3 = Watch()  # unwired: arg0
watch_4 = Watch(watch_3)
watch_5 = Watch(watch_4)
code_block_6 = CodeBlock { 0; 1; }
getItemAtIndex_5 = List.GetItemAtIndex(list=watch_5@@L2, index=code_block_6.out1)
getItemAtIndex_6 = List.GetItemAtIndex(list=watch_5@@L2, index=code_block_6.out0)

# group: intersection points
code_block_7 = CodeBlock { 0; 1; }
getItemAtIndex_7 = List.GetItemAtIndex(list=watch_3@@L2, index=code_block_7.out0)
getItemAtIndex_8 = List.GetItemAtIndex(list=watch_3@@L2, index=code_block_7.out1)
code_block_8 = CodeBlock(radius=getItemAtIndex_8) { radius*3; }
extendEnd = Curve.ExtendEnd(curve=getItemAtIndex_7@@L1, distance=code_block_8@L1, lacing=Longest)
extendStart = Curve.ExtendStart(curve=extendEnd@@L1, distance=code_block_8@L1, lacing=Longest)
intersect = Geometry.Intersect(geometry=extendStart@@L1, other=extendStart@L2, lacing=CrossProduct)
flatten = List.Flatten(list=intersect@@L5)
string_from_object = FromObject(object=flatten)
code_block_9 = CodeBlock { "Line"; }
contains = String.Contains(string=string_from_object@@L1, searchFor=code_block_9, lacing=Longest)
boolean = BoolSelector(false)
allIndicesOf = List.AllIndicesOf(list=contains@@L2, item=boolean@L1, lacing=Longest)
getItemAtIndex_9 = List.GetItemAtIndex(list=flatten@L2, index=allIndicesOf@L2)
getItemAtIndex_10 = List.GetItemAtIndex(list=string_from_object@L2, index=allIndicesOf@L2)
uniqueItems = List.UniqueItems(list=getItemAtIndex_10@@L2)
indexOf = List.IndexOf(list=getItemAtIndex_10@@L2, element=uniqueItems@L2, lacing=Longest)
getItemAtIndex_11 = List.GetItemAtIndex(list=getItemAtIndex_9@L2, index=indexOf@L2)

# group (continued): calibrated all extend/trim
extended_lines = Watch(extendStart)
watch_6 = Watch(getItemAtIndex_11)

# group: calibrated all extend/trim > original lines start&end points
endPoint_3 = Curve.EndPoint(curve=getItemAtIndex_7)
startPoint_3 = Curve.StartPoint(curve=getItemAtIndex_7)
list_create_3 = List.Create(item0=endPoint_3, item1=startPoint_3)
transpose_4 = List.Transpose(lists=list_create_3)
flatten_2 = List.Flatten(list=transpose_4@@L3)
string_from_object_2 = FromObject(object=flatten_2)
uniqueItems_2 = List.UniqueItems(list=string_from_object_2@@L2)
indexOf_2 = List.IndexOf(list=string_from_object_2@@L2, element=uniqueItems_2@L2, lacing=Longest)
getItemAtIndex_12 = List.GetItemAtIndex(list=flatten_2@L2, index=indexOf_2@L2)

# group (continued): calibrated all extend/trim
list_create_4 = List.Create(item0=getItemAtIndex_11, item1=getItemAtIndex_12)
transpose_5 = List.Transpose(lists=list_create_4)
flatten_3 = List.Flatten(list=transpose_5@@L3)

# group: calibrated all extend/trim > trim 1: connecting lines
extended_lines_2 = Watch(extended_lines)
count = List.Count(list=getItemAtIndex_6@L2)
ofRepeatedItem = List.OfRepeatedItem(item=flatten_3@@L2, amount=count@L1, lacing=Longest)
intersect_2 = Geometry.Intersect(geometry=extended_lines_2@@L1, other=ofRepeatedItem@L2, lacing=Longest)
flatten_4 = List.Flatten(list=intersect_2@@L3)
parameterAtPoint = Curve.ParameterAtPoint(curve=extended_lines_2@@L1, point=flatten_4@L2, lacing=Longest)
minimumItem = List.MinimumItem(list=parameterAtPoint@@L2)
maximumItem = List.MaximumItem(list=parameterAtPoint@@L2)
trimByParameter = Curve.TrimByParameter(curve=extended_lines_2, startParameter=minimumItem, endParameter=maximumItem)

# group: calibrated all extend/trim > trim 2: by inspecting distance from intersection points to end points <= radius
radius = Watch(getItemAtIndex_5)
radius_2 = Watch(radius)
watch_7 = Watch(trimByParameter)
watch_8 = Watch(watch_7)
code_block_10 = CodeBlock { [0,1]; }
count_2 = List.Count(list=watch_7@L2)
ofRepeatedItem_2 = List.OfRepeatedItem(item=watch_6@@L2, amount=count_2@L1, lacing=Longest)
intersect_3 = Geometry.Intersect(geometry=watch_7@@L1, other=ofRepeatedItem_2@L2, lacing=Longest)
flatten_5 = List.Flatten(list=intersect_3@@L3)
endPoint_4 = Curve.EndPoint(curve=watch_7)
startPoint_4 = Curve.StartPoint(curve=watch_7)
addItemToEnd = List.AddItemToEnd(item=endPoint_4@@L1, list=startPoint_4@L1, lacing=Longest)
count_3 = List.Count(list=flatten_5@L2)
ofRepeatedItem_3 = List.OfRepeatedItem(item=addItemToEnd@@L2, amount=count_3@L1, lacing=Longest)
distanceTo = Geometry.DistanceTo(geometry=flatten_5@@L1, other=ofRepeatedItem_3@L2, lacing=Longest)
minimumItem_2 = List.MinimumItem(list=distanceTo@@L2)
maximumItem_2 = List.MaximumItem(list=radius@L2)
code_block_11 = CodeBlock(max_radius=maximumItem_2) { max_radius*1.2; }
le = minimumItem_2@L3 <= code_block_11@@L1  # lacing=Longest
allFalse = List.AllFalse(list=le@@L2)
boolean_2 = BoolSelector(true)
allIndicesOf_2 = List.AllIndicesOf(list=allFalse@@L2, item=boolean_2@L1, lacing=Longest)
count_4 = List.Count(list=allIndicesOf_2@@L2)
ofRepeatedItem_4 = List.OfRepeatedItem(item=code_block_10@L2, amount=count_4, lacing=Longest)
parameterAtPoint_2 = Curve.ParameterAtPoint(curve=watch_7@@L1, point=flatten_5@L2, lacing=Longest)
filterByBoolMask = List.FilterByBoolMask(list=parameterAtPoint_2@@L2, mask=le@L2, lacing=Longest)
watch_9 = Watch(filterByBoolMask.in)
anyTrue = List.AnyTrue(list=le@@L2)
boolean_3 = BoolSelector(true)
allIndicesOf_3 = List.AllIndicesOf(list=anyTrue@@L2, item=boolean_3@L1, lacing=Longest)
getItemAtIndex_13 = List.GetItemAtIndex(list=watch_9@L3, index=allIndicesOf_3@@L2, lacing=Longest)
addItemToEnd_2 = List.AddItemToEnd(item=ofRepeatedItem_4@L3, list=getItemAtIndex_13@@L3, lacing=Longest)
boolean_4 = BoolSelector(false)
clean = List.Clean(list=addItemToEnd_2, preserveIndices=boolean_4)
flatten_6 = List.Flatten(list=clean@@L3)
flatten_7 = List.Flatten(list=flatten_6@@L3)
count_5 = List.Count(list=ofRepeatedItem_4@@L2)
count_6 = List.Count(list=getItemAtIndex_13@@L2)
addItemToEnd_3 = List.AddItemToEnd(item=count_5@L2, list=count_6@L2, lacing=Longest)
boolean_5 = BoolSelector(false)
clean_2 = List.Clean(list=addItemToEnd_3, preserveIndices=boolean_5)
flatten_8 = List.Flatten(list=clean_2@L3)
chop = List.Chop(list=flatten_7@@L2, lengths=flatten_8@L2, lacing=Longest)
addItemToEnd_4 = List.AddItemToEnd(item=allIndicesOf_2@L2, list=allIndicesOf_3@L2, lacing=Longest)
flatten_9 = List.Flatten(list=addItemToEnd_4@L3)
sortByKey = List.SortByKey(list=chop@@L3, keys=flatten_9@L2, lacing=Longest)
watch_10 = Watch(sortByKey.sortedList)
minimumItem_3 = List.MinimumItem(list=watch_10@@L2)
code_block_12 = CodeBlock { 0.2; }
ge = minimumItem_3 >= code_block_12
code_block_13 = CodeBlock { 0; }
if_ = RefactoredIf(test=ge@@L1, true=code_block_13@L1, false=minimumItem_3@L1, lacing=Longest)
maximumItem_3 = List.MaximumItem(list=watch_10@@L2)
code_block_14 = CodeBlock { 0.8; }
le_2 = maximumItem_3 <= code_block_14
code_block_15 = CodeBlock { 1; }
if_2 = RefactoredIf(test=le_2@@L1, true=code_block_15@L1, false=maximumItem_3@L1, lacing=Longest)
trimByParameter_2 = Curve.TrimByParameter(curve=watch_8@@L1, startParameter=if_@L1, endParameter=if_2@L1, lacing=Longest)

# group (continued): calibrated all extend/trim
addItemToEnd_5 = List.AddItemToEnd(item=radius_2@L1, list=trimByParameter_2@@L1, lacing=Longest)

# group: split
watch_11 = Watch()  # unwired: arg0
watch_12 = Watch(watch_11)
code_block_16 = CodeBlock { 0; 1; }
getItemAtIndex_14 = List.GetItemAtIndex(list=watch_12@@L2, index=code_block_16.out0)
count_7 = List.Count(list=watch_12@L3)
getItemAtIndex_15 = List.GetItemAtIndex(list=watch_12@@L2, index=code_block_16.out1)
code_block_17 = CodeBlock { 0; }

# group: split > intersection points
all = Watch(watch_11)
code_block_18 = CodeBlock { 0; 1; }
getItemAtIndex_16 = List.GetItemAtIndex(list=all@@L2, index=code_block_18.out0)
getItemAtIndex_17 = List.GetItemAtIndex(list=all@@L2, index=code_block_18.out1)
code_block_19 = CodeBlock(radius=getItemAtIndex_17) { radius*3; }
extendEnd_2 = Curve.ExtendEnd(curve=getItemAtIndex_16@@L1, distance=code_block_19@L1, lacing=Longest)
extendStart_2 = Curve.ExtendStart(curve=extendEnd_2@@L1, distance=code_block_19@L1, lacing=Longest)
intersect_4 = Geometry.Intersect(geometry=extendStart_2@@L1, other=extendStart_2@L2, lacing=CrossProduct)
flatten_10 = List.Flatten(list=intersect_4@@L5)
string_from_object_3 = FromObject(object=flatten_10)
code_block_20 = CodeBlock { "Line"; }
contains_2 = String.Contains(string=string_from_object_3@@L1, searchFor=code_block_20, lacing=Longest)
boolean_6 = BoolSelector(false)
allIndicesOf_4 = List.AllIndicesOf(list=contains_2@@L2, item=boolean_6@L1, lacing=Longest)
getItemAtIndex_18 = List.GetItemAtIndex(list=flatten_10@L2, index=allIndicesOf_4@L2)
getItemAtIndex_19 = List.GetItemAtIndex(list=string_from_object_3@L2, index=allIndicesOf_4@L2)
uniqueItems_3 = List.UniqueItems(list=getItemAtIndex_19@@L2)
indexOf_3 = List.IndexOf(list=getItemAtIndex_19@@L2, element=uniqueItems_3@L2, lacing=Longest)
getItemAtIndex_20 = List.GetItemAtIndex(list=getItemAtIndex_18@L2, index=indexOf_3@L2)

# group (continued): split
ofRepeatedItem_5 = List.OfRepeatedItem(item=getItemAtIndex_20@L2, amount=count_7@L1, lacing=Longest)
intersect_5 = Geometry.Intersect(geometry=getItemAtIndex_14@@L1, other=ofRepeatedItem_5@L2, lacing=Longest)
flatten_11 = List.Flatten(list=intersect_5@@L3)
parameterAtPoint_3 = Curve.ParameterAtPoint(curve=getItemAtIndex_14@@L1, point=flatten_11@L2, lacing=Longest)  # frozen
splitByPoints = Curve.SplitByPoints(curve=getItemAtIndex_14@@L1, points=flatten_11@L2, lacing=Longest)
count_8 = List.Count(list=splitByPoints@@L2)
ofRepeatedItem_6 = List.OfRepeatedItem(item=getItemAtIndex_15@@L1, amount=count_8@L1, lacing=Longest)
round = Math.Round(number=ofRepeatedItem_6)
flatten_12 = List.Flatten(list=splitByPoints@@L3)
offset = Curve.Offset(curve=flatten_12, distance=code_block_17)
addItemToEnd_6 = List.AddItemToEnd(item=round@L1, list=offset@@L1, lacing=Longest)
code_block_21 = CodeBlock(x=addItemToEnd_6) { x[0]; }
watch_13 = Watch(code_block_21)

# group: split > line to curve
watch_14 = Watch(code_block_21)  # frozen
code_block_22 = CodeBlock { 0; 1; }
getItemAtIndex_21 = List.GetItemAtIndex(list=watch_14@@L2, index=code_block_22.out1)
getItemAtIndex_22 = List.GetItemAtIndex(list=watch_14@@L2, index=code_block_22.out0)
trimByParameter_3 = Curve.TrimByParameter(curve=getItemAtIndex_22)
addItemToEnd_7 = List.AddItemToEnd(item=getItemAtIndex_21@L1, list=trimByParameter_3@@L1, lacing=Longest)
watch_15 = Watch(addItemToEnd_7)

string = StringInput("Diameter")
number = DoubleInput(61)
setParameterByName = Element.SetParameterByName(parameterName=string, value=number)  # unwired: element
select_model_element_5 = DSModelElementSelection()  # 1 picked in the model
by2MEPCurves = Custom[Tee.By2MEPCurves]()  # package MEPover; Creates a tee by a main curve and a branch MEP curve (duct, pipe, conduit, cable tray). Only works with perpendicular brand curves; unwired: Main_MEPCurve, Branch_MEPCurve
select_model_element_6 = DSModelElementSelection()  # 1 picked in the model
by3MEPCurves = Custom[Tee.By3MEPCurves](Main_MEPCurve_2=select_model_element_2, Branch_MEPCurve=select_model_element_6)  # package MEPover; Creates a new Tee fitting for the 3 input MEP curves (conduit, cable tray, duct or pipe). Only works with a perpendicular branch MEPCurve; unwired: Main_MEPCurve
select_model_elements_2 = DSModelElementsSelection()  # 12 picked in the model

# group: intersect lines ==> 3 lines==tee; 2lines==elbow > set param
code_block_23 = CodeBlock { all_generated_pipes(placedholder); Diameter; }  # unwired: placedholder, Diameter
string_2 = StringInput("Diameter")
setParameterByName_2 = Element.SetParameterByName(parameterName=string_2, lacing=Longest)  # unwired: element, value
convertPipePlaceholders = Gorilla.Placeholders.ConvertPlaceholder.ConvertPipePlaceholders(pipePlaceholders=setParameterByName_2)

# group: Pipe from curve+Radius ！！！generate pipe after splitting！！！ > creating pipes
watch_16 = Watch(transpose)
code_block_24 = CodeBlock { 0; }
getItemAtIndex_23 = List.GetItemAtIndex(list=watch_16@L2, index=code_block_24)
element_classes = ElementTypes("PipeType")
all_elements_of_class = ElementsOfType(element_class=element_classes)
element_classes_2 = ElementTypes("PipingSystemType")
all_elements_of_class_2 = ElementsOfType(element_class=element_classes_2)
code_block_25 = CodeBlock(a=all_elements_of_class, b=all_elements_of_class_2) { a[0]; b[0]; }
levels = Levels("Level 0")
code_block_26 = CodeBlock { 1; }
getItemAtIndex_24 = List.GetItemAtIndex(list=watch_16@L2, index=code_block_26)
radius_2_diameter = CodeBlock(x=getItemAtIndex_24) { x*2; }

# group: Pipe from curve+Radius ！！！generate pipe after splitting！！！ > delete pipe elements in the location
element_classes_3 = ElementTypes("Pipe")
all_elements_of_class_3 = ElementsOfType(element_class=element_classes_3)
getLocation = Element.GetLocation(element=all_elements_of_class_3)
count_9 = List.Count(list=getLocation@L2)
ofRepeatedItem_7 = List.OfRepeatedItem(item=getItemAtIndex_23@L2, amount=count_9)
intersect_6 = Geometry.Intersect(geometry=getLocation@@L1, other=ofRepeatedItem_7@L2, lacing=Longest)
flatten_13 = List.Flatten(list=intersect_6@@L3)
string_from_object_4 = FromObject(object=flatten_13)
code_block_27 = CodeBlock { "Line"; }
contains_3 = String.Contains(string=string_from_object_4@@L2, searchFor=code_block_27)
boolean_7 = BoolSelector(true)
allIndicesOf_5 = List.AllIndicesOf(list=contains_3@@L2, item=boolean_7@L1, lacing=Longest)
getItemAtIndex_25 = List.GetItemAtIndex(list=flatten_13@L2, index=allIndicesOf_5@L2)
doesIntersect = Geometry.DoesIntersect(geometry=getItemAtIndex_25@L1, other=getLocation@L2, lacing=Longest)
boolean_8 = BoolSelector(true)
allIndicesOf_6 = List.AllIndicesOf(list=doesIntersect@@L2, item=boolean_8@L1, lacing=Longest)
getItemAtIndex_26 = List.GetItemAtIndex(list=all_elements_of_class_3@L2, index=allIndicesOf_6@L1, lacing=Longest)
delete = Element.Delete(element=getItemAtIndex_26@L2, lacing=Longest)

# group: Pipe from curve+Radius ！！！generate pipe after splitting！！！ > cylinder
watch_17 = Watch(transpose)
code_block_28 = CodeBlock { 0; 1; }
getItemAtIndex_27 = List.GetItemAtIndex(list=watch_17@@L2, index=code_block_28.out0)
startPoint_5 = Curve.StartPoint(curve=getItemAtIndex_27)
endPoint_5 = Curve.EndPoint(curve=getItemAtIndex_27)
getItemAtIndex_28 = List.GetItemAtIndex(list=watch_17@@L2, index=code_block_28.out1)
byPointsRadius_3 = Cylinder.ByPointsRadius(startPoint=startPoint_5, endPoint=endPoint_5, radius=getItemAtIndex_28)

# group: Pipe from curve+Radius ！！！generate pipe after splitting！！！ > delete fittings
categories = Categories("OST_PipeFitting")
all_elements_of_category = ElementsOfCategory(Category=categories)
getLocation_2 = Element.GetLocation(element=all_elements_of_category)
count_10 = List.Count(list=getLocation_2@L2)
ofRepeatedItem_8 = List.OfRepeatedItem(item=byPointsRadius_3@L2, amount=count_10)
doesIntersect_2 = Geometry.DoesIntersect(geometry=getLocation_2@@L1, other=ofRepeatedItem_8@L2, lacing=Longest)
anyTrue_2 = List.AnyTrue(list=doesIntersect_2@L2)
boolean_9 = BoolSelector(true)
allIndicesOf_7 = List.AllIndicesOf(list=anyTrue_2@@L2, item=boolean_9@L1, lacing=Longest)
getItemAtIndex_29 = List.GetItemAtIndex(list=all_elements_of_category@L2, index=allIndicesOf_7@L2, lacing=Longest)
delete_2 = Element.Delete(element=getItemAtIndex_29@L2, lacing=Longest)
geometry = Element.Geometry(element=all_elements_of_category)

# group: Pipe from curve+Radius ！！！generate pipe after splitting！！！
code_block_29 = CodeBlock(PassthroughWaitfor=delete_2) { PassthroughWaitfor; }
code_block_30 = CodeBlock(passthrough=delete, waitfor=code_block_29) { [passthrough,waitfor][0]; }
code_block_31 = CodeBlock(PassthroughWaitfor=code_block_30) { PassthroughWaitfor; }

# group (continued): Pipe from curve+Radius ！！！generate pipe after splitting！！！ > creating pipes
code_block_32 = CodeBlock(passthrough=getItemAtIndex_23, waitfor=code_block_31) { [passthrough,waitfor][0]; }
byLines = Custom[Pipe.ByLines](Lines=code_block_32, PipeType=code_block_25.out0, SystemType=code_block_25.out1, level=levels, Diameter=radius_2_diameter, lacing=Longest)  # package MEPover; Creates a pipe by Line, PipeType, SystemType, Level and Diameter

# group (continued): Pipe from curve+Radius ！！！generate pipe after splitting！！！
watch_18 = Watch(byLines)
elementType = Revit.LinkElement.ElementType(linkElement=byLines)
typeName = Custom[Element.TypeName](Element=byLines)  # package SteamNodes; Get Type Name as string

# group: Pipe from curve+Radius ！！！generate pipe after splitting！！！ > ROUTING PREFERENCE
id = Element.Id(element=byLines)
flatten_14 = List.Flatten(list=id)
python_script = Python(IN[0]=flatten_14)  # IronPython2
# ---------- python_script.python (48 lines) ----------
# Import the required libraries
import clr

clr.AddReference('ProtoGeometry')
from Autodesk.DesignScript.Geometry import *

clr.AddReference('RevitAPI')
import Autodesk
from Autodesk.Revit.DB import *

pipe_ids = IN[0]
# Define the function to set the routing preference for specific pipes
def set_pipe_routing_preference(pipe_ids):
    # Start a transaction in the Revit database
    doc = DocumentManager.Instance.CurrentDBDocument
    t = Transaction(doc, 'Edit Pipe Routing Preference')
    t.Start()
    
    # Loop through each pipe ID
    for pipe_id in pipe_ids:
        # Get the pipe element from the Revit model
        pipe = doc.GetElement(ElementId(pipe_id))
        
        # Check the pipe type
        if isinstance(pipe, Autodesk.Revit.DB.Pipe):
            # Get the fittings of the current pipe
            fittings = pipe.Fittings
            
            # Loop through each fitting
            for fitting in fittings:
                # Check if the current fitting is a pipe elbow
                if isinstance(fitting, Autodesk.Revit.DB.PipeElbow):
                    # Set the routing preference of the current pipe elbow to 'Bend - Plain - CI: Standard'
                    fitting.get_Parameter(BuiltInParameter.ROUTING_PREF_PIPE_ELBOW).Set("Bend - Plain - CI: Standard")
                
                # Check if the current fitting is a pipe tee
                if isinstance(fitting, Autodesk.Revit.DB.PipeTee):
                    # Set the routing preference of the current pipe tee to 'Branch 90 Deg - Plain - CI: Standard'
                    fitting.get_Parameter(BuiltInParameter.ROUTING_PREF_PIPE_TEE).Set("Branch 90 Deg - Plain - CI: Standard")
    
    # Commit the transaction to save the changes
    t.Commit()

# Example input: a list of element IDs of pipes
# pipe_ids = [12345, 67890, 11111]

# Call the function to set the routing preference for specific pipes
#set_pipe_routing_preference(pipe_ids)
# ----------------------------------------

code_block_33 = CodeBlock(passthrough=watch_18, waitfor=python_script) { [passthrough,waitfor][0]; }
code_block_34 = CodeBlock(passthrough=transpose, waitfor=code_block_33) { [passthrough,waitfor][0]; }
watch_19 = Watch(code_block_34)

# group: intersect lines ==> 3 lines==tee; 2lines==elbow > intersection points
watch_20 = Watch(watch_19)
code_block_35 = CodeBlock { 0; 1; }
getItemAtIndex_30 = List.GetItemAtIndex(list=watch_20@@L2, index=code_block_35.out0)
getItemAtIndex_31 = List.GetItemAtIndex(list=watch_20@@L2, index=code_block_35.out1)
code_block_36 = CodeBlock(radius=getItemAtIndex_31) { radius*3; }
extendEnd_3 = Curve.ExtendEnd(curve=getItemAtIndex_30@@L1, distance=code_block_36@L1, lacing=Longest)
extendStart_3 = Curve.ExtendStart(curve=extendEnd_3@@L1, distance=code_block_36@L1, lacing=Longest)
intersect_7 = Geometry.Intersect(geometry=extendStart_3@@L1, other=extendStart_3@L2, lacing=CrossProduct)
flatten_15 = List.Flatten(list=intersect_7@@L5)
string_from_object_5 = FromObject(object=flatten_15)
code_block_37 = CodeBlock { "Line"; }
contains_4 = String.Contains(string=string_from_object_5@@L1, searchFor=code_block_37, lacing=Longest)
boolean_10 = BoolSelector(false)
allIndicesOf_8 = List.AllIndicesOf(list=contains_4@@L2, item=boolean_10@L1, lacing=Longest)
getItemAtIndex_32 = List.GetItemAtIndex(list=flatten_15@L2, index=allIndicesOf_8@L2)
getItemAtIndex_33 = List.GetItemAtIndex(list=string_from_object_5@L2, index=allIndicesOf_8@L2)
uniqueItems_4 = List.UniqueItems(list=getItemAtIndex_33@@L2)
indexOf_4 = List.IndexOf(list=getItemAtIndex_33@@L2, element=uniqueItems_4@L2, lacing=Longest)
getItemAtIndex_34 = List.GetItemAtIndex(list=getItemAtIndex_32@L2, index=indexOf_4@L2)
watch_21 = Watch(watch_20)

# group: intersect lines ==> 3 lines==tee; 2lines==elbow > CHECK INTERSECTION
watch_22 = Watch(watch_21)
code_block_38 = CodeBlock { 0; 1; }
getItemAtIndex_35 = List.GetItemAtIndex(list=watch_22@@L2, index=code_block_38.out0)
count_11 = List.Count(list=getItemAtIndex_34@L2)
ofRepeatedItem_9 = List.OfRepeatedItem(item=getItemAtIndex_35@L2, amount=count_11@L1)
intersect_8 = Geometry.Intersect(geometry=getItemAtIndex_34@L1, other=ofRepeatedItem_9@L2, lacing=Longest)  # frozen
flatten_16 = List.Flatten(list=intersect_8@L3)
doesIntersect_3 = Geometry.DoesIntersect(geometry=getItemAtIndex_34@L1, other=ofRepeatedItem_9@L2, lacing=Longest)
boolean_11 = BoolSelector(true)
allIndicesOf_9 = List.AllIndicesOf(list=doesIntersect_3@L2, item=boolean_11)
getItemAtIndex_36 = List.GetItemAtIndex(list=ofRepeatedItem_9@L2, index=allIndicesOf_9@L2, lacing=Longest)
code_block_39 = CodeBlock { -10; }
extendStart_4 = Curve.ExtendStart(curve=getItemAtIndex_36, distance=code_block_39)
extendEnd_4 = Curve.ExtendEnd(curve=extendStart_4, distance=code_block_39)
getItemAtIndex_37 = List.GetItemAtIndex(list=watch_22@@L2, index=code_block_38.out1)
ofRepeatedItem_10 = List.OfRepeatedItem(item=getItemAtIndex_37@L2, amount=count_11@L1)
getItemAtIndex_38 = List.GetItemAtIndex(list=ofRepeatedItem_10@L2, index=allIndicesOf_9@L2, lacing=Longest)

# group: intersect lines ==> 3 lines==tee; 2lines==elbow
element_classes_4 = ElementTypes("Pipe")
code_block_40 = CodeBlock(passthrough=element_classes_4) { [passthrough,waitfor][0]; }  # frozen; unwired: waitfor
code_block_41 = CodeBlock(passthrough=element_classes_4, waitfor=watch_19) { [passthrough,waitfor][0]; }
all_elements_of_class_4 = ElementsOfType(element_class=code_block_41)
elementType_2 = Revit.LinkElement.ElementType(linkElement=all_elements_of_class_4)
select_model_elements_3 = DSModelElementsSelection()  # nothing selected; frozen
getLocation_3 = Element.GetLocation(element=all_elements_of_class_4)
get_routingpreferences = Custom[Get RoutingPreferences](elementOrElementType=all_elements_of_class_4@L1, lacing=Longest)  # package Genius Loci; Obtains the routing preferences of the given duct or pipe. By Cyril Poupin on Dynamo Forum
select_model_elements_by = DSModelElementsByCategorySelection()  # "Select Model Elements By Category"; nothing selected; nothing selected
element_classes_5 = ElementTypes("Pipe")
all_elements_of_class_5 = ElementsOfType(element_class=element_classes_5)
watch_23 = Watch(all_elements_of_class_4)
count_12 = List.Count(list=extendEnd_4@L2)
ofRepeatedItem_11 = List.OfRepeatedItem(item=watch_23@L2, amount=count_12@@L1, lacing=Longest)  # frozen
getLocation_4 = Element.GetLocation(element=watch_23)
ofRepeatedItem_12 = List.OfRepeatedItem(item=getLocation_4@L2, amount=count_12@@L1, lacing=Longest)
doesIntersect_4 = Geometry.DoesIntersect(geometry=extendEnd_4@@L1, other=ofRepeatedItem_12@L2, lacing=Longest)
boolean_12 = BoolSelector(true)
allIndicesOf_10 = List.AllIndicesOf(list=doesIntersect_4@@L2, item=boolean_12@L1, lacing=Longest)
flatten_17 = List.Flatten(list=allIndicesOf_10@L3)
getItemAtIndex_39 = List.GetItemAtIndex(list=watch_23@L2, index=flatten_17@L2, lacing=Longest)
count_13 = List.Count(list=flatten_17@L2)
code_block_42 = CodeBlock { 3; }
eq = count_13 == code_block_42
filterByBoolMask_2 = List.FilterByBoolMask(list=getItemAtIndex_39, mask=eq)
filterByBoolMask_3 = List.FilterByBoolMask(list=getItemAtIndex_38, mask=eq)

# group: intersect lines ==> 3 lines==tee; 2lines==elbow > check sequence
intersect_9 = Geometry.Intersect()  # unwired: geometry, other
code_block_43 = CodeBlock { -10; }
extendStart_5 = Curve.ExtendStart(curve=getLocation_3, distance=code_block_43)
extendEnd_5 = Curve.ExtendEnd(curve=extendStart_5, distance=code_block_43)
code_block_44 = CodeBlock(line=watch_19) { line; }  # frozen
code_block_45 = CodeBlock { 0; 1; }
getItemAtIndex_40 = List.GetItemAtIndex(list=code_block_44@L2, index=code_block_45.out0)
code_block_46 = CodeBlock(line=getItemAtIndex_40) { line; }
count_14 = List.Count(list=extendEnd_5)
ofRepeatedItem_13 = List.OfRepeatedItem(item=code_block_46@L2, amount=count_14)
doesIntersect_5 = Geometry.DoesIntersect(geometry=extendEnd_5@L1, other=ofRepeatedItem_13@L2, lacing=Longest)
boolean_13 = BoolSelector(true)
allIndicesOf_11 = List.AllIndicesOf(list=doesIntersect_5@L2, item=boolean_13, lacing=Longest)
flatten_18 = List.Flatten(list=allIndicesOf_11)
getItemAtIndex_41 = List.GetItemAtIndex(list=code_block_44@L2, index=code_block_45.out1)
radius_2_diameter_2 = CodeBlock(x=getItemAtIndex_41) { x*2; }

# group (continued): intersect lines ==> 3 lines==tee; 2lines==elbow
sortByKey_2 = List.SortByKey(list=select_model_elements_3, keys=flatten_18)
watch_24 = Watch(sortByKey_2.sortedList)

# group: intersect lines ==> 3 lines==tee; 2lines==elbow > TEE/ELBOW
TEE_ELEMENTS = Watch(filterByBoolMask_2.in)
TEE_RADIUS = Watch(filterByBoolMask_3.in)
ELBOW_ELEMENTS = Watch(filterByBoolMask_2.out)
ELBOW_RADIUS = Watch(filterByBoolMask_3.out)

# group: ATTACH FITTINGS > TEE
code_block_47 = CodeBlock(TEE_PIPES=TEE_ELEMENTS, TEE_RADIUS=TEE_RADIUS) { TEE_PIPES; TEE_RADIUS; }
sortByKey_3 = List.SortByKey(list=code_block_47.TEE_PIPES@L2, keys=code_block_47.TEE_RADIUS@L2)
code_block_48 = CodeBlock()
# ---------- code_block_48.designscript (4 lines) ----------
//MAIN*2
1;

2;
# ----------------------------------------
getItemAtIndex_42 = List.GetItemAtIndex(list=sortByKey_3.sortedList@L2, index=code_block_48.out0)
getItemAtIndex_43 = List.GetItemAtIndex(list=sortByKey_3.sortedList@L2, index=code_block_48.out1)
code_block_49 = CodeBlock()
# ---------- code_block_49.designscript (2 lines) ----------
//BRFACH*1
0;
# ----------------------------------------
getItemAtIndex_44 = List.GetItemAtIndex(list=sortByKey_3.sortedList@L2, index=code_block_49)
by3MEPCurves_2 = Custom[Tee.By3MEPCurves](Main_MEPCurve=getItemAtIndex_42, Main_MEPCurve_2=getItemAtIndex_43, Branch_MEPCurve=getItemAtIndex_44)

# group: ATTACH FITTINGS > ELBOW
code_block_50 = CodeBlock(ELBOW_PIPES=ELBOW_ELEMENTS, ELBOW_RADIUS=ELBOW_RADIUS) { ELBOW_PIPES; ELBOW_RADIUS; }
code_block_51 = CodeBlock { 0; 1; }
getItemAtIndex_45 = List.GetItemAtIndex(list=code_block_50.ELBOW_PIPES@L2, index=code_block_51.out0)
getItemAtIndex_46 = List.GetItemAtIndex(list=code_block_50.ELBOW_PIPES@L2, index=code_block_51.out1)
byMEPCurves_3 = Custom[MEPFitting.ByMEPCurves](MEPCurve1=getItemAtIndex_45, MEPCurve2=getItemAtIndex_46)

# group: all intersect points (result might not contains single lines) grouping (lines & points) by their connection relationship
watch_25 = Watch()  # unwired: arg0
code_block_52 = CodeBlock { 0; }
getItemAtIndex_47 = List.GetItemAtIndex(list=watch_25@L2, index=code_block_52)
count_15 = List.Count(list=getItemAtIndex_47)
code_block_53 = CodeBlock(x=count_15) { 0..x-1; }
removeItemAtIndex = List.RemoveItemAtIndex(list=getItemAtIndex_47@@L2, indices=code_block_53, lacing=CrossProduct)
intersect_10 = Geometry.Intersect(geometry=getItemAtIndex_47@L1, other=removeItemAtIndex@@L2, lacing=Longest)

# group: all intersect points (result might not contains single lines) grouping (lines & points) by their connection relationship > list == line intersection on line
flatten_19 = List.Flatten(list=intersect_10@L3)

# group (continued): all intersect points (result might not contains single lines) grouping (lines & points) by their connection relationship
flatten_20 = List.Flatten(list=flatten_19)

# group: all intersect points (result might not contains single lines) grouping (lines & points) by their connection relationship > unique item: intersect points 不然一个位置会有>= 2 个points
string_from_object_6 = FromObject(object=flatten_20)
uniqueItems_5 = List.UniqueItems(list=string_from_object_6@L2)
indexOf_5 = List.IndexOf(list=string_from_object_6@L2, element=uniqueItems_5@L1, lacing=CrossProduct)

# group: all intersect points (result might not contains single lines) grouping (lines & points) by their connection relationship > intersection all
getItemAtIndex_48 = List.GetItemAtIndex(list=flatten_20, index=indexOf_5)
flatten_21 = List.Flatten(list=getItemAtIndex_48)

# group: all intersect points (result might not contains single lines) grouping (lines & points) by their connection relationship > split grouping lines & points recover to long curves
watch_26 = Watch(watch_25)
code_block_54 = CodeBlock { 0; }
getItemAtIndex_49 = List.GetItemAtIndex(list=watch_25@L2, index=code_block_54)
intersect_11 = Geometry.Intersect(geometry=getItemAtIndex_49@L1, lacing=CrossProduct)  # unwired: other
flatten_22 = List.Flatten(list=intersect_11@L4)
splitByPoints_2 = Curve.SplitByPoints(curve=getItemAtIndex_49@L1, points=flatten_22@L2, lacing=Longest)
count_16 = List.Count(list=splitByPoints_2@L3)
code_block_55 = CodeBlock(x=count_16) { 0..x-1; }
count_17 = List.Count(list=splitByPoints_2@L2)
ofRepeatedItem_14 = List.OfRepeatedItem(item=code_block_55@L1, amount=count_17@L1, lacing=Longest)
flatten_23 = List.Flatten(list=ofRepeatedItem_14)
flatten_24 = List.Flatten(list=splitByPoints_2)
curves_groupLoops = Custom[curves_groupLoops](curves=flatten_24)  # package Sparrow; This node takes a list of curves and groups them into subsists of curves that form continuous loops. The output is polycurves ordered by distance, starting with the longest.
indexOf_6 = List.IndexOf(list=flatten_24, element=curves_groupLoops)
getItemAtIndex_50 = List.GetItemAtIndex(list=flatten_23, index=indexOf_6)
uniqueItems_6 = List.UniqueItems(list=getItemAtIndex_50@L2)
getItemAtIndex_51 = List.GetItemAtIndex(list=watch_26@L3, index=uniqueItems_6@@L2, lacing=Longest)
groupByKey = List.GroupByKey(list=curves_groupLoops@@L2, keys=getItemAtIndex_50@L2)  # frozen
grouped_lines_splitted = Watch(groupByKey.groups)

# group: Pipe from Line+Radius
element_classes_6 = ElementTypes("PipeType")
all_elements_of_class_6 = ElementsOfType(element_class=element_classes_6)
element_classes_7 = ElementTypes("PipingSystemType")
all_elements_of_class_7 = ElementsOfType(element_class=element_classes_7)
code_block_56 = CodeBlock(standard_pipeType=all_elements_of_class_6, b=all_elements_of_class_7) { standard_pipeType[2]; b[0]; }
levels_2 = Levels("Level 0")
python_script_line_pipetype = Python(IN[1]=code_block_56.out0, IN[2]=code_block_56.out1, IN[3]=levels_2)  # "Python Script (Line-PipeType-PipeSystemType-Level)"; IronPython2; unwired: IN[0]
# ---------- python_script_line_pipetype.python (60 lines) ----------
import clr

clr.AddReference('RevitServices')
import RevitServices
from RevitServices.Persistence import DocumentManager
from RevitServices.Transactions import TransactionManager
doc = DocumentManager.Instance.CurrentDBDocument

clr.AddReference('RevitAPI')
import Autodesk
from Autodesk.Revit.DB import *

clr.AddReference('RevitNodes')
import Revit
clr.ImportExtensions(Revit.Elements)
clr.ImportExtensions(Revit.GeometryConversion)


if isinstance(IN[0], list):
	lines = IN[0]
else:
	lines = [IN[0]]
	
FirstPoint = [x.StartPoint for x in lines]
SecondPoint = [x.EndPoint for x in lines]

if isinstance(IN[1], list):
	pipetype = UnwrapElement(IN[1])
else:
	pipetype = [UnwrapElement(IN[1])]
ptl = len(pipetype)

if isinstance(IN[2], list):
	systemtype = UnwrapElement(IN[2])
else:
	systemtype = [UnwrapElement(IN[2])]
stl = len(systemtype)
if isinstance(IN[3], list):
	level = UnwrapElement(IN[3])
else:
	level = [UnwrapElement(IN[3])]
ll = len(level)

elements = []

TransactionManager.Instance.EnsureInTransaction(doc)
for i,x in enumerate(FirstPoint):
	
	levelid = level[i%ll].Id
	systypeid = systemtype[i%stl].Id
	pipetypeid = pipetype[i%ptl].Id
		
	pipeplaceholder = Autodesk.Revit.DB.Plumbing.Pipe.CreatePlaceholder(doc,systypeid,pipetypeid,levelid,x.ToXyz(),SecondPoint[i].ToXyz())
	
	elements.append(pipeplaceholder.ToDSType(False))	

TransactionManager.Instance.TransactionTaskDone()


OUT = elements
# ----------------------------------------
getLocation_5 = Element.GetLocation(element=python_script_line_pipetype)
convertPipePlaceholders_2 = Gorilla.Placeholders.ConvertPlaceholder.ConvertPipePlaceholders(pipePlaceholders=python_script_line_pipetype)  # frozen
string_3 = StringInput("Diameter")
watch_27 = Watch()  # unwired: arg0
code_block_57 = CodeBlock { 1; }
getItemAtIndex_52 = List.GetItemAtIndex(list=watch_27@L2, index=code_block_57)
radius_2_diameter_3 = CodeBlock(x=getItemAtIndex_52) { x*2; }
code_block_58 = CodeBlock(x=radius_2_diameter_3) { x; 50; }
setParameterByName_3 = Element.SetParameterByName(element=convertPipePlaceholders_2, parameterName=string_3, value=code_block_58.out1)
code_block_59 = CodeBlock { 0; }
getItemAtIndex_53 = List.GetItemAtIndex(list=watch_27@L2, index=code_block_59)

select_model_element_7 = DSModelElementSelection()  # 1 picked in the model
select_model_element_8 = DSModelElementSelection()  # 1 picked in the model
select_model_element_9 = DSModelElementSelection()  # 1 picked in the model
by3MEPCurves_3 = Custom[Tee.By3MEPCurves](Main_MEPCurve=select_model_element_7, Main_MEPCurve_2=select_model_element_8, Branch_MEPCurve=select_model_element_9)
select_model_element_10 = DSModelElementSelection()  # 1 picked in the model
select_model_element_11 = DSModelElementSelection()  # 1 picked in the model
byMEPCurves_4 = Custom[MEPFitting.ByMEPCurves](MEPCurve1=select_model_element_10, MEPCurve2=select_model_element_11)
addElbow = Gorilla.MEPObjects.AddMEPFittings.AddElbow()  # unwired: StartConnector, FinishConnector
connectors = RevitModel.Element.Connectors()  # unwired: elements
connectors_2 = RevitModel.Element.Connectors()  # unwired: elements
code_block_60 = CodeBlock(x=connectors, y=connectors_2) { x[0]; y[0]; }
location = Custom[Connector.Location](connector=code_block_60.out0)  # package MEPover; Returns the location of a connector
location_2 = Custom[Connector.Location](connector=code_block_60.out1)
distanceTo_2 = Geometry.DistanceTo(geometry=location, other=location_2, lacing=CrossProduct)
code_block_61 = CodeBlock { [a,waitfor]; }  # unwired: a, waitfor
code_block_62 = CodeBlock(x=code_block_60.out0, y=code_block_60.out1) { x[0]; y[1]; }
